# Dynamo graph ARV_MBTuongXayTang_v1_20261109_1721_truoc_bat_quy_tac.dyn "ARV_MBTuongXayTang_v1" (Dynamo 4.2.1.5887)
# author: Archivina BIM
# Mặt bằng tường xây (định vị tường) cả tầng theo mẫu FPT P5 A.CD.04.07: view, trục 2 đầu, dim trục, chuỗi định vị tường mặt ngoài + hành lang, legend ký hiệu tường, sheet A1. Mặc định dry-run. TRẠNG THÁI: CHƯA DUYỆT.

# group: 1. Đầu vào
# Revit 2027 / Dynamo 4.2. Mở file LOCAL (không phải central). Giữ Dry-run = True cho lần chạy đầu, đọc Báo cáo rồi mới đổi False. Đã có view / sheet cùng tên → bật Làm lại.
in_0_level_trống_level_của_view = StringInput("")  # "IN[0] Level (trống = level của view đang mở)"; graph input
in_1_tên_view = StringInput("MB TƯỜNG XÂY TẦNG ĐIỂN HÌNH")  # graph input
in_2_view_template_chép_thông_số = StringInput("TC.04.MatBangTuongXay")  # graph input
in_3_tỷ_lệ_thử_lần_lượt = StringInput("100;150")  # graph input
in_4_số_hiệu_sheet = StringInput("A140")  # graph input
in_5_tên_sheet = StringInput("MẶT BẰNG TƯỜNG XÂY TẦNG ĐIỂN HÌNH")  # graph input
in_6_khung_tên = StringInput("AV-Khung A1(841x594)-Kien Truc")  # graph input
in_7_viewport_type = StringInput("AV-Title No Line")  # graph input
in_8_dim_type_dim_trục = StringInput("AV_Dim 2.2mm_Cut dim 6mm")  # graph input
in_9_dim_type_định_vị_tường = StringInput("AV_Dim 2.2mm_Cut dim 4mm")  # graph input
in_10_tên_legend_ghi_chú_tường = StringInput("GHI CHÚ TƯỜNG XÂY TẦNG ĐIỂN HÌNH")  # "IN[10] Tên legend ghi chú tường (trống = không làm)"; graph input
in_11_vật_liệu_lõi_hatch_mô_tả = StringInput("GachNung=AV_Hatch Gach Xay|Tường gạch đặc nung;BeTong=AV_Hatch BTCT|Cột, vách BTCT")  # graph input
in_12_room_hành_lang_cách = StringInput("Hành lang")  # graph input
in_13_dry_run_true_chỉ_báo_cáo = BoolSelector(true)  # graph input
in_14_làm_lại_dùng_lại_view_tạo = BoolSelector(false)  # "IN[14] Làm lại (dùng lại view, tạo lại sheet / legend)"; graph input
in_15_nhóm_sheet_tham_số_giá_trị = StringInput("01_GiaiDoan=03_TKBVTC;02_HangMuc=04_MatBangTuongXay")  # graph input
in_16_filter_ẩn_trục_link_kc = StringInput("Trục + Level- Kiến Trúc-Not")  # "IN[16] Filter ẩn trục link KC (trống = không đụng)"; graph input
in_17_đặt_lên_bản_vẽ_false_chỉ = BoolSelector(true)  # "IN[17] Đặt lên bản vẽ (False = chỉ dựng view)"; graph input
in_18_vùng_x0_y0_x1_y1_mm_trống = StringInput("")  # "IN[18] Vùng x0,y0,x1,y1 mm (trống = cả tầng; tách nhiều tờ: chạy mỗi vùng một lần)"; graph input
in_19_ẩn_trục_có_tên_bắt_đầu = StringInput("")  # "IN[19] Ẩn trục có tên bắt đầu bằng (cách ;, trống = không ẩn)"; graph input
in_20_trục_theo_cad_link_layer = StringInput("")  # "IN[20] Trục theo CAD link: layer đường trục;layer ký hiệu (trống = không theo CAD)"; graph input
in_21_line_style_nét_đứt_tại = StringInput("")  # "IN[21] Line style nét đứt tại đường cắt (có sẵn trong file)"; graph input
in_22_ẩn_tường_theo_tiền_tố_tên = StringInput("")  # "IN[22] Ẩn tường theo tiền tố tên type (cách ;, trống = không ẩn)"; graph input
in_23_số_chuỗi_dim_hành_lang_1 = StringInput("1")  # "IN[23] Số chuỗi dim hành lang (1 = gộp giữa, 2 = mỗi bên tường một chuỗi)"; graph input
in_24_chuỗi_hành_lang_chỉ_dim = StringInput("")  # "IN[24] Chuỗi hành lang chỉ dim cửa + trục (1 = có, trống = không)"; graph input
in_25_room_coi_như_ngoài_nhà_có = StringInput("")  # "IN[25] Room coi như ngoài nhà; có giá trị = mặt ngoài chỉ dim cửa sổ, cửa lùa, trục (VD Logia)"; graph input

# group: 2. Mặt bằng tường xây (Python)
# View 1/100 (chép template, không gắn), trục 2 đầu, dim trục 4 phía, chuỗi định vị tường mặt ngoài + hành lang (mặt lõi, má cửa, cột vách link KC, trục), legend ký hiệu tường, sheet A1; log CSV ở Documents\ARV_Logs. TRẠNG THÁI: CHƯA DUYỆT.
arv_mặt_bằng_tường_xây_tầng = Python(IN[0]=in_0_level_trống_level_của_view, IN[1]=in_1_tên_view, IN[2]=in_2_view_template_chép_thông_số, IN[3]=in_3_tỷ_lệ_thử_lần_lượt, IN[4]=in_4_số_hiệu_sheet, IN[5]=in_5_tên_sheet, IN[6]=in_6_khung_tên, IN[7]=in_7_viewport_type, IN[8]=in_8_dim_type_dim_trục, IN[9]=in_9_dim_type_định_vị_tường, IN[10]=in_10_tên_legend_ghi_chú_tường, IN[11]=in_11_vật_liệu_lõi_hatch_mô_tả, IN[12]=in_12_room_hành_lang_cách, IN[13]=in_13_dry_run_true_chỉ_báo_cáo, IN[14]=in_14_làm_lại_dùng_lại_view_tạo, IN[15]=in_15_nhóm_sheet_tham_số_giá_trị, IN[16]=in_16_filter_ẩn_trục_link_kc, IN[17]=in_17_đặt_lên_bản_vẽ_false_chỉ, IN[18]=in_18_vùng_x0_y0_x1_y1_mm_trống, IN[19]=in_19_ẩn_trục_có_tên_bắt_đầu, IN[20]=in_20_trục_theo_cad_link_layer, IN[21]=in_21_line_style_nét_đứt_tại, IN[22]=in_22_ẩn_tường_theo_tiền_tố_tên, IN[23]=in_23_số_chuỗi_dim_hành_lang_1, IN[24]=in_24_chuỗi_hành_lang_chỉ_dim, IN[25]=in_25_room_coi_như_ngoài_nhà_có)  # PythonNet3
# ---------- arv_mặt_bằng_tường_xây_tầng.python (2153 lines) ----------
# TRẠNG THÁI: CHƯA DUYỆT
# Mã nguồn của Python node trong ARV_MBTuongXayTang_v1.dyn (bản để review; .dyn nhúng đúng nội dung này).
# Revit 2027 / Dynamo 4.2 (PythonNet3).
#
# Trình bày MẶT BẰNG TƯỜNG XÂY (định vị tường) cả tầng theo mẫu FPT P5 A.CD.04.07 (KTS chốt 2026-11-03, G19):
#   1. View mặt bằng mới trên level IN[0] (tên IN[1]), chép thông số view template IN[2] vào view rồi BỎ gắn template
#      (template công ty để 1/150 – KHÔNG sửa template). Ẩn nội thất, thiết bị, Room, sàn. Tỷ lệ = số đầu tiên trong
#      IN[3] mà hình (kể cả dim, đầu trục) ước tính vừa vùng vẽ khung tên.
#   2. Trục của file: đầu trục 2D ở CẢ 2 ĐẦU, cách tường ngoài cùng GRID_END mm giấy. Dim trục 4 phía, mỗi phía
#      2 chuỗi: khoảng trục + kích thước tổng (dim type IN[8]).
#   3. Chuỗi định vị tường (dim type IN[9]): gom tường (lõi ≥ 80, thẳng, song song trục X / Y) thành TUYẾN thẳng hàng
#      (lệch tim ≤ 60, hở ≤ 2500, tổng dài ≥ 4000). Mỗi tuyến xét 2 phía (điểm mẫu cách mặt tường 400):
#        - một phía phần lớn KHÔNG có Room → mặt ngoài nhà: chuỗi đặt phía ngoài, cách mặt tường WALL_EXT mm giấy;
#        - không, mà một phía là Room công cộng IN[12] (hành lang, khu vực chung) → chuỗi phía đó, cách WALL_INT;
#        - cả 2 phía là phòng trong căn → không dim (chi tiết căn hộ đã dim).
#      Mốc: MẶT LÕI (gạch thô, bỏ trát) tường vuông góc chạm tuyến, mép cửa đi / cửa sổ trên tuyến (tham chiếu
#      Left / Right của family), đầu tường của tuyến, mặt cột / vách BTCT của file Revit link (kết cấu), trục.
#      Mốc cách nhau < DIM_MIN gộp; chữ số đoạn ngắn chồng nhau → kéo sang phía ngoài đường dim, lệch xen kẽ.
#   4. Legend IN[10] (nhân bản một legend có sẵn rồi vẽ): BẢNG KÝ HIỆU GHI CHÚ TƯỜNG – mỗi vật liệu lõi tường một
#      dòng (hatch theo IN[11], loại, các chiều dày lõi) + lưu ý chỉ ghi điều đúng với mô hình.
#   5. Sheet IN[4] / IN[5], khung tên IN[6], viewport type IN[7]: MB ở trên, giữa vùng vẽ; legend góc dưới trái.
#   6. Trục file link KC: tắt hiển thị view filter có sẵn IN[16] trong view (trục type không phải '…KT').
#   Không tạo / sửa type, style, view template, filter. Chưa làm: tag căn hộ, chi tiết điển hình cột vách giao tường
#   xây, dim trong lòng căn.
# INPUT
#   IN[0] (str)  Level (trống = level của view mặt bằng đang mở) – VD "TẦNG 3"; bản D:\AI để trống (nút pyRevit)
#   IN[1] (str)  Tên view – VD "MB TƯỜNG XÂY TẦNG ĐIỂN HÌNH"
#   IN[2] (str)  View template để chép thông số – VD "TC.04.MatBangTuongXay"
#   IN[3] (str)  Tỷ lệ thử lần lượt – VD "100;150"
#   IN[4] (str)  Số hiệu sheet – VD "A140"
#   IN[5] (str)  Tên sheet – VD "MẶT BẰNG TƯỜNG XÂY TẦNG ĐIỂN HÌNH"
#   IN[6] (str)  Khung tên (tên family hoặc type) – VD "AV-Khung A1(841x594)-Kien Truc"
#   IN[7] (str)  Viewport type – VD "AV-Title No Line"
#   IN[8] (str)  Dimension type dim trục – VD "AV_Dim 2.2mm_Cut dim 6mm"
#   IN[9] (str)  Dimension type định vị tường – VD "AV_Dim 2.2mm_Cut dim 4mm"
#   IN[10] (str) Tên legend ghi chú tường (trống = không làm) – VD "GHI CHÚ TƯỜNG XÂY TẦNG ĐIỂN HÌNH"
#   IN[11] (str) Vật liệu lõi → hatch | mô tả, cách nhau ';' – VD
#                "GachNung=AV_Hatch Gach Xay|Tường gạch đặc nung;BeTong=AV_Hatch BTCT|Cột, vách BTCT"
#                (vật liệu cột / vách link KC cũng thành một dòng, chiều dày "Theo hồ sơ KC")
#   IN[12] (str) Tên Room hành lang (cách ';') – VD "Hành lang". KTS 2026-11-03: KHÔNG dim trong lõi thang / phòng
#                kỹ thuật → bỏ "Khu vực chung" (G19 đặt tên đó cho sảnh thang, phòng kỹ thuật trong lõi)
#   IN[13] (bool) Dry-run: True = dựng thử rồi hoàn tác, chỉ báo cáo (mặc định True)
#   IN[14] (bool) Làm lại: đã có view / sheet / legend cùng tên → dựng lại (mặc định False = dừng). View cùng level
#                được DÙNG LẠI (xóa dim của view, giữ VG / ẩn hiện KTS đã chỉnh, không chép lại template); sheet xóa
#                rồi tạo mới; legend xóa nội dung, vẽ lại tại chỗ.
#   IN[15] (str) Tham số nhóm Project Browser của sheet "tên=giá trị;…" – VD
#                "01_GiaiDoan=03_TKBVTC;02_HangMuc=04_MatBangTuongXay" (G19: nhóm có sẵn, như sheet giữ chỗ A107)
#   IN[16] (str) View filter có sẵn để ẨN trục / level không phải kiến trúc (trục file link KC) – VD
#                "Trục + Level- Kiến Trúc-Not" (type trục không kết thúc 'KT'; trống = không đụng). Filter áp cả phần
#                tử link (ByHostView). Tool chỉ thêm filter vào view + tắt hiển thị, KHÔNG tạo / sửa filter.
#   IN[17] (bool) Đặt lên bản vẽ (mặc định True; D:\AI thêm 2026-11-04 cho nút một chạm). False = chỉ dựng view + legend,
#                không tạo / đụng sheet. Số hiệu IN[4] là sheet TRỐNG có sẵn (không view, không bảng thống kê) thì đặt
#                vào sheet đó, giữ tên / khung tên / tham số (như Chống thấm), không cần bật IN[14].
#   IN[18] (str) Vùng x0,y0,x1,y1 mm (trống = cả tầng; tách nhiều tờ: chạy mỗi vùng một lần) – VD "2380000,540313,2450000,590000"
#   IN[19] (str) Ẩn trục có tên bắt đầu bằng (cách ';', trống = không ẩn) – VD "XA;YA"
#   IN[20] (str) Trục theo CAD link: layer đường trục;layer ký hiệu (trống = không theo CAD) – VD "A-axis;A-Symbol"
#   IN[21] (str) Line style nét đứt tại đường cắt khi tách vùng (có sẵn trong file) – VD "AV-Net Dut Callout"
#   IN[22] (str) Ẩn tường theo tiền tố tên type (cách ';', trống = không ẩn) – VD "WF_;WA_F1"
#   IN[23] (str) Số chuỗi dim hành lang (1 = gộp giữa, 2 = mỗi bên tường một chuỗi)
#   IN[24] (str) Chuỗi hành lang chỉ dim cửa + trục (1 = có, trống = không)
#   IN[25] (str) Room coi như ngoài nhà; có giá trị = mặt ngoài chỉ dim cửa sổ, cửa lùa, trục – VD "Logia"
# OUTPUT
#   OUT[0] (list[str])  Báo cáo
#   OUT[1] (list)       Trống

import os
import io
import csv
import datetime
import unicodedata

DYNAMO = "IN" in globals()

if DYNAMO:
    import clr
    clr.AddReference("RevitAPI")
    from Autodesk.Revit.DB import (FilteredElementCollector, XYZ, Transaction, ModelPathUtils, BuiltInParameter,
                                   BuiltInCategory, Level, ViewType, ViewFamily, ViewFamilyType, ViewPlan, ViewSheet,
                                   Viewport, ViewportRotation, ElementId, Reference, FamilySymbol, FamilyInstance, ElementType, View,
                                   LocationPoint, LocationCurve, FailureProcessingResult, IFailuresPreprocessor,
                                   FailureSeverity, FilledRegion, FilledRegionType, CurveLoop, Line, TextNote,
                                   TextNoteOptions, TextNoteType, HorizontalTextAlignment, Category,
                                   ViewDuplicateOption, Wall, WallType, HostObjectUtils, ShellLayerType,
                                   ReferenceArray, Options, Solid, PlanarFace, DimensionType, Dimension,
                                   RevitLinkInstance, Grid, DatumEnds, DatumExtentType, GeometryInstance,
                                   FamilyInstanceReferenceType, ElementCategoryFilter, LogicalOrFilter,
                                   DocumentValidation, CurveElement, ParameterFilterElement, ScheduleSheetInstance,
                                   ImportInstance, Arc, PolyLine, GraphicsStyleType, ViewDetailLevel,
                                   OverrideGraphicSettings, FillPatternElement, Color, Material)
    from System.Collections.Generic import List
    try:
        clr.AddReference("RevitServices")
        from RevitServices.Persistence import DocumentManager
        from RevitServices.Transactions import TransactionManager
        doc = DocumentManager.Instance.CurrentDBDocument
    except Exception:          # chạy thử ngoài Dynamo (pyRevit): doc do môi trường cấp
        TransactionManager = None

TRANSACTION_NAME = u"ARV - Mặt bằng tường xây tầng"
SCRIPT_TAG = u"ARV_MBTuongXayTang_v1"

# Khung A1 AV-Khung A1(841x594): vùng vẽ NHÌN THẤY (đo 2026-10-22, xem ARV_DanTrangCanHo_v2) – mm giấy
AREA_X0, AREA_X1, AREA_Y0, AREA_Y1 = 36.0, 733.0, 17.0, 576.0
SHEET_PAD = 4.0            # mm giấy: cách mép vùng vẽ
LABEL_GAP = 2.0            # mm giấy: tên hình cách đáy khung viewport (dưới đầu trục)
LEGEND_SCALE = 50
LEGEND_H_GUESS = 70.0      # mm giấy: cao legend dùng lại (không vẽ lại) – để chọn tỷ lệ

# Vị trí dim / trục – mm GIẤY (nhân tỷ lệ ra mm thật)
WALL_EXT = 7.0             # chuỗi định vị tường mặt ngoài nhà cách mặt tường
WALL_INT = 4.5             # chuỗi định vị tường phía hành lang cách mặt tường
GRID_CHAIN = 13.0          # chuỗi khoảng trục cách tường ngoài cùng
GRID_TOTAL = 19.0          # dim tổng
GRID_END = 22.0            # đầu đường trục
CROP_PAD = 31.0            # crop cách tường ngoài cùng (chứa đầu trục) – G19 1/100: khung viewport 694 mm ≤ 697
CORR_MERGE = 20.0          # 2 chuỗi hành lang đối diện, khoảng thông thủy < → gộp 1 chuỗi giữa (1/100: 2000 mm)
TEXT_DROP = 3.0            # chữ số bị chồng → dời sang phía đường dim, cách đường dim
TEXT_CHAR_W = 1.35         # bề rộng 1 chữ số dim (chữ 2,2 mm)

# mm thật
CORE_MIN = 80.0            # lõi tường ≥ → tường xây / BTCT cần định vị
ALIGN_TOL = 60.0           # lệch tim để cùng tuyến
ALIGN_GAP = 8000.0         # hở tối đa giữa 2 đoạn cùng tuyến (G19: tường bao trục X1 đứt 7700 ở logia / vách KC)
ALIGN_MIN = 4000.0         # tổng dài tối thiểu của tuyến
SIDE_PROBE = 400.0         # điểm mẫu phía tuyến cách mặt tường
SIDE_STEP = 600.0
EXT_MAX = 12000.0          # đầu chuỗi kéo tới tường / KC gặp đầu tiên trong khoảng này
CLIP_STEP = 100.0          # bước dò dọc đường dim tìm đoạn nằm trong căn hộ
CLIP_MIN = 1000.0          # đoạn chuỗi còn lại ngắn hơn → bỏ
FACADE_STEP = 25.0         # mm giấy: mặt ngoài so le lệch hàng ≤ → gộp một chuỗi ở hàng ngoài cùng
FACADE_JOIN = 3000.0       # mm: hai đoạn mặt ngoài hở ≤ → coi là liền nhau
FACADE_DEPTH = 3000.0      # mm: tường / cột trong dải này tính từ mặt ngoài vào → mặt ngoài còn tiếp tục
FACADE_HOLE = 3000.0       # mm: đoạn không có tường / cột dài hơn → hết mặt ngoài
FACADE_WALK = 15000.0      # mm: quãng dò tối đa từ đầu chuỗi
GRID_END_REACH = 1000.0   # mm: trục cách đầu chuỗi mặt ngoài ≤ → chuỗi kéo tới trục đó
LOGIA_MERGE = 15.0         # mm giấy: chuỗi logia đưa ra ngoài cách chuỗi mặt ngoài ≤ → gộp mốc
FACADE_ROW_GAP = 8.0       # mm giấy: hàng dim trục cách chuỗi mặt ngoài (mẫu KTS ~ 800 ở 1/100)
FACADE_ROW_SKIP = 25.0     # mm giấy: chuỗi cách mép tường ngoài cùng ≤ → đã có hàng dim trục ở mép, không thêm
CORR_TWO_MIN = 14.0       # mm giấy: hành lang hẹp hơn → không đủ chỗ 2 chuỗi, về 1 chuỗi giữa
VISIBLE_TOL = 30.0        # mm: cấu kiện nhô khỏi mặt tường phía đặt chuỗi ít hơn → khuất, không lấy mốc ở hành lang
EXT_MIN = 30.0           # gần hơn = đầu chuỗi đã chạm tường, không kéo
EXT_FACE_TOL = 150.0       # mốc cuối: mặt lệch biên gần của vật gặp ≤ (mặt lõi lùi trát 15; khuôn cửa sổ lùi
#                            so với hộp bao gồm bậu / nẹp)
BAND_PAD = 60.0            # dải tuyến nới thêm khi tìm tường vuông góc / kết cấu chạm tuyến
JAMB_GAP_MAX = 30.0        # má tường thô nằm NGOÀI mép family ≤ (cửa sổ G19: 5 mm chèn foam)
JAMB_IN_MAX = 60.0         # má tường thô lùi VÀO trong mép family ≤ (cửa đi G19: nẹp khuôn trùm 20 mm)
OPEN_SKIP = 120.0         # mặt đầu tường cách mép cửa < → là má cửa (đã có mốc cửa) → bỏ
DIM_MIN = 30.0             # mốc cách nhau < → gộp
CUT_Z = 1000.0             # cao độ mặt cắt so với level

HIDE_CATS = ("OST_Furniture", "OST_PlumbingFixtures", "OST_MechanicalEquipment", "OST_Rooms", "OST_RoomTags",
             "OST_Floors", "OST_Casework", "OST_SpecialityEquipment", "OST_FurnitureSystems")
TEXT_TITLE = u"AV_Text 3mm_Arial-Bold"
TEXT_TITLE_ALT = (u"AV_Text 3mm_bold",)   # tên khác của cùng kiểu chữ ở template dự án khác (HQV)
TEXT_BODY = u"AV_Arial_2 mm_Dot"
NOTE_COLS = (20.0, 96.0, 34.0)

PRI_GRID, PRI_CORE, PRI_STRUCT, PRI_OPEN, PRI_END = 0, 1, 2, 3, 4


class StopReport(Exception):
    def __init__(self, lines):
        Exception.__init__(self, lines[0] if lines else u"")
        self.lines = lines


def to_mm(feet):
    return feet * 304.8


def from_mm(mm):
    return mm / 304.8


def norm(s):
    return unicodedata.normalize("NFC", (s or u"")).strip()


def split_list(text):
    return [s.strip() for s in (text or u"").split(u";") if s.strip()]


def get_name(element):
    try:
        return element.Name
    except Exception:
        p = element.get_Parameter(BuiltInParameter.ALL_MODEL_TYPE_NAME)
        return p.AsString() if p else u""


def id_value(eid):
    v = getattr(eid, "Value", None)
    return v if v is not None else eid.IntegerValue


def is_central_file(document):
    if not document.IsWorkshared:
        return False
    try:
        central = ModelPathUtils.ConvertModelPathToUserVisiblePath(document.GetWorksharingCentralModelPath())
    except Exception:
        return False
    return os.path.normcase(central or "") == os.path.normcase(document.PathName or "")


def delete_ids(elements):
    ids = List[ElementId]()
    for e in elements:
        ids.Add(e.Id)
    if ids.Count:
        doc.Delete(ids)


def by_name(cls, name):
    n = norm(name)
    return next((e for e in FilteredElementCollector(doc).OfClass(cls).ToElements() if norm(get_name(e)) == n), None)


def find_type(bic, name):
    n = norm(name)
    fam, sep, typ = n.partition(u" : ")          # "Family : Type" (hộp thoại nút pyRevit, D:\AI 2026-11-04)
    for e in FilteredElementCollector(doc).OfCategory(bic).WhereElementIsElementType().ToElements():
        if sep and norm(getattr(e, "FamilyName", u"")) == fam and norm(get_name(e)) == typ:
            return e
    for e in FilteredElementCollector(doc).OfCategory(bic).WhereElementIsElementType().ToElements():
        if norm(get_name(e)) == n or norm(getattr(e, "FamilyName", u"")) == n:
            return e
    return None


def find_vp_type(name):
    """Viewport type (ElementType family 'Viewport', không có category) theo tên."""
    n = norm(name)
    return next((e for e in FilteredElementCollector(doc).OfClass(ElementType).ToElements()
                 if norm(getattr(e, "FamilyName", u"")) == u"Viewport" and norm(get_name(e)) == n), None)


def parse_materials(text):
    """'GachNung=AV_Hatch Gach Xay|Tường gạch đặc nung;…' → [(từ khoá vật liệu, tên hatch, mô tả)]."""
    res = []
    for item in split_list(text):
        if u"=" not in item:
            continue
        key, rest = item.split(u"=", 1)
        hatch, _, more = rest.partition(u"|")
        desc, _, pat = more.partition(u"|")     # phần 3 (tùy chọn): fill pattern của ô ký hiệu, trùng pattern mặt bằng
        res.append((norm(key).lower(), norm(hatch), norm(desc), norm(pat)))
    return res


# --- Hình học tường -----------------------------------------------------------------
class WallInfo(object):
    """Tường thẳng song song trục: ax = True khi chạy dọc X. c = tọa độ tim theo phương vuông góc, hw = nửa dày,
    lo / hi = phạm vi dọc tuyến (hộp bao), cores = [(tọa độ mm, Reference mặt lõi)] theo phương vuông góc tuyến."""

    def __init__(self, w, ax, c, hw, lo, hi, cores, core_mm, mat):
        self.w, self.ax, self.c, self.hw, self.lo, self.hi = w, ax, c, hw, lo, hi
        self.cores, self.core_mm, self.mat = cores, core_mm, mat


def core_layers(wt):
    """(dày lõi mm, dày lớp ngoài lõi mm, dày lớp trong lõi mm, tên vật liệu lõi) – None nếu không có lõi."""
    cs = wt.GetCompoundStructure()
    if cs is None:
        return None
    i0, i1 = cs.GetFirstCoreLayerIndex(), cs.GetLastCoreLayerIndex()
    if i0 < 0 or i1 < 0:
        return None
    layers = list(cs.GetLayers())
    core = sum(to_mm(l.Width) for l in layers[i0:i1 + 1])
    t_ext = sum(to_mm(l.Width) for l in layers[:i0])
    t_int = sum(to_mm(l.Width) for l in layers[i1 + 1:])
    m = doc.GetElement(layers[i0].MaterialId)
    return core, t_ext, t_int, (get_name(m) if m is not None else u"")


def core_faces(w, t_ext, t_int):
    """Mặt LÕI tường (lớp gạch, bỏ trát): tham chiếu ẩn '<UniqueId>:-9999:2:SURFACE' (lõi phía ngoài) /
    ':-9999:3:SURFACE' (lõi phía trong) – như ARV_DanTrangCanHo_v2 (đo trên G19 2026-10-28). Không có lớp trát →
    mặt bên tường. Trả về [(tọa độ mm theo pháp tuyến, Reference)]."""
    res = []
    for shell, idx, t in ((ShellLayerType.Exterior, 2, t_ext), (ShellLayerType.Interior, 3, t_int)):
        side = HostObjectUtils.GetSideFaces(w, shell)
        if side is None or side.Count == 0:
            continue
        f = w.GetGeometryObjectFromReference(side[0])
        if not isinstance(f, PlanarFace):
            continue
        nv = f.FaceNormal
        if abs(nv.X) > 0.99:
            cd, sg = to_mm(f.Origin.X), (1.0 if nv.X > 0 else -1.0)
        else:
            cd, sg = to_mm(f.Origin.Y), (1.0 if nv.Y > 0 else -1.0)
        if t < 0.5:
            res.append((cd, side[0]))
        else:
            ref = Reference.ParseFromStableRepresentation(doc, u"{}:-9999:{}:SURFACE".format(w.UniqueId, idx))
            res.append((cd - sg * t, ref))
    return res


def collect_walls(level):
    z = level.Elevation + from_mm(CUT_Z)
    out = []
    for w in FilteredElementCollector(doc).OfClass(Wall).WhereElementIsNotElementType().ToElements():
        bb = w.get_BoundingBox(None)
        if bb is None or not (bb.Min.Z <= z <= bb.Max.Z):
            continue
        wt = doc.GetElement(w.GetTypeId())
        if not isinstance(wt, WallType):
            continue
        cl = core_layers(wt)
        if cl is None or cl[0] < CORE_MIN:
            continue
        lc = getattr(w.Location, "Curve", None)
        if not isinstance(lc, Line):
            continue
        d = lc.Direction
        if abs(d.X) > 0.999:
            ax = True
        elif abs(d.Y) > 0.999:
            ax = False
        else:
            continue
        c = to_mm(lc.Origin.Y if ax else lc.Origin.X)
        lo = to_mm(bb.Min.X if ax else bb.Min.Y)
        hi = to_mm(bb.Max.X if ax else bb.Max.Y)
        try:
            cores = core_faces(w, cl[1], cl[2])
        except Exception:
            cores = []
        out.append(WallInfo(w, ax, c, to_mm(w.Width) / 2.0, lo, hi, cores, cl[0], cl[3]))
    return out


def opening_faces(e, view, along_x):
    """2 mặt ngoài cùng (min / max) của khuôn cửa theo phương tường: ((tọa độ, Ref), (tọa độ, Ref)) – như
    opening_edges của ARV_DanTrangCanHo_v2 (hình học symbol + Transform). Không có → None."""
    opt = Options()
    opt.ComputeReferences = True
    opt.View = view
    fl = []
    for gi in (e.get_Geometry(opt) or []):
        if not isinstance(gi, GeometryInstance):
            continue
        T = gi.Transform
        for s in gi.GetSymbolGeometry():
            if not isinstance(s, Solid):
                continue
            for f in s.Faces:
                if not isinstance(f, PlanarFace) or f.Reference is None:
                    continue
                nv = T.OfVector(f.FaceNormal)
                if (abs(nv.X) if along_x else abs(nv.Y)) > 0.999:
                    p = T.OfPoint(f.Origin)
                    fl.append((to_mm(p.X if along_x else p.Y), f.Reference))
    if len(fl) < 2:
        return None
    return min(fl, key=lambda q: q[0]), max(fl, key=lambda q: q[0])


SLIDING_WORDS = (u"trượt", u"truot", u"lùa", u"lua")
FACADE_REFS = set()                # id(Reference) mép cửa sổ / cửa lùa
OUTSIDE_ROOMS = set()              # tên Room coi như ngoài nhà (IN[25])


def collect_openings(level, view):
    """{id tường chủ: [(mép nhỏ (tọa độ, Ref), mép lớn (tọa độ, Ref))]} – cửa đi / cửa sổ trên tường thẳng.
    Mép = mặt hình học THẬT của khuôn (G19 2026-11-03: ước theo Width + hướng tay → vài cửa đảo Left / Right,
    đoạn dim chồng nhau '1610 / 2400'). Không lấy được hình học → Left / Right ước theo Width."""
    flt = LogicalOrFilter(ElementCategoryFilter(BuiltInCategory.OST_Doors),
                          ElementCategoryFilter(BuiltInCategory.OST_Windows))
    res, jamb_cache = {}, {}
    for e in FilteredElementCollector(doc).WherePasses(flt).WhereElementIsNotElementType().ToElements():
        if not isinstance(e, FamilyInstance) or e.Host is None or e.LevelId != level.Id:
            continue
        lp = e.Location
        hc = getattr(e.Host.Location, "Curve", None)
        if not isinstance(lp, LocationPoint) or not isinstance(hc, Line):
            continue
        along_x = abs(hc.Direction.X) > 0.999
        if not along_x and abs(hc.Direction.Y) <= 0.999:
            continue
        edge = opening_faces(e, view, along_x)
        if edge is None:
            wp = e.Symbol.LookupParameter("Width") or e.LookupParameter("Width")
            L = e.GetReferences(FamilyInstanceReferenceType.Left)
            R = e.GetReferences(FamilyInstanceReferenceType.Right)
            if wp is None or L.Count == 0 or R.Count == 0:
                continue
            cc, h = to_mm(lp.Point.X if along_x else lp.Point.Y), to_mm(wp.AsDouble()) / 2.0
            hand = e.HandOrientation.X if along_x else e.HandOrientation.Y
            a, b = (cc - h, L[0]), (cc + h, R[0])
            edge = (a, b) if hand >= 0 else ((cc - h, R[0]), (cc + h, L[0]))
        edge = rough_jambs(e.Host, along_x, edge, jamb_cache)
        fam = norm(e.Symbol.FamilyName).lower()
        if id_value(e.Category.Id) == -2000014 or any(k in fam for k in SLIDING_WORDS):   # -2000014 = OST_Windows
            FACADE_REFS.add(id(edge[0][1]))          # mặt ngoài chỉ dim cửa sổ + cửa lùa
            FACADE_REFS.add(id(edge[1][1]))
        res.setdefault(id_value(e.Host.Id), []).append(edge)
    return res


def rough_jambs(wall, along_x, edge, cache):
    """KTS 2026-11-03: cửa sổ VÀ cửa đi dim vào MÁ TƯỜNG THÔ. Mốc = mặt má lỗ trên tường host gần mép ngoài cùng của
    family nhất: nằm ngoài mép ≤ JAMB_GAP_MAX (cửa sổ cách tường 5 mm chèn foam – W2_2200X2350: khuôn 2200, lỗ 2210)
    hoặc lùi vào trong ≤ JAMB_IN_MAX (cửa đi có nẹp khuôn trùm ra ngoài lỗ – DW01_800X2200: nẹp ±420, lỗ ±400).
    Không có → giữ mặt ngoài cùng của family."""
    key = id_value(wall.Id)
    if key not in cache:
        opt = Options()
        opt.ComputeReferences = True
        faces = []
        for s in (wall.get_Geometry(opt) or []):
            if not isinstance(s, Solid):
                continue
            for f in s.Faces:
                if isinstance(f, PlanarFace) and f.Reference is not None:
                    nv = f.FaceNormal
                    if abs(nv.X) > 0.999:
                        faces.append((True, to_mm(f.Origin.X), f.Reference))
                    elif abs(nv.Y) > 0.999:
                        faces.append((False, to_mm(f.Origin.Y), f.Reference))
        cache[key] = faces
    fs = [(cd, r) for ax_, cd, r in cache[key] if ax_ == along_x]
    (ca, ra), (cb, rb) = edge
    lo = [q for q in fs if -JAMB_IN_MAX <= ca - q[0] <= JAMB_GAP_MAX]
    hi = [q for q in fs if -JAMB_IN_MAX <= q[0] - cb <= JAMB_GAP_MAX]
    a = min(lo, key=lambda q: abs(ca - q[0])) if lo else (ca, ra)
    b = min(hi, key=lambda q: abs(q[0] - cb)) if hi else (cb, rb)
    return a, b


def link_material(ld, e):
    """Tên vật liệu kết cấu của cột (Structural Material, instance rồi type) / vách (lớp lõi) trong file link."""
    try:
        if isinstance(e, Wall):
            cs = ld.GetElement(e.GetTypeId()).GetCompoundStructure()
            i0 = cs.GetFirstCoreLayerIndex() if cs is not None else -1
            m = ld.GetElement(list(cs.GetLayers())[i0].MaterialId) if i0 >= 0 else None
        else:
            p = e.get_Parameter(BuiltInParameter.STRUCTURAL_MATERIAL_PARAM)
            m = ld.GetElement(p.AsElementId()) if p is not None else None
            if m is None:
                tp = ld.GetElement(e.GetTypeId()).get_Parameter(BuiltInParameter.STRUCTURAL_MATERIAL_PARAM)
                m = ld.GetElement(tp.AsElementId()) if tp is not None else None
        return get_name(m) if m is not None else u""
    except Exception:
        return u""


def collect_structure(level, warns, struct_mats):
    """Cột / vách của file Revit link cắt qua mặt cắt: [(x0, y0, x1, y1, [(trục X?, tọa độ mm, Reference link)])].
    struct_mats (set) nhận tên vật liệu kết cấu – cho dòng BTCT của bảng ký hiệu tường (G19: AV_BeTongCotThep)."""
    flt = LogicalOrFilter(ElementCategoryFilter(BuiltInCategory.OST_StructuralColumns),
                          ElementCategoryFilter(BuiltInCategory.OST_Walls))
    opt = Options()
    opt.ComputeReferences = True
    z = level.Elevation + from_mm(CUT_Z)
    res = []
    for lk in FilteredElementCollector(doc).OfClass(RevitLinkInstance).ToElements():
        ld = lk.GetLinkDocument()
        if ld is None:
            continue
        T = lk.GetTotalTransform()
        n0 = len(res)
        for e in FilteredElementCollector(ld).WherePasses(flt).WhereElementIsNotElementType().ToElements():
            bb = e.get_BoundingBox(None)
            if bb is None:
                continue
            mn, mx = T.OfPoint(bb.Min), T.OfPoint(bb.Max)
            if not (min(mn.Z, mx.Z) <= z <= max(mn.Z, mx.Z)):
                continue
            if isinstance(e, Wall):       # vách kết cấu: chỉ lấy loại có lõi BTCT (bỏ lớp hoàn thiện mỏng)
                if to_mm(e.Width) < CORE_MIN:
                    continue
            geo = e.get_Geometry(opt)
            if geo is None:
                continue
            solids = []
            for g in geo:
                if isinstance(g, Solid) and g.Volume > 0:
                    solids.append(g)
                elif isinstance(g, GeometryInstance):
                    for g2 in g.GetInstanceGeometry():
                        if isinstance(g2, Solid) and g2.Volume > 0:
                            solids.append(g2)
            faces = []
            for s in solids:
                for f in s.Faces:
                    if not isinstance(f, PlanarFace) or f.Reference is None:
                        continue
                    nv, p = T.OfVector(f.FaceNormal), T.OfPoint(f.Origin)
                    try:
                        if abs(nv.X) > 0.999:
                            faces.append((True, to_mm(p.X), f.Reference.CreateLinkReference(lk)))
                        elif abs(nv.Y) > 0.999:
                            faces.append((False, to_mm(p.Y), f.Reference.CreateLinkReference(lk)))
                    except Exception:
                        pass
            if faces:
                mat = norm(link_material(ld, e))
                if mat:
                    struct_mats.add(mat)
                res.append((to_mm(min(mn.X, mx.X)), to_mm(min(mn.Y, mx.Y)), to_mm(max(mn.X, mx.X)),
                            to_mm(max(mn.Y, mx.Y)), faces))
        if len(res) > n0:
            warns.append(u"Mốc kết cấu từ link '{}': {} cột / vách.".format(get_name(lk), len(res) - n0))
    return res


# --- View, trục ---------------------------------------------------------------------
def walls_box(walls):
    xs, ys = [], []
    for wi in walls:
        bb = wi.w.get_BoundingBox(None)
        xs += [to_mm(bb.Min.X), to_mm(bb.Max.X)]
        ys += [to_mm(bb.Min.Y), to_mm(bb.Max.Y)]
    return min(xs), min(ys), max(xs), max(ys)


def pick_scale(scales, box, legend_h, stagger=0.0):
    """(tỷ lệ, quay 90°): mỗi tỷ lệ thử đặt thẳng rồi quay, hết mới xuống tỷ lệ nhỏ hơn (KTS: quay trước, giảm tỷ lệ
    sau). MB gồm tường + dim + đầu trục, ước theo CROP_PAD; legend nằm phía dưới. Không tỷ lệ nào vừa → tỷ lệ cuối,
    đặt thẳng; make_sheet sẽ cảnh báo tràn."""
    aw = AREA_X1 - AREA_X0 - 2 * SHEET_PAD
    ah = AREA_Y1 - AREA_Y0 - 2 * SHEET_PAD
    for s in scales:
        w = (box[2] - box[0]) / s + 2 * (CROP_PAD + stagger)
        h = (box[3] - box[1]) / s + 2 * CROP_PAD
        if w <= aw and h + legend_h + 12.0 <= ah:
            return s, False
        if h <= aw and w + legend_h + 12.0 <= ah:
            return s, True
    return scales[-1], False


def hide_wall_types(view, prefixes):
    """Ẩn trong view các tường theo tiền tố tên type (len chân tường HQV: WF_Len…; filter 'LCT' của template không bắt)."""
    if not prefixes:
        return 0
    ids = List[ElementId]()
    for w in FilteredElementCollector(doc, view.Id).OfClass(Wall).ToElements():
        if any(norm(get_name(doc.GetElement(w.GetTypeId()))).startswith(p) for p in prefixes) and w.CanBeHidden(view):
            ids.Add(w.Id)
    if ids.Count:
        view.HideElements(ids)
    return ids.Count


def draw_cut_lines(view, box, cut, scale, style_name, warns):
    """Nét đứt tại mép cắt của tờ (tách vùng). Làm lại: xóa nét cũ cùng line style nằm đúng tuyến cắt (detail line
    không có tham số Comments để đánh dấu – đo 2026-11-08)."""
    if not any(c is not None for c in cut):
        return
    subs = doc.Settings.Categories.get_Item(BuiltInCategory.OST_Lines).SubCategories
    style = None
    if subs.Contains(style_name):
        style = subs.get_Item(style_name).GetGraphicsStyle(GraphicsStyleType.Projection)
    if style is None:
        warns.append(u"Không có line style '{}' (IN[21]) → không vẽ nét đứt đường cắt.".format(style_name))
        return
    ov = CUT_OVER * scale
    z = view.GenLevel.Elevation
    existing = [e for e in FilteredElementCollector(doc, view.Id).OfClass(CurveElement).ToElements()
                if e.LineStyle is not None and e.LineStyle.Id == style.Id and isinstance(e.GeometryCurve, Line)]
    for i, val in enumerate(cut):
        if val is None:
            continue
        inward = CUT_LINE_IN if i < 2 else -CUT_LINE_IN
        along = val + inward
        delete_ids([e for e in existing
                    if abs(to_mm(e.GeometryCurve.GetEndPoint(0).Y if i in (1, 3) else e.GeometryCurve.GetEndPoint(0).X)
                           - along) < 1.0
                    and abs(to_mm(e.GeometryCurve.GetEndPoint(1).Y if i in (1, 3) else e.GeometryCurve.GetEndPoint(1).X)
                            - along) < 1.0])
        if i in (1, 3):
            p, q = XYZ(from_mm(box[0] - ov), from_mm(val + inward), z), XYZ(from_mm(box[2] + ov), from_mm(val + inward), z)
        else:
            p, q = XYZ(from_mm(val + inward), from_mm(box[1] - ov), z), XYZ(from_mm(val + inward), from_mm(box[3] + ov), z)
        dc = doc.Create.NewDetailCurve(view, Line.CreateBound(p, q))
        dc.LineStyle = style


def make_view(level, name, template, scale, box, old=None, cut=(None, None, None, None), stagger=0.0):
    """old: view cùng tên đã có (Làm lại) → dùng lại, xóa dim của view, KHÔNG chép lại template – giữ VG KTS đã
    chỉnh (G19 2026-11-03: tắt Grids link KC bị mất khi tool xóa view tạo mới)."""
    if old is not None:
        v = old
        delete_ids([d for d in FilteredElementCollector(doc, v.Id).OfClass(Dimension).ToElements()
                    if d.OwnerViewId == v.Id])
    else:
        vft = next((t for t in FilteredElementCollector(doc).OfClass(ViewFamilyType).ToElements()
                    if t.ViewFamily == ViewFamily.FloorPlan), None)
        if vft is None:
            raise StopReport([u"DỪNG: file không có View Family Type mặt bằng."])
        v = ViewPlan.Create(doc, vft.Id, level.Id)
        v.ViewTemplateId = ElementId.InvalidElementId
        v.Name = name
        if template is not None:
            v.ApplyViewTemplateParameters(template)
            v.ViewTemplateId = ElementId.InvalidElementId
    v.Scale = scale
    v.DetailLevel = ViewDetailLevel.Fine   # Fine mới có nét lớp trát; view dùng lại có thể đã bị đổi (KTS 2026-11-08)
    for name_ in HIDE_CATS:
        try:
            c = Category.GetCategory(doc, getattr(BuiltInCategory, name_))
            if c is not None and v.CanCategoryBeHidden(c.Id):
                v.SetCategoryHidden(c.Id, True)
        except Exception:
            pass
    pad = CROP_PAD * scale
    pad_x = pad + stagger * scale    # chỗ cho đầu trục ngang kéo so le (chỉ khi trục theo CAD)
    v.CropBoxActive = True
    cb = v.CropBox
    cb.Min = XYZ(from_mm(box[0] - pad_x if cut[0] is None else cut[0]),
                 from_mm(box[1] - pad if cut[1] is None else cut[1]), cb.Min.Z)
    cb.Max = XYZ(from_mm(box[2] + pad_x if cut[2] is None else cut[2]),
                 from_mm(box[3] + pad if cut[3] is None else cut[3]), cb.Max.Z)
    v.CropBox = cb
    v.CropBoxVisible = False
    doc.Regenerate()
    return v


def hide_by_filter(view, name, warns):
    """Tắt hiển thị view filter có sẵn tên `name` trong view (thêm vào view nếu chưa có). G19 2026-11-03: filter
    'Trục + Level- Kiến Trúc-Not' ẩn trục 'AV_Truc Dinh Vi-KC' của link KC – khung viewport 766 → 695 mm."""
    if not name.strip():
        return False
    f = by_name(ParameterFilterElement, name)
    if f is None:
        warns.append(u"Không có view filter '{}' → trục file link KC vẫn hiện (tắt tay trong VG).".format(name))
        return False
    try:
        if id_value(f.Id) not in [id_value(i) for i in view.GetFilters()]:
            view.AddFilter(f.Id)
        view.SetFilterVisibility(f.Id, False)
        return True
    except Exception as ex:
        warns.append(u"Không tắt được filter '{}' ({}) – tắt tay trong VG.".format(name, ex))
        return False


CUT_OFFSET = 2.5           # mm giấy: đường cắt lệch khỏi trục tại đường cắt, về phía tờ kia (không trùng nét trục)
CUT_LINE_IN = 30.0         # mm: nét đứt lùi vào trong mép crop để không bị crop xén
CUT_OVER = 12.0            # mm giấy: nét đứt nhô ra ngoài tường hai đầu
GRID_STAGGER = 12.0       # mm giấy: đầu trục kéo xa hơn để không đè trục sát bên (CAD: YB6, YB9, YB14 kéo dài, YB2 gập)
CAD_BUBBLE_R = 5000.0      # mm: tâm ký hiệu cách đầu đường trục ≤ → đầu đó có đầu trục (CAD HQV: tới 4575)
CAD_BOX_TOL = 500.0        # mm: trục nằm sát ngoài hộp tường vẫn thuộc vùng (trục tại đường cắt hiện ở cả 2 tờ)
CAD_NEAR = 15000.0         # mm: đầu trục CAD cách mép vùng ≤ → trục thuộc mép đó của vùng


def read_cad_grids(axis_layer, symbol_layer):
    """Đường trục + ký hiệu đầu trục trên CAD link (layer so theo phần sau $0$ của xref).
    Trả về {'v': [(tọa độ, lo, hi, có đầu lo, có đầu hi, so le)], 'h': [...]} hoặc None nếu không có đường trục."""
    segs, circles = {True: {}, False: {}}, []

    def add(p, q, elbow):
        vert = abs(p[0] - q[0]) < 5.0
        if not vert and abs(p[1] - q[1]) >= 5.0:
            return
        a, b = (p[1], q[1]) if vert else (p[0], q[0])
        lo, hi = min(a, b), max(a, b)
        if hi - lo < 5000.0:
            return
        key = int(round(p[0] if vert else p[1]))
        old = segs[vert].get(key)
        if old is None or hi - lo > old[1] - old[0]:
            segs[vert][key] = (lo, hi, elbow)

    for ii in FilteredElementCollector(doc).OfClass(ImportInstance).ToElements():
        geo = ii.get_Geometry(Options())
        if geo is None:
            continue
        for g in geo:
            if not isinstance(g, GeometryInstance):
                continue
            for o in g.GetInstanceGeometry():
                st = doc.GetElement(o.GraphicsStyleId)
                cat = st.GraphicsStyleCategory if st is not None else None
                if cat is None:
                    continue
                layer = cat.Name.strip().lower().split(u"$")[-1]
                if layer == axis_layer:
                    if isinstance(o, Line):
                        p, q = o.GetEndPoint(0), o.GetEndPoint(1)
                        add((to_mm(p.X), to_mm(p.Y)), (to_mm(q.X), to_mm(q.Y)), False)
                    elif isinstance(o, PolyLine):
                        c = [(to_mm(t.X), to_mm(t.Y)) for t in o.GetCoordinates()]
                        for i in range(len(c) - 1):
                            add(c[i], c[i + 1], len(c) > 2)
                elif layer == symbol_layer and isinstance(o, Arc) and not o.IsBound and to_mm(o.Radius) >= 500.0:
                    circles.append((to_mm(o.Center.X), to_mm(o.Center.Y)))
        if segs[True] or segs[False]:
            break
    if not segs[True] and not segs[False]:
        return None

    def bubble(x, y):
        return any((x - cx) ** 2 + (y - cy) ** 2 <= CAD_BUBBLE_R ** 2 for cx, cy in circles)

    lows = sorted(v[0] for v in segs[False].values()) or [0.0]
    mid = lows[len(lows) // 2]
    return {"v": [(float(k), v[0], v[1], bubble(k, v[0]), bubble(k, v[1]), False) for k, v in segs[True].items()],
            "h": [(float(k), v[0], v[1], bubble(v[0], k), bubble(v[1], k), v[2] or v[0] < mid - 500.0)
                  for k, v in segs[False].items()]}


def fit_grids(view, box, scale, warns, hide_prefixes=(), hide_outside=False, cad=None, cut=(None, None, None, None)):
    """Trục của file (song song X / Y): 2D trong view, dài tới GRID_END mm giấy ngoài tường, đầu trục 2 đầu.
    Trả về (trục dọc [(x mm, Reference)], trục ngang [(y mm, Reference)])."""
    ext = GRID_END * scale
    gx, gy, gx_lo, gx_hi = [], [], [], []
    to_hide, to_show = List[ElementId](), List[ElementId]()
    for gr in FilteredElementCollector(doc).OfClass(Grid).ToElements():
        if any(norm(get_name(gr)).startswith(p) for p in hide_prefixes):   # trục khối khác: ẩn trong view, không dim
            if gr.CanBeHidden(view):
                to_hide.Add(gr.Id)
            continue
        c = gr.Curve
        if not isinstance(c, Line):
            continue
        vert = abs(c.Direction.Y) > 0.99
        if not vert and abs(c.Direction.X) <= 0.99:
            continue
        p0 = c.GetEndPoint(0)
        tol = CAD_BOX_TOL if cad is not None else 1.0
        if (vert and not box[0] - tol <= to_mm(p0.X) <= box[2] + tol) or (
                not vert and not box[1] - tol <= to_mm(p0.Y) <= box[3] + tol):
            if hide_outside and gr.CanBeHidden(view):    # tách vùng: trục ngoài vùng giữ dài hết mô hình → khung VP phình
                to_hide.Add(gr.Id)
            continue
        side0, side1 = box[1] if vert else box[0], box[3] if vert else box[2]
        lo_v, hi_v, b_lo, b_hi, line_only = side0 - ext, side1 + ext, True, True, False
        if cad is not None:          # thể hiện theo CAD link: trục không có trên CAD → ẩn; đầu trục đúng phía CAD
            pos = to_mm(p0.X if vert else p0.Y)
            spec = next((s for s in cad["v" if vert else "h"] if abs(s[0] - pos) <= 5.0), None)
            if spec is None:
                if gr.CanBeHidden(view):
                    to_hide.Add(gr.Id)
                continue
            b_lo, b_hi = spec[3], spec[4]
            if vert:                 # tách vùng: đầu trục phải nằm ở mép ngoài của chính vùng này
                b_lo = b_lo and abs(spec[1] - side0) <= CAD_NEAR
                b_hi = b_hi and abs(spec[2] - side1) <= CAD_NEAR
                if not b_lo and not b_hi:
                    if min(spec[2], side1) - max(spec[1], side0) < 1000.0:   # trục của cánh khác
                        if gr.CanBeHidden(view):
                            to_hide.Add(gr.Id)
                        continue
                    line_only = True  # đoạn đuôi trục từ cánh khác: chỉ có nét, không đầu trục, không dim
            extra = GRID_STAGGER * scale if spec[5] else 0.0
            lo_v = side0 - ext - extra if b_lo else max(spec[1], side0 - ext)
            hi_v = side1 + ext + extra if b_hi else min(spec[2], side1 + ext)
            c_lo, c_hi = cut[1] if vert else cut[0], cut[3] if vert else cut[2]
            if c_lo is not None and not b_lo:         # đầu không ký hiệu không vượt đường cắt (Revit không crop trục 2D)
                lo_v = max(lo_v, c_lo + CUT_LINE_IN)
            if c_hi is not None and not b_hi:
                hi_v = min(hi_v, c_hi - CUT_LINE_IN)
        try:
            for e in (DatumEnds.End0, DatumEnds.End1):
                gr.SetDatumExtentType(e, view, DatumExtentType.ViewSpecific)
            cv = list(gr.GetCurvesInView(DatumExtentType.ViewSpecific, view))[0]
            q0, q1 = cv.GetEndPoint(0), cv.GetEndPoint(1)
            if vert:
                a, b = XYZ(q0.X, from_mm(lo_v), q0.Z), XYZ(q0.X, from_mm(hi_v), q0.Z)
            else:
                a, b = XYZ(from_mm(lo_v), q0.Y, q0.Z), XYZ(from_mm(hi_v), q0.Y, q0.Z)
            swapped = (q1 - q0).DotProduct(b - a) < 0
            if swapped:
                a, b = b, a
            gr.SetCurveInView(DatumExtentType.ViewSpecific, view, Line.CreateBound(a, b))
            for end, has in ((DatumEnds.End1 if swapped else DatumEnds.End0, b_lo),
                             (DatumEnds.End0 if swapped else DatumEnds.End1, b_hi)):
                if has:
                    gr.ShowBubbleInView(end, view)
                else:
                    gr.HideBubbleInView(end, view)
        except Exception as ex:
            warns.append(u"Trục {}: không chỉnh được đầu trục ({}).".format(get_name(gr), ex))
        if gr.IsHidden(view):        # view dùng lại (Làm lại): trục đã ẩn ở lần chạy trước nay thuộc vùng
            to_show.Add(gr.Id)
        if line_only:
            continue
        item = (to_mm(p0.X if vert else p0.Y), Reference(gr))
        (gx if vert else gy).append(item)
        if vert:
            if b_lo:
                gx_lo.append(item)
            if b_hi:
                gx_hi.append(item)
    if to_show.Count:
        view.UnhideElements(to_show)
    if to_hide.Count:
        view.HideElements(to_hide)
    return gx, gy, gx_lo, gx_hi


# --- Dim ----------------------------------------------------------------------------
def dedupe(refs):
    """refs: [(tọa độ mm, Reference, ưu tiên)] → [(tọa độ, Reference)] tăng dần; cụm mốc cách nhau < DIM_MIN
    giữ mốc ưu tiên cao nhất (trục > lõi tường > kết cấu > cửa > đầu tường)."""
    out = []
    for c, r, p in sorted(refs, key=lambda q: q[0]):
        if out and c - out[-1][0] < DIM_MIN:
            if p < out[-1][2]:
                out[-1] = (c, r, p)
            continue
        out.append((c, r, p))
    return [(c, r) for c, r, _p in out]


def new_dim(view, along_x, pos, lo, hi, refs, dtype, z):
    ra = ReferenceArray()
    for _c, r in refs:
        ra.Append(r)
    if ra.Size < 2:
        return None
    if along_x:
        ln = Line.CreateBound(XYZ(from_mm(lo), from_mm(pos), z), XYZ(from_mm(hi), from_mm(pos), z))
    else:
        ln = Line.CreateBound(XYZ(from_mm(pos), from_mm(lo), z), XYZ(from_mm(pos), from_mm(hi), z))
    try:
        return doc.Create.NewDimension(view, ln, ra, dtype)
    except Exception:
        return None


def dim_no_tiny(view, along_x, pos, lo, hi, chain, refs, dtype, z, rounds=4):
    """Tọa độ mép cửa chỉ ước theo Width (G19 thử 2026-11-03: khuôn lệch mặt lõi 5 mm → đoạn dim '5'). Tạo dim
    rồi đọc giá trị thật: đoạn < DIM_MIN → bỏ mốc ưu tiên thấp hơn trong 2 mốc của đoạn, dựng lại."""
    pri = {}
    for _c, r, p in refs:
        try:
            pri[r.ConvertToStableRepresentation(doc)] = p
        except Exception:
            pass
    d = new_dim(view, along_x, pos, lo, hi, chain, dtype, z)
    for _i in range(rounds):
        if d is None or d.NumberOfSegments < 2:
            return d
        doc.Regenerate()
        rs = [r for r in d.References]
        vals = [to_mm(s.Value) for s in d.Segments]
        bad = [i for i, v in enumerate(vals) if v < DIM_MIN]
        if not bad or len(rs) != len(vals) + 1:
            return d
        drop = set()
        for i in bad:
            a, b = rs[i], rs[i + 1]
            pa = pri.get(a.ConvertToStableRepresentation(doc), PRI_END)
            pb = pri.get(b.ConvertToStableRepresentation(doc), PRI_END)
            drop.add(i + 1 if pb >= pa else i)
        keep = [(0.0, r) for i, r in enumerate(rs) if i not in drop]
        doc.Delete(d.Id)
        d = new_dim(view, along_x, pos, lo, hi, keep, dtype, z)
    return d


TEXT_H = 2.2               # mm giấy: cao chữ dim (AV_Dim 2.2mm, đo G19: chữ cách đường dim 0,3 / 1 mm)
TEXT_PAD = 0.6             # mm giấy: 2 chữ dim cách nhau ít hơn → coi như chồng (KTS: "30|60" dính nhau)
TEXT_STEPS = (0.0, -2.5, 2.5, -5.0, 5.0, -7.5, 7.5, -10.0, 10.0, -12.5, 12.5, -15.0, 15.0)   # mm giấy: lùi
#                            dọc đường dim khi tìm chỗ trống (±10 còn kẹt 2 chữ ở cụm cửa mặt ngoài G19 trục X10)


def text_box(along_x, t, value_mm, scale):
    """Hộp chữ số dim (mm thật) quanh TextPosition t – đo trên ảnh G19 1/100: chữ ngang nằm trên điểm đặt, chữ dọc
    nằm bên trái điểm đặt; rộng TEXT_CHAR_W mm giấy / chữ số."""
    w = len(u"{}".format(int(round(value_mm)))) * TEXT_CHAR_W * scale
    h = TEXT_H * scale
    x, y = to_mm(t.X), to_mm(t.Y)
    return (x - w / 2.0, y, x + w / 2.0, y + h) if along_x else (x - h, y - w / 2.0, x, y + w / 2.0)


def box_hit(b, occ, own=None, pad=0.0):
    """Hộp b chạm (hoặc cách < pad, mm thật) hộp nào trong occ – bỏ qua đường dim của chính dim own."""
    for o, tag in occ:
        if tag is not None and tag == own:
            continue
        if min(b[2], o[2]) - max(b[0], o[0]) > -pad and min(b[3], o[3]) - max(b[1], o[1]) > -pad:
            return True
    return False


def place_texts(dim, along_x, pos, lo, hi, sides, scale, occ):
    """KTS 2026-11-03 (G19 hành lang X2–X3): chữ dim KHÔNG được chồng nhau. Chữ số nào chồng chữ / đường dim đã
    đặt (ghi trong occ, gồm cả dim trục) → thử lần lượt: hai phía đường dim (sides: phía ưu tiên trước, cách
    TEXT_DROP mm giấy), lùi dọc đường TEXT_STEPS; chỗ đầu tiên còn trống thì đặt (Revit tự vẽ gạch dẫn).
    Trả về (số chữ đã dời, số chữ không tìm được chỗ)."""
    tag = id_value(dim.Id)
    t = 0.3 * scale
    occ.append(((lo, pos - t, hi, pos + t) if along_x else (pos - t, lo, pos + t, hi), tag))
    if dim.NumberOfSegments < 2:
        register_dim_text(dim, along_x, scale, occ)
        return 0, 0
    doc.Regenerate()
    moved, stuck = 0, 0
    drop, hgt, pad = TEXT_DROP * scale, TEXT_H * scale, TEXT_PAD * scale
    for s in dim.Segments:
        t0 = s.TextPosition
        if t0 is None:
            continue
        val = to_mm(s.Value)
        b = text_box(along_x, t0, val, scale)
        if not box_hit(b, occ, tag, pad):
            occ.append((b, None))
            continue
        placed = None
        for side in sides:
            # điểm đặt theo phía: chữ ngang nằm TRÊN điểm đặt, chữ dọc nằm TRÁI điểm đặt
            p = pos + drop if side > 0 else pos - drop - hgt
            if not along_x:
                p = pos + drop + hgt if side > 0 else pos - drop
            for st in TEXT_STEPS:
                d = from_mm(st * scale)
                cand = XYZ(t0.X + d, from_mm(p), t0.Z) if along_x else XYZ(from_mm(p), t0.Y + d, t0.Z)
                cb = text_box(along_x, cand, val, scale)
                if not box_hit(cb, occ, tag, pad):
                    placed = (cand, cb)
                    break
            if placed:
                break
        if placed is None:
            stuck += 1
            occ.append((b, None))
            continue
        s.TextPosition = placed[0]
        occ.append((placed[1], None))
        moved += 1
    return moved, stuck


def clear_chain_pos(ch, gx, gy, scale):
    """Đường dim + dải chữ không được nằm trên trục song song: dời đường dim tối đa 6 mm giấy, ưu tiên ra xa tường,
    vào phía tường tối đa 2 mm. Chữ ngang nằm trên đường dim, chữ dọc nằm trái đường dim."""
    par = [c for c, _r in (gy if ch.ax else gx)]
    b0, b1 = (-0.6 * scale, 3.1 * scale) if ch.ax else (-3.1 * scale, 0.6 * scale)
    sign = ch.sgn or 1.0
    for k in range(13):
        for dl in ((k * 0.5, -k * 0.5) if k else (0.0,)):
            if dl < -2.0:
                continue
            p = ch.pos + sign * dl * scale
            if not any(p + b0 < g < p + b1 for g in par):
                return p
    return ch.pos


def add_obstacles(occ, walls, struct, gx, gy, box, scale):
    """Trục, tường, cột / vách vào occ: chữ dim tự tránh (KTS 2026-11-08: dim, trục không chồng nhau và không chồng
    đối tượng khác)."""
    ext, t = GRID_END * scale, 0.2 * scale
    for c, _r in gx:
        occ.append(((c - t, box[1] - ext, c + t, box[3] + ext), None))
    for c, _r in gy:
        occ.append(((box[0] - ext, c - t, box[2] + ext, c + t), None))
    for wi in walls:
        bb = wi.w.get_BoundingBox(None)
        occ.append(((to_mm(bb.Min.X), to_mm(bb.Min.Y), to_mm(bb.Max.X), to_mm(bb.Max.Y)), None))
    for s in struct:
        occ.append(((s[0], s[1], s[2], s[3]), None))


def register_dim_text(dim, along_x, scale, occ):
    segs = [s for s in dim.Segments] if dim.NumberOfSegments > 1 else [dim]
    for s in segs:
        if s.TextPosition is not None and s.Value is not None:
            occ.append((text_box(along_x, s.TextPosition, to_mm(s.Value), scale), None))


def grid_dims(view, box, gx, gy, scale, dtype, z, occ, gx_lo=None, gx_hi=None):
    """Dim trục 4 phía × 2 hàng; chữ + đường dim ghi vào occ để chữ dim tường tránh."""
    n = 0
    for refs, along_x, lo_side, hi_side, lo, hi in ((gx, True, box[1], box[3], box[0], box[2]),
                                                   (gy, False, box[0], box[2], box[1], box[3])):
        if len(refs) < 2:
            continue
        for sign, base in ((-1.0, lo_side), (1.0, hi_side)):
            side_refs = refs
            if along_x and gx_lo is not None:     # theo CAD: dim trục chỉ ở phía có đầu trục, chỉ trục của phía đó
                side_refs = gx_lo if sign < 0 else gx_hi
            if len(side_refs) < 2:
                continue
            srt = sorted(side_refs, key=lambda q: q[0])
            for pos, rr in ((base + sign * GRID_CHAIN * scale, srt), (base + sign * GRID_TOTAL * scale,
                                                                         [srt[0], srt[-1]])):
                d = new_dim(view, along_x, pos, lo, hi, rr, dtype, z)
                if d is not None:
                    n += 1
                    doc.Regenerate()
                    place_texts(d, along_x, pos, lo, hi, (), scale, occ)
    return n


def room_kind(x, y, z, public):
    r = doc.GetRoomAtPoint(XYZ(from_mm(x), from_mm(y), z))
    if r is None:
        return 0
    p = r.get_Parameter(BuiltInParameter.ROOM_NAME)
    name = norm(p.AsString() if p else u"")
    if name in OUTSIDE_ROOMS:          # logia: tính là ngoài nhà để dim cửa lùa, chuỗi không bị cắt như phòng căn hộ
        return 3
    return 1 if name in public else 2


def side_kind(x, y, z, public, solids):
    """Loại phía tuyến tại điểm mẫu (x, y): 1 hành lang (Room IN[12]), 2 phòng / trong nhà, 0 NGOÀI NHÀ – không Room
    VÀ ít nhất một trong 4 tia ±X / ±Y từ điểm không chạm tường / cột / vách nào (thoát ra ngoài nhà). KTS
    2026-11-03 (G19 lõi thang): hộp kỹ thuật, khoảng trống trong lõi không có Room (lõi phải ~3,5 m) bị coi là mặt
    ngoài → dim trong lõi; khe thông tầng X4–X5, đầu hành lang hở vẫn có tia thoát → mặt ngoài."""
    kd = room_kind(x, y, z, public)
    if kd == 3:
        return 0
    if kd != 0:
        return kd
    if any(b[0] <= x <= b[2] and b[1] <= y <= b[3] for b in solids):
        return 2
    rays = [True, True, True, True]                      # +X, −X, +Y, −Y chưa bị chặn
    for b in solids:
        if b[1] <= y <= b[3]:
            if b[0] >= x:
                rays[0] = False
            if b[2] <= x:
                rays[1] = False
        if b[0] <= x <= b[2]:
            if b[1] >= y:
                rays[2] = False
            if b[3] <= y:
                rays[3] = False
        if not any(rays):
            return 2
    return 0


def make_alignments(walls, opens=None):
    """Tuyến: các tường cùng phương, lệch tim ≤ ALIGN_TOL, hở ≤ ALIGN_GAP (gộp bắc cầu). Tuyến ngắn vẫn giữ nếu có cửa
    sổ / cửa lùa (HQV: tường ngắn của mặt ngoài so le bị bỏ → thiếu dim cửa sổ)."""
    out = []
    for ax in (True, False):
        ws = sorted([w for w in walls if w.ax == ax], key=lambda q: q.c)
        groups = []
        for q in ws:
            hit = [g for g in groups if abs(g[0].c - q.c) <= ALIGN_TOL and
                   any(q.lo <= o.hi + ALIGN_GAP and q.hi >= o.lo - ALIGN_GAP for o in g)]
            if not hit:
                groups.append([q])
                continue
            hit[0].append(q)
            for g in hit[1:]:
                hit[0].extend(g)
                groups.remove(g)
        for g in groups:
            has_facade = opens is not None and any(id(e[0][1]) in FACADE_REFS for o in g
                                                   for e in opens.get(id_value(o.w.Id), []))
            if sum(o.hi - o.lo for o in g) >= ALIGN_MIN or has_facade:
                out.append((ax, g))
    return out


class Chain(object):
    """Một chuỗi định vị tường: phương, phạm vi lo–hi, vị trí đường dim, phía đặt chuỗi (0 = giữa hành lang),
    các mốc [(tọa độ, Reference, ưu tiên)], nhãn log."""

    def __init__(self, ax, c, lo, hi, pos, sgn, kind, refs, face, band=None):
        self.ax, self.c, self.lo, self.hi, self.pos, self.sgn = ax, c, lo, hi, pos, sgn
        self.kind, self.refs, self.face = kind, refs, face
        self.band = band            # (blo, bhi) mm theo phương vuông góc: tường vuông góc chạm dải → mốc


def clip_apartments(chains, z, public):
    """KTS 2026-11-03 (G19 khối cánh phải, Y3–Y4): KHÔNG dim vào căn hộ. Dò dọc đường dim mỗi CLIP_STEP: điểm nằm
    trong Room không phải hành lang (phòng căn hộ, lõi) → cắt. Chuỗi tách thành các đoạn liền ở ngoài nhà / hành lang /
    trong tường; đoạn < CLIP_MIN bỏ; mốc ngoài đoạn bỏ. Trả về (chuỗi mới, số chuỗi bị cắt)."""
    out, n_cut = [], 0
    for ch in chains:
        ok = []
        s = ch.lo
        while s <= ch.hi + 0.1:
            x, y = (s, ch.pos) if ch.ax else (ch.pos, s)
            ok.append((s, room_kind(x, y, z, public) != 2))
            s += CLIP_STEP
        runs, start = [], None
        for s, good in ok:
            if good and start is None:
                start = s
            elif not good and start is not None:
                runs.append((start, s - CLIP_STEP))
                start = None
        if start is not None:
            runs.append((start, ch.hi))
        if len(runs) == 1 and runs[0][0] <= ch.lo + 1.0 and runs[0][1] >= ch.hi - CLIP_STEP:
            out.append(ch)
            continue
        n_cut += 1
        for a, b in runs:
            # mút đoạn: mốc gần nhất ngoài vùng bị cắt (mặt tường căn hộ) – nới nửa bước dò
            a2, b2 = (a - CLIP_STEP if a > ch.lo + 1.0 else a), (b + CLIP_STEP if b < ch.hi - 1.0 else b)
            refs = [r for r in ch.refs if a2 - 1.0 <= r[0] <= b2 + 1.0]
            if b2 - a2 < CLIP_MIN or len(refs) < 2:
                continue
            lo, hi = min(r[0] for r in refs), max(r[0] for r in refs)
            out.append(Chain(ch.ax, ch.c, lo, hi, ch.pos, ch.sgn, ch.kind + u" (cắt căn hộ)", refs, ch.face, ch.band))
    return out, n_cut


def opening_stoppers(level, view):
    """Cửa đi / cửa sổ KHÔNG gắn tường trên level: [(hộp bao mm, [(trục X?, tọa độ, Ref)])] – chặn tia kéo dài chuỗi
    (G19: mặt khối cánh X4 đoạn y 21850–24482 chỉ là cửa sổ 2400×3150 không host → tia xuyên vào tường ngăn trong
    căn). Cửa có host bỏ qua: tường host đã chặn, còn hộp bao gồm cung cánh mở chồng ra hành lang (thử: dừng ở
    x 13300 giữa hành lang)."""
    flt = LogicalOrFilter(ElementCategoryFilter(BuiltInCategory.OST_Doors),
                          ElementCategoryFilter(BuiltInCategory.OST_Windows))
    opt = Options()
    opt.ComputeReferences = True
    opt.View = view
    res = []
    for e in FilteredElementCollector(doc).WherePasses(flt).WhereElementIsNotElementType().ToElements():
        if not isinstance(e, FamilyInstance) or e.LevelId != level.Id or e.Host is not None:
            continue
        bb = e.get_BoundingBox(None)
        if bb is None:
            continue
        faces = []
        for gi in (e.get_Geometry(opt) or []):
            if not isinstance(gi, GeometryInstance):
                continue
            T = gi.Transform
            for s in gi.GetSymbolGeometry():
                if not isinstance(s, Solid):
                    continue
                for f in s.Faces:
                    if not isinstance(f, PlanarFace) or f.Reference is None:
                        continue
                    nv, p = T.OfVector(f.FaceNormal), T.OfPoint(f.Origin)
                    if abs(nv.X) > 0.999:
                        faces.append((True, to_mm(p.X), f.Reference))
                    elif abs(nv.Y) > 0.999:
                        faces.append((False, to_mm(p.Y), f.Reference))
        if faces:
            res.append(((to_mm(bb.Min.X), to_mm(bb.Min.Y), to_mm(bb.Max.X), to_mm(bb.Max.Y)), faces))
    return res


def extend_chains(chains, walls, struct, gx, gy, stoppers=()):
    """KTS 2026-11-03 (G19, ảnh khoanh đỏ): đầu chuỗi dừng giữa khoảng trống (hành lang ngang Y3–Y4 dừng ở x 18550,
    mặt trên khối giữa dừng trước khe X4–X5, mặt khối cánh nhìn ra khe dừng ở y 24300) → kéo tiếp theo đường dim
    tới tường / cột / vách ĐẦU TIÊN gặp (≤ EXT_MAX): mốc cuối = mặt lõi (KC: mặt) phía gần của nó; trên đoạn kéo
    thêm lấy mặt lõi các tường vuông góc chạm dải tuyến và trục đi qua."""
    solids = []                      # (hộp bao mm, [(trục X?, tọa độ, Ref)])
    for q in walls:
        bb = q.w.get_BoundingBox(None)
        faces = [(not q.ax, cd, r) for cd, r in q.cores]     # mặt lõi tường dọc Y có pháp tuyến X
        solids.append(((to_mm(bb.Min.X), to_mm(bb.Min.Y), to_mm(bb.Max.X), to_mm(bb.Max.Y)), faces))
    for x0, y0, x1, y1, faces in struct:
        solids.append(((x0, y0, x1, y1), faces))
    solids += list(stoppers)
    n = 0
    for ch in chains:
        ax, p = ch.ax, ch.pos
        for end in (-1, 1):
            tip = ch.lo if end < 0 else ch.hi
            best = None
            for b, faces in solids:
                plo, phi = (b[1], b[3]) if ax else (b[0], b[2])      # phạm vi vuông góc đường dim
                alo, ahi = (b[0], b[2]) if ax else (b[1], b[3])      # phạm vi dọc đường dim
                if not plo <= p <= phi:
                    continue
                if end < 0 and ahi <= tip + 1.0:
                    d = tip - ahi
                elif end > 0 and alo >= tip - 1.0:
                    d = alo - tip
                else:
                    continue
                if d > EXT_MAX or (best is not None and d >= best[0]):
                    continue
                # mốc = mặt ĐÚNG ở biên gần của vật gặp (G19 thử: vách KC lấy nhầm mặt khuất trong lõi → kéo lố 2000)
                near = ahi if end < 0 else alo
                fs = [(cd, r) for fx, cd, r in faces if fx == ax and abs(cd - near) <= EXT_FACE_TOL]
                if fs:
                    best = (d, min(fs, key=lambda q: abs(q[0] - near)))
            if best is None or best[0] < EXT_MIN:
                continue
            cd, r = best[1]
            new_lo, new_hi = (cd, ch.lo) if end < 0 else (ch.hi, cd)
            ch.refs.append((cd, r, PRI_CORE))
            if ch.band is not None:
                for q in walls:
                    if q.ax == ax or q.hi < ch.band[0] or q.lo > ch.band[1] or not new_lo - 1.0 <= q.c <= new_hi + 1.0:
                        continue
                    ch.refs += [(c_, r_, PRI_CORE) for c_, r_ in q.cores]
                for x0, y0, x1, y1, faces in struct:     # cột / vách KC chạm dải trên đoạn kéo thêm (vách lõi)
                    slo, shi = (y0, y1) if ax else (x0, x1)
                    alo, ahi = (x0, x1) if ax else (y0, y1)
                    if shi < ch.band[0] or slo > ch.band[1] or ahi < new_lo - 1.0 or alo > new_hi + 1.0:
                        continue
                    ch.refs += [(c_, r_, PRI_STRUCT) for fx, c_, r_ in faces if fx == ax and new_lo - 1.0 <= c_ <= new_hi + 1.0]
            ch.refs += [(c_, r_, PRI_GRID) for c_, r_ in (gx if ax else gy) if new_lo < c_ < new_hi]
            if end < 0:
                ch.lo = min(ch.lo, cd)
            else:
                ch.hi = max(ch.hi, cd)
            n += 1
    return n


def corridor_gap(ch, scale):
    """Mẫu KTS 2026-11-08 (HQV YB5–YB6, rộng 1800): chữ nằm giữa tường và đường dim → cách mặt tường 6 mm giấy (đo 594),
    chữ nằm phía lòng hành lang → 5 mm (đo 491). Chữ ngang ở trên đường dim, chữ dọc ở trái đường dim."""
    toward_wall = ch.sgn < 0 if ch.ax else ch.sgn > 0
    return (6.0 if toward_wall else 5.0) * scale


def merge_corridors(chains, scale, two=False):
    """KTS 2026-11-03 (G19 hành lang X2–X3 rộng 1600): 2 chuỗi hành lang đối diện nhau, khoảng thông thủy giữa 2
    mặt tường < CORR_MERGE mm giấy → chữ 2 chuỗi đè nhau. Gộp thành MỘT chuỗi ở giữa hành lang, mốc của cả hai
    bên, chữ đoạn ngắn kéo xen kẽ hai phía. Gộp theo CỤM (một bên tường bị tách nhiều tuyến – G19 X3: ghép từng
    cặp còn sót 1 chuỗi cách tường 450 đè chữ chuỗi giữa). Xét cả chuỗi 'mặt ngoài': đầu hành lang hở không có
    Room (G19 X3 y 3000–5615) làm tuyến bị xếp mặt ngoài nhưng vẫn đối diện chuỗi hành lang bên kia."""
    corr = list(chains)
    parent = dict((id(ch), id(ch)) for ch in corr)

    def root(k):
        while parent[k] != k:
            k = parent[k]
        return k
    for a in corr:
        for b in corr:
            if a is b or a.ax != b.ax or a.sgn <= 0 or b.sgn >= 0:
                continue                    # a: chuỗi phía +, b: chuỗi phía −, b nằm phía + của a
            gap = b.face - a.face
            if 0 < gap < CORR_MERGE * scale and min(a.hi, b.hi) - max(a.lo, b.lo) > 0:
                parent[root(id(a))] = root(id(b))
    groups = {}
    for ch in corr:
        groups.setdefault(root(id(ch)), []).append(ch)
    used, out = set(), []
    for grp in groups.values():
        ups = [ch for ch in grp if ch.sgn > 0]
        downs = [ch for ch in grp if ch.sgn < 0]
        if not ups or not downs:
            continue
        if two and min(ch.face for ch in downs) - max(ch.face for ch in ups) >= CORR_TWO_MIN * scale:
            for ch in grp:                  # mỗi bên tường một chuỗi riêng, chỉ mốc của bên đó
                hidden = set(id(t) for t in getattr(ch, "back", ()))
                ch.refs = [t for t in ch.refs if id(t) not in hidden]
                ch.kind = u"hành lang"
                ch.pos = ch.face + ch.sgn * corridor_gap(ch, scale)
            continue
        used.update(id(ch) for ch in grp)
        refs = []
        for ch in grp:                      # đầu hành lang hở xếp 'mặt ngoài': vẫn bỏ mốc khuất khi gộp vào hành lang
            hidden = set(id(t) for t in getattr(ch, "back", ()))
            refs += [t for t in ch.refs if id(t) not in hidden]
        face_a, face_b = max(ch.face for ch in ups), min(ch.face for ch in downs)
        bands = [ch.band for ch in grp if ch.band is not None]
        band = (min(b[0] for b in bands), max(b[1] for b in bands)) if bands else None
        out.append(Chain(grp[0].ax, (face_a + face_b) / 2.0, min(ch.lo for ch in grp), max(ch.hi for ch in grp),
                         (face_a + face_b) / 2.0, 0.0, u"hành lang (gộp {} tuyến)".format(len(grp)), refs, None,
                         band))
    return [ch for ch in chains if id(ch) not in used] + out


def move_logia_chains(chains, z, public, scale):
    """KTS 2026-11-08: dim cửa lùa không nằm trong lòng logia. Chuỗi trong logia đưa ra ngoài mép logia; có chuỗi mặt
    ngoài cùng phía sát đó thì gộp mốc vào chuỗi ấy."""
    out = []
    logia = []
    for ch in chains:
        n = 8
        pts = [ch.lo + (ch.hi - ch.lo) * i / float(n) for i in range(1, n)]
        inside = [s for s in pts if room_kind(*((s, ch.pos, z) if ch.ax else (ch.pos, s, z)), public=public) == 3]
        if ch.kind.startswith(u"mặt ngoài") and ch.sgn and inside:
            logia.append((ch, inside[len(inside) // 2]))
        else:
            out.append(ch)
    for ch, s in logia:
        p, steps = ch.pos, 0
        while steps < 60 and room_kind(*((s, p, z) if ch.ax else (p, s, z)), public=public) == 3:
            p += ch.sgn * 100.0
            steps += 1
        new_pos = p + ch.sgn * WALL_EXT * scale
        host = [t for t in out if t.ax == ch.ax and t.sgn == ch.sgn and t.kind.startswith(u"mặt ngoài")
                and abs(t.pos - new_pos) <= LOGIA_MERGE * scale and t.lo <= ch.hi + ALIGN_GAP and t.hi >= ch.lo - ALIGN_GAP]
        if host:
            t = min(host, key=lambda q: abs(q.pos - new_pos))
            t.refs += [r for r in ch.refs if r not in getattr(ch, "back", ())]
            t.lo, t.hi = min(t.lo, ch.lo), max(t.hi, ch.hi)
        else:
            ch.pos = new_pos
            out.append(ch)
    return out


def merge_facade_steps(chains, scale):
    """Mặt ngoài so le: các chuỗi cùng phía, lệch hàng ≤ FACADE_STEP và liền nhau → một chuỗi ở hàng ngoài cùng
    (KTS 2026-11-08: kéo dim ra ngoài để dim được phần còn thiếu)."""
    fac = [c for c in chains if c.kind.startswith(u"mặt ngoài") and c.sgn]
    parent = dict((id(c), id(c)) for c in fac)

    def root(k):
        while parent[k] != k:
            k = parent[k]
        return k
    for a in fac:
        for b in fac:
            if a is not b and a.ax == b.ax and a.sgn == b.sgn and abs(a.pos - b.pos) <= FACADE_STEP * scale \
                    and a.lo <= b.hi + FACADE_JOIN and b.lo <= a.hi + FACADE_JOIN:
                parent[root(id(a))] = root(id(b))
    groups, drop = {}, set()
    for c in fac:
        groups.setdefault(root(id(c)), []).append(c)
    for grp in groups.values():
        if len(grp) < 2:
            continue
        main_ch = max(grp, key=lambda c: c.pos * c.sgn)      # hàng ngoài cùng theo hướng ra ngoài
        for c in grp:
            if c is main_ch:
                continue
            main_ch.refs = main_ch.refs + c.refs
            main_ch.lo, main_ch.hi = min(main_ch.lo, c.lo), max(main_ch.hi, c.hi)
            drop.add(id(c))
    return [c for c in chains if id(c) not in drop]


def extend_facade_to_grids(ch, keep, solids, grids, scale):
    """Kéo đầu chuỗi mặt ngoài tới trục góc nhà: đi dọc mặt ngoài tới khi hết tường / cột, hoặc gặp khối chắn đường dim."""
    F = ch.pos - ch.sgn * WALL_EXT * scale
    win0, win1 = (F - FACADE_DEPTH, F + 50.0) if ch.sgn > 0 else (F - 50.0, F + FACADE_DEPTH)
    if ch.ax:
        strips = [(b[0], b[2], b[1], b[3]) for b in solids]
    else:
        strips = [(b[1], b[3], b[0], b[2]) for b in solids]
    for d in (1.0, -1.0):
        end = ch.hi if d > 0 else ch.lo
        last, limit = end, None
        for i in range(1, int(FACADE_WALK / 200.0) + 1):
            s = end + d * 200.0 * i
            here = [q for q in strips if q[0] <= s <= q[1]]
            if any(q[2] <= ch.pos <= q[3] for q in here):
                limit = s + d * 300.0
                break
            if any(q[3] >= win0 and q[2] <= win1 for q in here):
                last = s
            elif abs(s - last) > FACADE_HOLE:
                break
        if limit is None:
            limit = last + d * GRID_END_REACH
        cand = [(c_, r_) for c_, r_ in grids if (end < c_ <= limit if d > 0 else limit <= c_ < end)]
        if not cand:
            continue
        c_, r_ = max(cand, key=lambda q: q[0] * d)
        if not any(abs(c_ - t[0]) < 1.0 for t in keep):
            keep.append((c_, r_, PRI_GRID))
        if d > 0:
            ch.hi = c_
        else:
            ch.lo = c_


def add_facade_grid_row(view, ch, gx, gy, gx_lo, gx_hi, box, scale, dtype, z, occ, log):
    """Hàng dim trục ngoài chuỗi mặt ngoài, cho các mặt không nằm ở mép bản vẽ (mép đã có hàng dim trục)."""
    side = (box[1] if ch.sgn < 0 else box[3]) if ch.ax else (box[0] if ch.sgn < 0 else box[2])
    has_row = len(gx_lo if ch.sgn < 0 else gx_hi) >= 2 if ch.ax else True
    if has_row and abs(ch.pos - side) <= FACADE_ROW_SKIP * scale:
        return
    refs = sorted([q for q in (gx if ch.ax else gy) if ch.lo - GRID_END_REACH < q[0] < ch.hi + GRID_END_REACH],
                  key=lambda q: q[0])
    if len(refs) < 2:
        return
    lo, hi = refs[0][0], refs[-1][0]
    probe = Chain(ch.ax, ch.c, lo, hi, ch.pos + ch.sgn * FACADE_ROW_GAP * scale, ch.sgn, ch.kind, [], None, None)
    pos = clear_chain_pos(probe, gx, gy, scale)
    d = new_dim(view, ch.ax, pos, lo, hi, refs, dtype, z)
    if d is None:
        log.append([u"X" if ch.ax else u"Y", u"{:.0f}".format(ch.c), u"", u"hàng dim trục mặt ngoài", len(refs), u"LỖI tạo dim"])
        return
    doc.Regenerate()
    place_texts(d, ch.ax, pos, lo, hi, (), scale, occ)


def wall_chains(view, walls, align, opens, struct, gx, gy, scale, dtype, z, public, log, occ, two=False,
                door_grid_only=False, box=None, gx_lo=(), gx_hi=()):
    chains = plan_chains(walls, align, opens, struct, gx, gy, scale, z, public)
    chains = merge_corridors(chains, scale, two)
    if two:
        for ch in chains:                # hành lang một bên tường: cùng khoảng cách với hành lang hai bên
            if ch.kind == u"hành lang" and ch.sgn:
                ch.pos = ch.face + ch.sgn * corridor_gap(ch, scale)
    n_ext = extend_chains(chains, walls, struct, gx, gy, opening_stoppers(view.GenLevel, view))
    if n_ext:
        log.append([u"", u"", u"", u"kéo dài đầu chuỗi tới tường gặp đầu tiên", n_ext, u""])
    chains, n_cut = clip_apartments(chains, z, public)
    if n_cut:
        log.append([u"", u"", u"", u"cắt đoạn chuỗi đi qua căn hộ / lõi", n_cut, u""])
    if OUTSIDE_ROOMS:
        chains = merge_facade_steps(move_logia_chains(chains, z, public, scale), scale)
    solids = [(s[0], s[1], s[2], s[3]) for s in struct]
    for wi in walls:
        bb = wi.w.get_BoundingBox(None)
        solids.append((to_mm(bb.Min.X), to_mm(bb.Min.Y), to_mm(bb.Max.X), to_mm(bb.Max.Y)))
    n_dim, n_moved, n_stuck = 0, 0, 0
    for ch in chains:
        if door_grid_only and ch.kind.startswith(u"hành lang"):   # KTS 2026-11-08: hành lang chỉ dim vào cửa và trục
            keep = [t for t in ch.refs if t[2] in (PRI_OPEN, PRI_GRID)]
            if not any(t[2] == PRI_OPEN for t in keep):           # không có cửa: chỉ còn trục, đã có ở dim trục
                log.append([u"X" if ch.ax else u"Y", u"{:.0f}".format(ch.c), u"{:.0f}–{:.0f}".format(ch.lo, ch.hi),
                            ch.kind, 0, u"bỏ: đoạn không có cửa"])
                continue
            ch.refs = keep
            ch.lo, ch.hi = min(t[0] for t in keep), max(t[0] for t in keep)
        elif OUTSIDE_ROOMS and ch.kind.startswith(u"mặt ngoài"):  # KTS 2026-11-08: chỉ cửa sổ, cửa lùa logia, trục
            keep = [t for t in ch.refs if t[2] == PRI_GRID or id(t[1]) in FACADE_REFS]
            keep += [(c_, r_, PRI_GRID) for c_, r_ in (gx if ch.ax else gy)     # chuỗi bắt đầu / kết thúc ở trục sát đầu
                     if ch.lo - GRID_END_REACH < c_ < ch.hi + GRID_END_REACH
                     and not any(abs(c_ - t[0]) < 1.0 for t in keep)]
            if not any(t[2] != PRI_GRID for t in keep):
                log.append([u"X" if ch.ax else u"Y", u"{:.0f}".format(ch.c), u"{:.0f}–{:.0f}".format(ch.lo, ch.hi),
                            ch.kind, 0, u"bỏ: đoạn không có cửa sổ / cửa lùa"])
                continue
            ch.lo, ch.hi = min(t[0] for t in keep), max(t[0] for t in keep)
            extend_facade_to_grids(ch, keep, solids, gx if ch.ax else gy, scale)
            ch.refs = keep
        ch.pos = clear_chain_pos(ch, gx, gy, scale)
        chain = dedupe(ch.refs)
        d = dim_no_tiny(view, ch.ax, ch.pos, ch.lo, ch.hi, chain, ch.refs, dtype, z)
        row = [u"X" if ch.ax else u"Y", u"{:.0f}".format(ch.c), u"{:.0f}–{:.0f}".format(ch.lo, ch.hi), ch.kind,
               len(chain)]
        if d is None:
            log.append(row + [u"LỖI tạo dim"])
            continue
        n_dim += 1
        # Phía thử trước: chuỗi mặt ngoài → phía tường (phía ngoài là chuỗi trục); chuỗi hành lang một bên → lòng
        # hành lang; chuỗi gộp giữa hành lang (sgn = 0) → cả hai phía
        if ch.sgn == 0:
            sides = (1.0, -1.0)
        elif ch.kind == u"mặt ngoài":
            sides = (-ch.sgn, ch.sgn)
        else:
            sides = (ch.sgn, -ch.sgn)
        mv, st = place_texts(d, ch.ax, ch.pos, ch.lo, ch.hi, sides, scale, occ)
        n_moved += mv
        n_stuck += st
        if OUTSIDE_ROOMS and ch.kind.startswith(u"mặt ngoài") and box is not None:
            add_facade_grid_row(view, ch, gx, gy, gx_lo, gx_hi, box, scale, dtype, z, occ, log)
        log.append(row + [u"{} đoạn{}".format(max(d.NumberOfSegments, 1),
                                              u", {} chữ còn chồng".format(st) if st else u"")])
    return n_dim, n_moved, n_stuck


def plan_chains(walls, align, opens, struct, gx, gy, scale, z, public):
    opt = Options()
    opt.ComputeReferences = True
    chains = []
    solids = []                                          # hộp bao tường (mm) + cột / vách KC – dò "ngoài nhà"
    for q in walls:
        bb = q.w.get_BoundingBox(None)
        solids.append((to_mm(bb.Min.X), to_mm(bb.Min.Y), to_mm(bb.Max.X), to_mm(bb.Max.Y)))
    solids += [(x0, y0, x1, y1) for x0, y0, x1, y1, _f in struct]
    for ax, g in align:
        lo, hi = min(o.lo for o in g), max(o.hi for o in g)
        c = sum(o.c for o in g) / float(len(g))
        hw = max(o.hw for o in g)
        k = [[0, 0, 0], [0, 0, 0]]
        s = lo + SIDE_PROBE
        while s < hi - SIDE_PROBE:
            for si in (0, 1):
                off = (-1.0 if si == 0 else 1.0) * (hw + SIDE_PROBE)
                kd = side_kind(s, c + off, z, public, solids) if ax else side_kind(c + off, s, z, public, solids)
                k[si][kd] += 1
            s += SIDE_STEP
        pick, gap, kind = None, 0.0, u""
        for si in (0, 1):
            if k[si][0] > k[si][1] + k[si][2]:
                pick, gap, kind = si, WALL_EXT * scale, u"mặt ngoài"
        if pick is None:
            for si in (0, 1):
                if k[si][1] > k[si][2]:
                    pick, gap, kind = si, WALL_INT * scale, u"hành lang"
        if pick is None:
            continue
        sgn = -1.0 if pick == 0 else 1.0
        pos = c + sgn * (hw + gap)
        blo, bhi = c - hw - BAND_PAD, c + hw + BAND_PAD
        refs, back = [], []                              # back: mốc khuất sau tường, gộp chuỗi hành lang thì bỏ

        def behind(p_lo, p_hi, at, _c=c, _hw=hw, _sgn=sgn, _g=g):
            """Cấu kiện vuông góc nằm sau tuyến tường (phía căn hộ), đứng từ phía đặt chuỗi không thấy (KTS 2026-11-08)."""
            shown = p_hi > _c + _hw + VISIBLE_TOL if _sgn > 0 else p_lo < _c - _hw - VISIBLE_TOL
            return not shown and any(o.lo - 1.0 <= at <= o.hi + 1.0 for o in _g)

        for q in walls:                                  # tường vuông góc chạm tuyến → mặt lõi
            if q.ax == ax or q.hi < blo or q.lo > bhi or not lo - 150.0 <= q.c <= hi + 150.0:
                continue
            new = [(cd, r, PRI_CORE) for cd, r in q.cores]
            if behind(q.lo, q.hi, q.c):
                if kind != u"hành lang":
                    back += new
                    refs += new
                continue
            refs += new
        edges = []
        ids = set(id_value(o.w.Id) for o in g)
        for wid in ids:                                  # cửa trên tuyến → 2 mép khuôn
            for (ca, ra), (cb, rb) in opens.get(wid, []):
                refs += [(ca, ra, PRI_OPEN), (cb, rb, PRI_OPEN)]
                edges += [ca, cb]
        for o in g:                                      # đầu tường của tuyến (bỏ má cửa)
            geo = o.w.get_Geometry(opt)
            for gob in (geo or []):
                if not isinstance(gob, Solid):
                    continue
                for f in gob.Faces:
                    if not isinstance(f, PlanarFace) or f.Reference is None:
                        continue
                    nv = f.FaceNormal
                    if (abs(nv.X) if ax else abs(nv.Y)) < 0.999:
                        continue
                    cd = to_mm(f.Origin.X if ax else f.Origin.Y)
                    if any(abs(e - cd) < OPEN_SKIP for e in edges):
                        continue
                    ub = f.GetBoundingBox()
                    pm = f.Evaluate((ub.Min + ub.Max) / 2.0)
                    if abs(to_mm(pm.Y if ax else pm.X) - c) > hw + 5.0:
                        continue
                    refs.append((cd, f.Reference, PRI_END))
        for x0, y0, x1, y1, faces in struct:             # cột / vách kết cấu chạm tuyến
            slo, shi = (y0, y1) if ax else (x0, x1)
            alo, ahi = (x0, x1) if ax else (y0, y1)
            if shi < blo or slo > bhi or ahi < lo - 150.0 or alo > hi + 150.0:
                continue
            for fx, cd, r in faces:
                if fx != ax:
                    continue
                item = (cd, r, PRI_STRUCT)
                if behind(slo, shi, cd):
                    if kind != u"hành lang":
                        back.append(item)
                        refs.append(item)
                    continue
                refs.append(item)
        refs += [(cd, r, PRI_GRID) for cd, r in (gx if ax else gy) if lo - 1.0 < cd < hi + 1.0]
        new_ch = Chain(ax, c, lo, hi, pos, sgn, kind, refs, c + sgn * hw, (blo, bhi))
        new_ch.back = back
        chains.append(new_ch)
    return chains


# --- Legend ghi chú tường ---------------------------------------------------------------
class NoteDraw(object):
    """Vẽ trong legend theo mm giấy (gốc 0,0 = góc trên trái)."""

    def __init__(self, view, t_title, t_body):
        self.view, self.s = view, view.Scale
        self.t_title, self.t_body = t_title, t_body

    def Q(self, x, y):
        return XYZ(from_mm(x * self.s), from_mm(y * self.s), 0)

    def line(self, a, b):
        doc.Create.NewDetailCurve(self.view, Line.CreateBound(self.Q(a[0], a[1]), self.Q(b[0], b[1])))

    def text(self, x, y, width, value, tt=None, center=False):
        opts = TextNoteOptions((tt or self.t_body).Id)
        if center:
            opts.HorizontalAlignment = HorizontalTextAlignment.Center
        tn = TextNote.Create(doc, self.view.Id, self.Q(x, y), from_mm(width), value, opts)
        doc.Regenerate()
        bb = tn.get_BoundingBox(self.view)
        return tn, (to_mm(bb.Max.Y - bb.Min.Y) / self.s if bb is not None else 3.0)

    def swatch(self, x0, x1, cy, frt, pattern=u""):
        loop = CurveLoop()
        pts = [self.Q(x0 + 2.0, cy + 2.2), self.Q(x1 - 2.0, cy + 2.2), self.Q(x1 - 2.0, cy - 2.2),
               self.Q(x0 + 2.0, cy - 2.2)]
        for i in range(4):
            loop.Append(Line.CreateBound(pts[i], pts[(i + 1) % 4]))
        loops = List[CurveLoop]()
        loops.Add(loop)
        region = FilledRegion.Create(doc, frt.Id, self.view.Id, loops)
        ogs = None                         # override trong legend: không phải tạo filled region type mới
        if isinstance(pattern, Material):  # đúng Cut Pattern của vật liệu lõi (mặt + nền, cả màu)
            ogs = OverrideGraphicSettings()
            ogs.SetSurfaceForegroundPatternId(pattern.CutForegroundPatternId)
            ogs.SetSurfaceForegroundPatternColor(pattern.CutForegroundPatternColor)
            ogs.SetSurfaceForegroundPatternVisible(pattern.CutForegroundPatternId != ElementId.InvalidElementId)
            ogs.SetSurfaceBackgroundPatternId(pattern.CutBackgroundPatternId)
            ogs.SetSurfaceBackgroundPatternColor(pattern.CutBackgroundPatternColor)
            ogs.SetSurfaceBackgroundPatternVisible(pattern.CutBackgroundPatternId != ElementId.InvalidElementId)
        elif pattern:
            fpe = by_name(FillPatternElement, pattern)
            if fpe is not None:
                ogs = OverrideGraphicSettings()
                ogs.SetSurfaceForegroundPatternId(fpe.Id)
                ogs.SetSurfaceForegroundPatternVisible(True)
                if pattern == u"<Solid fill>":   # cột / vách link KC trên mặt bằng tô đặc xám
                    ogs.SetSurfaceForegroundPatternColor(Color(128, 128, 128))
        if ogs is not None:
            self.view.SetElementOverrides(region.Id, ogs)


def note_rows(walls, struct_mats, mats, warns):
    """Mỗi vật liệu lõi một dòng: (FilledRegionType | None, mô tả, 'dày lõi …'). Vật liệu chỉ có ở cột / vách
    link KC (G19: tường VBT-150 của file là gờ logia, thấp hơn mặt cắt) → chiều dày ghi 'Theo hồ sơ KC'."""
    groups = {}
    for wi in walls:
        tn = norm(get_name(doc.GetElement(wi.w.GetTypeId()))).lower()
        key = next((m[0] for m in mats if m[0] and m[0] in tn), norm(wi.mat))   # từ khóa IN[11] khớp tên type trước
        groups.setdefault(key, set()).add(int(round(wi.core_mm)))
    for m in struct_mats:
        groups.setdefault(m, set())
    rows, merged = [], {}
    for mat, cores in sorted(groups.items()):
        hit = next((m for m in mats if m[0] and m[0] in mat.lower()), None)
        frt, desc = None, mat or u"(chưa gán vật liệu)"
        if hit is not None:
            desc = hit[2] or desc
            frt = by_name(FilledRegionType, hit[1]) if hit[1] else None
            if hit[1] and frt is None:
                warns.append(u"Không có filled region type '{}' → ô ký hiệu '{}' để trống.".format(hit[1], desc))
        else:
            warns.append(u"Vật liệu lõi '{}' chưa có trong IN[11] → ghi tên vật liệu, không hatch.".format(mat))
        pat = (hit[3] if hit is not None else u"") or by_name(Material, mat) or u""   # không ghi pattern → đọc từ vật liệu lõi
        merged.setdefault(desc, [frt, set(), pat])       # cùng mô tả (BTCT file + link KC) → 1 dòng
        merged[desc][0] = merged[desc][0] or frt
        merged[desc][1] |= cores
    for desc, (frt, cores, pat) in sorted(merged.items()):
        val = u", ".join(u"{}".format(c) for c in sorted(cores)) + u" mm" if cores else u"Theo hồ sơ KC"
        rows.append((frt, desc, val, pat))
    return rows


def finish_note(walls):
    """Lưu ý trát: chỉ ghi khi mọi tường có trát dùng cùng một chiều dày lớp ngoài lõi."""
    ts = set()
    for wi in walls:
        cl = core_layers(doc.GetElement(wi.w.GetTypeId()))
        for t in (cl[1], cl[2]):
            if t > 0.5:
                ts.add(int(round(t)))
    if len(ts) == 1:
        return u"- Tường xây trát vữa dày {} mm mỗi mặt (theo cấu tạo type tường).".format(ts.pop())
    return None


def make_legend(name, walls, struct_mats, mats, rebuild, warns):
    """Legend bảng ký hiệu tường + lưu ý. Trả về (legend | None, cao mm giấy)."""
    t_title = next((t for t in (by_name(TextNoteType, n) for n in (TEXT_TITLE,) + TEXT_TITLE_ALT) if t is not None), None)
    t_body = by_name(TextNoteType, TEXT_BODY)
    if t_title is None or t_body is None:
        warns.append(u"Thiếu text type '{}' / '{}' → không vẽ legend ghi chú.".format(TEXT_TITLE, TEXT_BODY))
        return None, 0.0
    legends = [v for v in FilteredElementCollector(doc).OfClass(View).ToElements()
               if v.ViewType == ViewType.Legend and not v.IsTemplate]
    old = next((v for v in legends if norm(get_name(v)) == norm(name)), None)
    if old is not None and not rebuild:
        warns.append(u"Dùng lại legend có sẵn '{}' (không vẽ lại – bật Làm lại để vẽ lại).".format(name))
        return old, LEGEND_H_GUESS
    if old is not None:
        delete_ids([e for e in FilteredElementCollector(doc, old.Id).WhereElementIsNotElementType().ToElements()
                    if e.OwnerViewId == old.Id and isinstance(e, (TextNote, CurveElement, FilledRegion))])
        view = old
    else:
        src = next((v for v in legends if v.CanViewBeDuplicated(ViewDuplicateOption.Duplicate)), None)
        if src is None:
            warns.append(u"File chưa có legend nào để nhân bản → bỏ qua bảng ghi chú (tạo 1 legend trống rồi chạy lại).")
            return None, 0.0
        view = doc.GetElement(src.Duplicate(ViewDuplicateOption.Duplicate))
        view.Name = name
    try:
        view.Scale = LEGEND_SCALE
    except Exception:
        pass
    nd = NoteDraw(view, t_title, t_body)
    xs = [0.0]
    for w in NOTE_COLS:
        xs.append(xs[-1] + w)
    W = xs[-1]
    nd.line((0.0, 0.0), (W, 0.0))
    nd.text(W / 2.0, -2.0, W, u"BẢNG KÝ HIỆU GHI CHÚ TƯỜNG", t_title, True)
    y = -7.5
    nd.line((0.0, y), (W, y))
    y_cols = y
    for i, hd in enumerate((u"Kí hiệu", u"Loại", u"Chiều dày lõi")):
        nd.text((xs[i] + xs[i + 1]) / 2.0, y - 1.6, NOTE_COLS[i] - 2.0, hd, center=True)
    y -= 6.0
    nd.line((0.0, y), (W, y))
    for frt, desc, val, pat in note_rows(walls, struct_mats, mats, warns):
        tn, h = nd.text(xs[1] + 1.5, y - 1.5, NOTE_COLS[1] - 3.0, desc)
        rh = max(7.0, h + 3.0)
        cy = y - rh / 2.0
        tn.Coord = nd.Q(xs[1] + 1.5, cy + h / 2.0)
        if frt is not None:
            nd.swatch(xs[0], xs[1], cy, frt, pat)
        nd.text((xs[2] + xs[3]) / 2.0, cy + 1.3, NOTE_COLS[2] - 2.0, val, center=True)
        y -= rh
        nd.line((0.0, y), (W, y))
    for x in xs[1:-1]:
        nd.line((x, y_cols), (x, y))
    notes = [u"Lưu ý:",
             u"- Kích thước định vị ghi đến mặt tường xây thô (chưa trát), má lỗ cửa đi / cửa sổ trên tường thô "
             u"và mặt cột, vách BTCT."]
    fn = finish_note(walls)
    if fn:
        notes.append(fn)
    notes += [u"- Cột, vách BTCT xem hồ sơ kết cấu.",
              u"- Chi tiết tường căn hộ, vệ sinh, logia xem bản vẽ chi tiết căn hộ tương ứng."]
    y -= 1.2
    for note in notes:
        _tn, h = nd.text(1.5, y, W - 3.0, note)
        y -= h + 0.6
    y -= 1.0
    nd.line((0.0, y), (W, y))
    nd.line((0.0, 0.0), (0.0, y))
    nd.line((W, 0.0), (W, y))
    return view, -y


# --- Sheet --------------------------------------------------------------------------------
def outline_mm(vp):
    o = vp.GetBoxOutline()
    return (to_mm(o.MinimumPoint.X), to_mm(o.MinimumPoint.Y), to_mm(o.MaximumPoint.X), to_mm(o.MaximumPoint.Y))


def move_vp(vp, dx_mm, dy_mm):
    c = vp.GetBoxCenter()
    vp.SetBoxCenter(XYZ(c.X + from_mm(dx_mm), c.Y + from_mm(dy_mm), c.Z))


def place_label(vp, o, warns):
    """Tên hình ngay dưới đầu trục, mép trái thẳng tường ngoài cùng, gạch chân dài bằng mặt bằng. LabelOffset tính
    từ góc dưới trái khung viewport (đo G19 2026-11-03) → đặt lúc link đang tạm ẩn, khung như sau khi KTS tắt
    Grids của link. Mặc định Revit để tên lệch trái ra ngoài khung tên (G19 lần chạy đầu)."""
    try:
        vp.LabelOffset = XYZ(0, 0, 0)
        doc.Regenerate()
        lo = vp.GetLabelOutline()
        if vp.Rotation == ViewportRotation.Counterclockwise:
            # VP quay: tên hình quay theo (nằm dọc mép phải) và LabelOffset (a, b) dời trên sheet (-b, a) – đo 2026-11-08
            dx = o[2] + LABEL_GAP - to_mm(lo.MinimumPoint.X)
            dy = o[1] + CROP_PAD - to_mm(lo.MinimumPoint.Y)
            vp.LabelOffset = XYZ(from_mm(dy), from_mm(-dx), 0)
            vp.LabelLineLength = from_mm(max(50.0, o[3] - o[1] - 2 * CROP_PAD))
            return
        top = to_mm(lo.MaximumPoint.Y) - o[1]
        left = to_mm(lo.MinimumPoint.X) - o[0]
        vp.LabelOffset = XYZ(from_mm(CROP_PAD - left), from_mm(-LABEL_GAP - top), 0)
        vp.LabelLineLength = from_mm(max(50.0, o[2] - o[0] - 2 * CROP_PAD))
    except Exception as ex:
        warns.append(u"Không đặt được vị trí tên hình ({}) – kéo tay.".format(ex))


def set_sheet_group(sh, text, warns):
    """Ghi tham số nhóm Project Browser (VD 01_GiaiDoan, 02_HangMuc) – thiếu tham số / chỉ đọc → cảnh báo."""
    done = []
    for item in split_list(text):
        name, sep, value = item.partition(u"=")
        name, value = norm(name), norm(value)
        if not sep or not name:
            continue
        p = sh.LookupParameter(name)
        if p is None or p.IsReadOnly:
            warns.append(u"Sheet không có tham số '{}' (hoặc chỉ đọc) → không xếp nhóm theo tham số này.".format(name))
            continue
        p.Set(value)
        done.append(u"{} = {}".format(name, value))
    return done


def empty_sheet(sh):
    """Sheet trống: không view / legend đặt lên, không bảng thống kê (trừ bảng revision của khung tên)."""
    if sh.IsPlaceholder or sh.GetAllPlacedViews().Count:
        return False
    return not any(not x.IsTitleblockRevisionSchedule
                   for x in FilteredElementCollector(doc, sh.Id).OfClass(ScheduleSheetInstance))


def make_sheet(number, name, tb, vp_type, plan, legend, warns, sh=None, rotate=False):
    """sh: sheet trống có sẵn (D:\\AI 2026-11-04) → đặt vào đó, giữ số hiệu / tên / khung tên."""
    if sh is None:
        sh = ViewSheet.Create(doc, tb.Id)
        sh.SheetNumber = number
        sh.Name = name
    vp = Viewport.Create(doc, sh.Id, plan.Id, XYZ(from_mm((AREA_X0 + AREA_X1) / 2.0), from_mm(400.0), 0))
    if vp_type is not None:
        vp.ChangeTypeId(vp_type.Id)
    if rotate:                # Revit dời khung đi xa khi quay (đo G19/HQV 2026-11-08) → căn vị trí phải đứng sau bước này
        vp.Rotation = ViewportRotation.Counterclockwise
        doc.Regenerate()
    # Trục của file link (ByHostView) không bị crop cắt → khung viewport phình (G19: 766 thay vì 698 mm). Đo và
    # căn vị trí khi TẠM ẩn link, rồi hiện lại – phòng khi không có filter IN[16] (khung đúng sau khi KTS tắt tay).
    links = List[ElementId]()
    for e in FilteredElementCollector(doc, plan.Id).OfClass(RevitLinkInstance).ToElements():
        if e.CanBeHidden(plan):
            links.Add(e.Id)
    if links.Count:
        plan.HideElements(links)
    doc.Regenerate()
    o = outline_mm(vp)
    move_vp(vp, (AREA_X0 + AREA_X1) / 2.0 - (o[0] + o[2]) / 2.0, AREA_Y1 - SHEET_PAD - o[3])
    doc.Regenerate()
    o = outline_mm(vp)
    place_label(vp, o, warns)
    if links.Count:
        plan.UnhideElements(links)
        doc.Regenerate()
    if o[0] < AREA_X0 - 0.5 or o[2] > AREA_X1 + 0.5:
        warns.append(u"MB rộng {:.0f} mm giấy, vượt vùng vẽ {:.0f} mm → thêm tỷ lệ nhỏ hơn vào IN[3].".format(
            o[2] - o[0], AREA_X1 - AREA_X0))
    if o[1] < AREA_Y0 - 0.5 or o[3] > AREA_Y1 + 0.5:
        warns.append(u"MB cao {:.0f} mm giấy, vượt vùng vẽ {:.0f} mm → tràn khung tên, thêm tỷ lệ nhỏ hơn vào "
                     u"IN[3].".format(o[3] - o[1], AREA_Y1 - AREA_Y0))
    lvp = None
    if legend is not None:
        lvp = Viewport.Create(doc, sh.Id, legend.Id, XYZ(from_mm(150.0), from_mm(80.0), 0))
        nt = find_vp_type(u"No Title")
        if nt is not None:
            lvp.ChangeTypeId(nt.Id)
        doc.Regenerate()
        lo = outline_mm(lvp)
        move_vp(lvp, AREA_X0 + SHEET_PAD - lo[0], AREA_Y0 + SHEET_PAD - lo[1])
        doc.Regenerate()
        lo = outline_mm(lvp)
        if lo[3] > o[1] - 2.0:
            warns.append(u"Legend chồng lên MB trên sheet – kéo lại tay hoặc dùng tỷ lệ nhỏ hơn.")
    return sh, vp, lvp


# --- Chính --------------------------------------------------------------------------------
def make_warning_swallower(failed):
    """Nuốt cảnh báo; lỗi chỉ dính dim tự động → xóa dim đó thay vì hủy cả lượt (như ARV_DanTrangCanHo_v2).
    Khai báo lớp trong hàm, namespace riêng mỗi lần chạy (pythonnet không cho khai báo lại cùng tên)."""
    ns = "ARV.MBTuongXayTang.R" + datetime.datetime.now().strftime("%Y%m%d%H%M%S%f")
    try:
        class SwallowWarnings(IFailuresPreprocessor):
            __namespace__ = ns

            def PreprocessFailures(self, fa):
                fixed = False
                for m in list(fa.GetFailureMessages()):
                    sev = m.GetSeverity()
                    if sev == FailureSeverity.Warning:
                        fa.DeleteWarning(m)
                    elif sev == FailureSeverity.Error:
                        d = fa.GetDocument()
                        ids = list(m.GetFailingElementIds())
                        els = [d.GetElement(i) for i in ids]
                        if els and all(e is not None and e.Category is not None and
                                       e.Category.BuiltInCategory == BuiltInCategory.OST_Dimensions for e in els):
                            lst = List[ElementId]()
                            for i in ids:
                                lst.Add(i)
                            fa.DeleteElements(lst)
                            failed.append(u"{} ({})".format(m.GetDescriptionText(), len(ids)))
                            fixed = True
                return FailureProcessingResult.ProceedWithCommit if fixed else FailureProcessingResult.Continue
        return SwallowWarnings()
    except Exception:
        return None


def log_folder():
    import tempfile
    for base in (os.path.join(os.path.expanduser("~"), "Documents"), tempfile.gettempdir()):
        folder = os.path.join(base, "ARV_Logs")
        try:
            if not os.path.isdir(folder):
                os.makedirs(folder)
            return folder
        except Exception:
            continue
    raise IOError(u"Không tạo được thư mục log")


TMPL_NOTE = []      # ghi chú template thay thế (D:\AI 2026-11-05)
LOG_HEADER = [u"Phương", u"Tim tuyến (mm)", u"Phạm vi (mm)", u"Phía đặt", u"Số mốc", u"Kết quả"]


def write_log(rows, level_name, dry_run):
    stamp = datetime.datetime.now().strftime("%Y%m%d_%H%M%S")
    path = os.path.join(log_folder(), "MBTuongXayTang_{}_{}.csv".format("DRYRUN" if dry_run else "THUCHIEN", stamp))
    with io.open(path, "w", encoding="utf-8-sig", newline="") as f:
        f.write(u"# Dự án: {}\n# Level: {}\n# Ngày: {}\n# Chế độ: {}\n".format(
            doc.Title, level_name, datetime.datetime.now().strftime("%Y-%m-%d %H:%M"),
            u"Chạy thử (dry-run)" if dry_run else u"Thực hiện"))
        w = csv.writer(f)
        w.writerow(LOG_HEADER)
        w.writerows(rows)
    return path
def main(level_name, view_name, tmpl_name, scale_text, number, sheet_name, tb_name, vp_name, dim_grid_name,
         dim_wall_name, legend_name, mat_text, public_text, dry_run, rebuild, group_text=u"", grid_filter=u"",
         place=True, region_text=u"", hide_grid_text=u"", cad_grid_text=u"", cut_style=u"", hide_wall_text=u"",
         corridor_chains=u"1", corridor_only=u"", outside_rooms=u""):
    OUTSIDE_ROOMS.clear()
    OUTSIDE_ROOMS.update(norm(s) for s in split_list(outside_rooms))
    FACADE_REFS.clear()
    if is_central_file(doc):
        raise StopReport([u"DỪNG: file đang mở là file CENTRAL. Hãy mở file local hoặc bản detached/copy."])
    if level_name.strip():
        level = by_name(Level, level_name)
        if level is None:
            raise StopReport([u"DỪNG: không có level '{}'.".format(level_name)])
    else:
        av = doc.ActiveView
        level = av.GenLevel if av.ViewType == ViewType.FloorPlan else None
        if level is None:
            raise StopReport([u"DỪNG: IN[0] trống và view đang mở không phải mặt bằng."])
    try:
        scales = [int(float(s)) for s in split_list(scale_text)]
    except ValueError:
        raise StopReport([u"DỪNG: IN[3] tỷ lệ '{}' không hợp lệ.".format(scale_text)])
    region = None
    if region_text.strip():              # tách tầng lớn thành nhiều tờ: chạy tool một lần cho mỗi vùng
        try:
            region = [float(s) for s in region_text.replace(u";", u",").split(u",")]
        except ValueError:
            region = []
        if len(region) != 4 or region[0] >= region[2] or region[1] >= region[3]:
            raise StopReport([u"DỪNG: IN[18] vùng '{}' phải là x0,y0,x1,y1 (mm).".format(region_text)])
    if not scales or not view_name.strip() or (place and not number.strip()):
        raise StopReport([u"DỪNG: thiếu tỷ lệ (IN[3]), tên view (IN[1]) hoặc số sheet (IN[4])."])
    template = None
    if tmpl_name.strip():
        template = next((v for v in FilteredElementCollector(doc).OfClass(View).ToElements()
                         if v.IsTemplate and norm(get_name(v)) == norm(tmpl_name)), None)
        if template is None:
            # D:\AI 2026-11-05: model HQV tháp B không có 'TC.04.MatBangTuongXay' mà có 'ACD.08_MatBangTuongXay' →
            # dùng template mặt bằng tường xây có sẵn (tên chứa "MatBangTuongXay" / "tường xây", bỏ loại căn hộ / WC)
            def _kd(s):
                s = unicodedata.normalize("NFD", s or u"").replace(u"đ", u"d").replace(u"Đ", u"D")
                return u"".join(c for c in s if unicodedata.category(c) != "Mn" and c.isalnum()).lower()
            tpls = sorted((v for v in FilteredElementCollector(doc).OfClass(View).ToElements()
                           if v.IsTemplate and v.ViewType == ViewType.FloorPlan and u"tuongxay" in _kd(get_name(v))
                           and not any(k in _kd(get_name(v)) for k in (u"canho", u"wc", u"baove", u"phongkythuat"))),
                          key=lambda v: (u"matbangtuongxay" not in _kd(get_name(v)), get_name(v)))
            if not tpls:
                raise StopReport([u"DỪNG: không có view template '{}' (cũng không có template mặt bằng tường xây "
                                  u"nào khác).".format(tmpl_name)])
            template = tpls[0]
            TMPL_NOTE.append(u"Không có view template '{}' → dùng '{}' của dự án (Cần xác nhận lại).".format(
                tmpl_name, get_name(template)))
    # Sheet (D:\AI 2026-11-04): IN[17] False → không đụng sheet; số hiệu là sheet trống có sẵn → đặt vào đó
    old_sheets = [s for s in FilteredElementCollector(doc).OfClass(ViewSheet).ToElements()
                  if place and norm(s.SheetNumber) == norm(number)]
    target = next((s for s in old_sheets if empty_sheet(s)), None)
    if target is not None:
        old_sheets = [s for s in old_sheets if s.Id != target.Id]
    tb = find_type(BuiltInCategory.OST_TitleBlocks, tb_name) if place and target is None else None
    vp_type = find_vp_type(vp_name) if vp_name.strip() else None
    dt_grid, dt_wall = by_name(DimensionType, dim_grid_name), by_name(DimensionType, dim_wall_name)
    lack = [n for n, e in ((u"khung tên '{}'".format(tb_name), tb if place and target is None else True),
                           (u"dim type '{}'".format(dim_grid_name), dt_grid),
                           (u"dim type '{}'".format(dim_wall_name), dt_wall)) if e is None]
    if vp_name.strip() and vp_type is None:
        lack.append(u"viewport type '{}'".format(vp_name))
    if lack:
        raise StopReport([u"DỪNG: file không có " + u", ".join(lack) + u" (tool không tự tạo type)."])
    public = set(norm(s) for s in split_list(public_text))

    old_views = [v for v in FilteredElementCollector(doc).OfClass(ViewPlan).ToElements()
                 if not v.IsTemplate and norm(get_name(v)) == norm(view_name)]
    if (old_views or old_sheets) and not rebuild:
        raise StopReport([u"DỪNG: đã có view '{}' ({}) / sheet '{}' ({}) – bật IN[14] Làm lại để dựng lại, "
                          u"hoặc đổi tên / số sheet.".format(view_name, len(old_views), number, len(old_sheets))])
    foreign = [s for s in old_sheets if norm(s.Name) != norm(sheet_name)]
    if foreign:
        raise StopReport([u"DỪNG: số sheet {} đang dùng cho '{}' – đổi IN[4].".format(number, foreign[0].Name)])
    reuse = [v for v in old_views if v.GenLevel is not None and v.GenLevel.Id == level.Id][:1]   # giữ, không xóa
    # Đổi số sheet khi Làm lại: view dùng lại còn nằm trên sheet số cũ → Viewport.Create báo "viewId cannot be added".
    # Sheet cũ cùng tên = bản tool đã tạo → xóa như Làm lại; khác tên → dừng, không đụng (HQV 2026-11-08 A140 → ACD.08.02).
    held = [s for s in FilteredElementCollector(doc).OfClass(ViewSheet).ToElements()
            if place and reuse and s.GetAllPlacedViews().Contains(reuse[0].Id) and norm(s.SheetNumber) != norm(number)]
    other = [s for s in held if norm(s.Name) != norm(sheet_name)]
    if other:
        raise StopReport([u"DỪNG: view '{}' đang nằm trên sheet {} '{}' – gỡ view khỏi sheet đó rồi chạy lại.".format(
            view_name, other[0].SheetNumber, other[0].Name)])
    old_sheets = old_sheets + held
    locked = [get_name(e) for e in old_views + old_sheets
              if e not in reuse and not DocumentValidation.CanDeleteElement(doc, e.Id)]
    if locked:
        raise StopReport([u"DỪNG: không xóa được {} (đang mở trong Revit?) – đóng tab rồi chạy lại.".format(
            u", ".join(locked))])

    warns, failed, log = list(TMPL_NOTE), [], []
    z = level.Elevation + from_mm(CUT_Z)
    if TransactionManager is not None:
        TransactionManager.Instance.ForceCloseTransaction()
    tx = Transaction(doc, TRANSACTION_NAME)
    sw = make_warning_swallower(failed)
    if sw is not None:
        fo = tx.GetFailureHandlingOptions()
        fo.SetFailuresPreprocessor(sw)
        tx.SetFailureHandlingOptions(fo)
    tx.Start()
    try:
        keep = next((v for v in old_views if v.GenLevel is not None and v.GenLevel.Id == level.Id), None)
        drop = [v for v in old_views if keep is None or v.Id != keep.Id]
        if old_views or old_sheets:
            warns.append(u"Làm lại – {}xóa {} view, {} sheet cũ.".format(
                u"dùng lại view '{}' (giữ VG, dựng lại dim), ".format(get_name(keep)) if keep is not None else u"",
                len(drop), len(old_sheets)))
            delete_ids(drop + old_sheets)
        walls = collect_walls(level)
        walls_all = walls                # bảng ghi chú theo cả tầng: các tờ tách vùng dùng chung một bảng
        if region is not None:
            def _inside(x0, y0, x1, y1):           # theo tâm hộp bao → mỗi cấu kiện chỉ thuộc một vùng
                return region[0] <= (x0 + x1) / 2.0 <= region[2] and region[1] <= (y0 + y1) / 2.0 <= region[3]
            kept = []
            for wi in walls:
                bb = wi.w.get_BoundingBox(None)
                if _inside(to_mm(bb.Min.X), to_mm(bb.Min.Y), to_mm(bb.Max.X), to_mm(bb.Max.Y)):
                    kept.append(wi)
            walls = kept
        if not walls:
            raise StopReport([u"DỪNG: level {} không có tường lõi ≥ {:.0f} mm trong vùng đã chọn.".format(
                level.Name, CORE_MIN)])
        box = walls_box(walls)
        struct_mats = set()
        struct = collect_structure(level, warns, struct_mats)
        if region is not None:
            struct = [s for s in struct if _inside(s[0], s[1], s[2], s[3])]
        legend, legend_h = (make_legend(legend_name.strip(), walls_all, struct_mats, parse_materials(mat_text), rebuild,
                                        warns) if legend_name.strip() else (None, 0.0))
        stagger = GRID_STAGGER if len(split_list(cad_grid_text)) >= 2 else 0.0
        scale, rotate = pick_scale(scales, box, legend_h, stagger)
        cut = [None, None, None, None]   # x0, y0, x1, y1: mép vùng sát hộp tường là mép cắt, crop đúng tại đó
        if region is not None:
            off = CUT_OFFSET * scale
            for i in (0, 1):
                if abs(region[i] - box[i]) <= 1000.0:
                    cut[i] = region[i] - off
            for i in (2, 3):
                if abs(region[i] - box[i]) <= 1000.0:
                    cut[i] = region[i] + off
        view = make_view(level, view_name.strip(), template, scale, box, keep, cut, stagger)
        draw_cut_lines(view, box, cut, scale, cut_style.strip(), warns)
        n_hid = hide_wall_types(view, [norm(s) for s in split_list(hide_wall_text)])
        if n_hid:
            warns.append(u"Đã ẩn {} tường theo IN[22] trong view.".format(n_hid))
        if hide_by_filter(view, grid_filter, warns):
            warns.append(u"Đã ẩn trục không phải kiến trúc (link KC) bằng filter '{}'.".format(grid_filter.strip()))
        cad = None
        cad_layers = [s.strip().lower() for s in split_list(cad_grid_text)]
        if len(cad_layers) >= 2:
            cad = read_cad_grids(cad_layers[0], cad_layers[1])
            if cad is None:
                warns.append(u"Không thấy đường trục layer '{}' trên CAD link → trục thể hiện như mặc định.".format(
                    cad_layers[0]))
        gx, gy, gx_lo, gx_hi = fit_grids(view, box, scale, warns, [norm(s) for s in split_list(hide_grid_text)],
                                         region is not None, cad, cut)
        occ = []                                         # ô chữ / đường dim đã đặt – chữ dim không chồng nhau
        add_obstacles(occ, walls, struct, gx, gy, box, scale)
        n_grid = grid_dims(view, box, gx, gy, scale, dt_grid, z, occ,
                           gx_lo if cad is not None else None, gx_hi if cad is not None else None)
        opens = collect_openings(level, view)
        align = make_alignments(walls, opens if OUTSIDE_ROOMS else None)
        n_wall, n_moved, n_stuck = wall_chains(view, walls, align, opens, struct, gx, gy, scale, dt_wall, z, public,
                                               log, occ, corridor_chains.strip() == u"2",
                                               corridor_only.strip() == u"1", box, gx_lo, gx_hi)
        if n_stuck:
            warns.append(u"Còn {} chữ dim không tìm được chỗ trống (xem cột Kết quả) – KTS kéo tay.".format(n_stuck))
        sheet, group = None, []
        if place:
            sheet, vp, lvp = make_sheet(number.strip(), sheet_name.strip(), tb, vp_type, view, legend, warns, target,
                                        rotate)
            if target is None:
                group = set_sheet_group(sheet, group_text, warns)
            else:
                warns.append(u"Đặt vào sheet trống có sẵn {} '{}' (giữ tên, khung tên, tham số).".format(
                    sheet.SheetNumber, sheet.Name))
            p = view.get_Parameter(BuiltInParameter.VIEW_DESCRIPTION)
            if p is not None and not p.IsReadOnly:
                p.Set(sheet.Name)
        summary = [u"Level {} – view '{}' 1/{}{} – {}".format(level.Name, get_name(view), scale,
                                                              u" (VP quay 90°)" if rotate else u"",
                                                              u"sheet {} '{}'".format(sheet.SheetNumber, sheet.Name)
                                                              if sheet is not None else u"không đặt lên sheet (IN[17])"),
                   u"Tường lõi ≥ {:.0f}: {} đoạn, {} tuyến; trục {} dọc / {} ngang".format(
                       CORE_MIN, len(walls), len(align), len(gx), len(gy)),
                   u"Dim trục: {} – chuỗi định vị tường: {} (dời {} chữ dim tránh chồng, còn chồng {})".format(
                       n_grid, n_wall, n_moved, n_stuck),
                   u"Legend: {}".format(get_name(legend) if legend is not None else u"(không)"),
                   u"Nhóm sheet: {}".format(u"; ".join(group) or u"(không)")]
        if dry_run:
            tx.RollBack()
        else:
            tx.Commit()
    except Exception:
        if tx.HasStarted() and not tx.HasEnded():
            tx.RollBack()
        raise

    report = [u"{} – {} – Làm lại: {}".format(TRANSACTION_NAME, u"CHẠY THỬ (đã dựng rồi hoàn tác)" if dry_run
                                              else u"ĐÃ THỰC HIỆN", u"CÓ" if rebuild else u"KHÔNG")]
    report += summary
    if failed:
        warns.append(u"Revit báo lỗi dim tự động → đã xóa dim đó: " + u"; ".join(failed))
    report += [u"CẢNH BÁO: " + w for w in warns]
    report.append(u"CHƯA LÀM: tag căn hộ, chi tiết điển hình cột vách giao tường xây, dim trong lòng căn. "
                  u"Dim tự động là bản nháp – KTS soát.")
    try:
        report.append(u"Log: " + write_log(log, level.Name, dry_run))
    except Exception as ex:
        report.append(u"Không ghi được log: {}".format(ex))
    if dry_run:
        report.append(u"Đúng thì đổi Dry-run = False và Run lại. Undo bằng mục \"{}\".".format(TRANSACTION_NAME))
    report.append(u" | ".join(LOG_HEADER))
    report += [u" | ".join(u"{}".format(v) for v in r) for r in log]
    return report, []


if DYNAMO:
    import traceback

    def _in(i, default):
        v = IN[i] if len(IN) > i else None
        return default if v is None else v

    try:
        OUT = list(main(
            _in(0, u""),
            _in(1, u"MB TƯỜNG XÂY TẦNG ĐIỂN HÌNH"),
            _in(2, u"TC.04.MatBangTuongXay"),
            u"{}".format(_in(3, u"100;150")),
            u"{}".format(_in(4, u"A140")),
            _in(5, u"MẶT BẰNG TƯỜNG XÂY TẦNG ĐIỂN HÌNH"),
            _in(6, u"AV-Khung A1(841x594)-Kien Truc"),
            _in(7, u"AV-Title No Line"),
            _in(8, u"AV_Dim 2.2mm_Cut dim 6mm"),
            _in(9, u"AV_Dim 2.2mm_Cut dim 4mm"),
            _in(10, u"GHI CHÚ TƯỜNG XÂY TẦNG ĐIỂN HÌNH"),
            _in(11, u"GachNung=AV_Hatch Gach Xay|Tường gạch đặc nung;BeTong=AV_Hatch BTCT|Cột, vách BTCT"),
            _in(12, u"Hành lang"),
            bool(_in(13, True)),
            bool(_in(14, False)),
            _in(15, u"01_GiaiDoan=03_TKBVTC;02_HangMuc=04_MatBangTuongXay"),
            _in(16, u"Trục + Level- Kiến Trúc-Not"),
            bool(_in(17, True)),
            u"{}".format(_in(18, u"")),
            u"{}".format(_in(19, u"")),
            u"{}".format(_in(20, u"")),
            u"{}".format(_in(21, u"")),
            u"{}".format(_in(22, u"")),
            u"{}".format(_in(23, u"1")),
            u"{}".format(_in(24, u"")),
            u"{}".format(_in(25, u"")),
        ))
    except StopReport as ex:
        OUT = [ex.lines, []]
    except Exception as ex:
        OUT = [[u"LỖI: {}".format(ex), traceback.format_exc()], []]
# ----------------------------------------

# group: 3. Báo cáo
# Tóm tắt, cảnh báo, đường dẫn log và từng chuỗi dim tường.
báo_cáo = Watch(arv_mặt_bằng_tường_xây_tầng)
