# Dynamo graph ks_nc_20261104_092157.dyn "ks_nc" (Dynamo 3.6.2.11575)
# author: Archivina
# Khao sat ngan chay

# group: Đầu vào
ghi_chu = StringInput("ks")  # graph input

# group: Xử lý
ks_nc = Python(IN[0]=ghi_chu)  # PythonNet3
# ---------- ks_nc.python (126 lines) ----------
# Khảo sát ngăn cháy lan trên bản sao G19_A_L3-32 (TẦNG 3): chạy công cụ (vẽ thật trên bản sao, không đặt sheet),
# rồi xuất toàn bộ hình học quanh đó ra JSON (mm) để vẽ ảnh đối chiếu các trục bị sót.
import os, sys, json, traceback
import clr
clr.AddReference("RevitAPI")
clr.AddReference("RevitServices")
from Autodesk.Revit.DB import *
from RevitServices.Persistence import DocumentManager
from RevitServices.Transactions import TransactionManager
TM = r"D:\AI\_tmp\revit_nganchay_L3"
NGUON = os.environ.get("ARV_NC_PY", r"D:\AI\scripts\dynamo\NganChay_TrucHKT.py")
kq = []
mmv = lambda v: UnitUtils.ConvertFromInternalUnits(v, UnitTypeId.Millimeters)


def ten(e):
    try:
        return e.Name
    except Exception:
        return "?"


def p2(p):
    return [round(mmv(p.X)), round(mmv(p.Y))]


try:
    doc = DocumentManager.Instance.CurrentDBDocument
    av = doc.ActiveView
    kq.append("View đang mở: %s" % av.Name)
    IN = [None] * 19
    IN[0] = ""
    IN[4] = False
    IN[5] = TM
    IN[10] = False
    IN[18] = True
    g = {"IN": IN}
    exec(open(NGUON, encoding="utf-8").read(), g)
    kq.extend(g["OUT"])
    TransactionManager.Instance.ForceCloseTransaction()
    lv = av.GenLevel
    z = lv.Elevation
    zc = z + UnitUtils.ConvertToInternalUnits(1000, UnitTypeId.Millimeters)
    D = {"tuong": [], "khac": [], "room": [], "cua": [], "link": []}
    opt = Options()
    opt.DetailLevel = ViewDetailLevel.Fine
    for cat in (BuiltInCategory.OST_Walls, BuiltInCategory.OST_Columns, BuiltInCategory.OST_StructuralColumns):
        for e in FilteredElementCollector(doc, av.Id).OfCategory(cat).WhereElementIsNotElementType():
            bb = e.get_BoundingBox(None)
            if bb is None or not (bb.Min.Z - 0.05 <= zc <= bb.Max.Z + 0.05):
                continue
            try:
                vong = [[p2(XYZ(x, y, 0)) for x, y in v] for f in g["mat_day"](e, opt) for v in f]
            except Exception:
                vong = []
            loi = None
            try:
                t = g["loi_tuong"](e) if cat == BuiltInCategory.OST_Walls else None
                if t:
                    loi = [p2(XYZ(t[0][0], t[0][1], 0)), p2(XYZ(t[1][0], t[1][1], 0)), round(mmv(t[2])), round(mmv(t[3]))]
            except Exception:
                pass
            D["tuong"].append({"id": e.Id.Value, "cat": str(cat), "kieu": ten(doc.GetElement(e.GetTypeId())),
                               "vong": vong, "loi": loi})
    for cat in (BuiltInCategory.OST_Doors, BuiltInCategory.OST_Windows):
        for e in FilteredElementCollector(doc).OfCategory(cat).WhereElementIsNotElementType():
            if e.LevelId == lv.Id:
                try:
                    D["cua"].append({"cat": str(cat), "p": p2(e.Location.Point), "kieu": ten(e.Symbol) + " | " + e.Symbol.FamilyName,
                                     "pts": [p2(XYZ(x, y, 0)) for x, y in g["diem_hai_ben"](e)]})
                except Exception:
                    pass
    for e in FilteredElementCollector(doc, av.Id).WhereElementIsNotElementType():
        c = e.Category
        if c is None:
            continue
        if c.Id.Value in (int(BuiltInCategory.OST_Walls), int(BuiltInCategory.OST_Doors), int(BuiltInCategory.OST_Windows)):
            continue
        bb = e.get_BoundingBox(av)
        if bb is None:
            continue
        try:
            fam = e.Symbol.FamilyName
        except Exception:
            fam = ""
        D["khac"].append({"id": e.Id.Value, "cat": c.Name, "fam": fam, "kieu": ten(doc.GetElement(e.GetTypeId())),
                          "ten": ten(e), "min": p2(bb.Min), "max": p2(bb.Max)})
    o = SpatialElementBoundaryOptions()
    o.SpatialElementBoundaryLocation = SpatialElementBoundaryLocation.CoreBoundary
    for r in FilteredElementCollector(doc).OfCategory(BuiltInCategory.OST_Rooms).WhereElementIsNotElementType():
        if r.LevelId != lv.Id or r.Location is None:
            continue
        D["room"].append({"ten": r.get_Parameter(BuiltInParameter.ROOM_NAME).AsString(), "p": p2(r.Location.Point),
                          "m2": round(UnitUtils.ConvertFromInternalUnits(r.Area, UnitTypeId.SquareMeters), 2),
                          "vong": [[p2(s.GetCurve().GetEndPoint(0)) for s in segs] for segs in (r.GetBoundarySegments(o) or [])]})
    for li in FilteredElementCollector(doc).OfClass(RevitLinkInstance):
        ld = li.GetLinkDocument()
        info = {"ten": ten(li), "co_doc": ld is not None, "tuong": []}
        if ld is not None:
            tf = li.GetTotalTransform()
            for cat in (BuiltInCategory.OST_Walls, BuiltInCategory.OST_StructuralColumns, BuiltInCategory.OST_Columns):
                for e in FilteredElementCollector(ld).OfCategory(cat).WhereElementIsNotElementType():
                    bb = e.get_BoundingBox(None)
                    if bb is None:
                        continue
                    a, b = tf.OfPoint(bb.Min), tf.OfPoint(bb.Max)
                    if not (min(a.Z, b.Z) - 0.05 <= zc <= max(a.Z, b.Z) + 0.05):
                        continue
                    try:
                        vong = []
                        for f in g["mat_day"](e, opt):
                            for v in f:
                                vong.append([p2(tf.OfPoint(XYZ(x, y, 0))) for x, y in v])
                    except Exception:
                        vong = []
                    info["tuong"].append({"id": e.Id.Value, "cat": str(cat), "kieu": ten(ld.GetElement(e.GetTypeId())), "vong": vong})
        D["link"].append(info)
    with open(os.path.join(TM, "hinh_hoc.json"), "w", encoding="utf-8") as f:
        json.dump(D, f, ensure_ascii=False)
    kq.append("Tường %d, cửa %d, khác %d, room %d, link %s" % (len(D["tuong"]), len(D["cua"]), len(D["khac"]), len(D["room"]),
                                                              [(l["ten"], len(l["tuong"])) for l in D["link"]]))
except Exception:
    kq.append(traceback.format_exc())
with open(os.path.join(TM, "ket_qua_ks.txt"), "w", encoding="utf-8") as f:
    f.write("\n".join(kq))
OUT = kq
# ----------------------------------------

# group: Đầu ra
báo_cáo = Watch(ks_nc)  # graph output
