# Dynamo graph test_lomo_x_20261029_163042.dyn "test_lomo_x" (Dynamo 3.6.2.11575)
# author: Archivina
# Tạo lỗ mở bằng MỘT Shaft Opening cho mọi trục / hộp kỹ thuật trên mặt bằng tầng đang mở (mỗi ô một vòng biên, nhận trục như công cụ Ngăn cháy lan), biên = mép tường thô; Base / Top Constraint = level mặt bằng, Base Offset -100, Top Offset 1500; tầng đã có shaft lỗ mở thì thêm vòng vào shaft đó; dấu X (Symbolic Line chép từ shaft mẫu vẽ tay) cho mọi vòng; bấm lại không tạo trùng, không xoá. Mặc định Dry-run.

# group: Đầu vào
tên_mặt_bằng_tầng_trống_view = StringInput("Tầng 1")  # "Tên mặt bằng tầng (trống = view đang mở)"; graph input
từ_khoá_tên_room_trục_hkt = StringInput("HKT;Hộp kỹ thuật;Trục kỹ thuật;Giếng kỹ thuật;Shaft")  # graph input
diện_tích_lớn_nhất_ô_khe_theo = DoubleInput(3)  # "Diện tích lớn nhất ô / khe theo hình học (m2)"; graph input
bề_rộng_lòng_nhỏ_nhất_mm = DoubleInput(80)  # graph input
dry_run_true_chỉ_báo_cáo = BoolSelector(false)  # graph input
thư_mục_log_ảnh_trống_documents = StringInput("D:\AI\_tmp\revit_lomo_test\log")  # "Thư mục log + ảnh (trống = Documents, ARV_Logs)"; graph input
từ_khoá_loại_trừ_thang_máy_thang = StringInput("Thang máy;Elevator;Lift;Thang bộ;Stair")  # "Từ khoá loại trừ thang máy / thang bộ (;)"; graph input
base_offset_mm = DoubleInput(-100)  # graph input
top_offset_mm = DoubleInput(1500)  # graph input
gắn_dấu_x_symbolic_line_chép_từ = BoolSelector(true)  # "Gắn dấu X (Symbolic Line chép từ shaft mẫu)"; graph input

# group: Xử lý
test_lomo_x = Python(IN[0]=tên_mặt_bằng_tầng_trống_view, IN[1]=từ_khoá_tên_room_trục_hkt, IN[2]=diện_tích_lớn_nhất_ô_khe_theo, IN[3]=bề_rộng_lòng_nhỏ_nhất_mm, IN[4]=dry_run_true_chỉ_báo_cáo, IN[5]=thư_mục_log_ảnh_trống_documents, IN[6]=từ_khoá_loại_trừ_thang_máy_thang, IN[7]=base_offset_mm, IN[8]=top_offset_mm, IN[9]=gắn_dấu_x_symbolic_line_chép_từ)  # PythonNet3
# ---------- test_lomo_x.python (1227 lines) ----------
# Tạo lỗ mở bằng MỘT Shaft Opening cho mọi trục / hộp kỹ thuật trên mặt bằng tầng đang mở của Revit (mỗi ô là một vòng
# biên trong sketch, như mẫu người dùng vẽ 2026-10-28: 1 lệnh shaft để dễ kiểm soát).
# Nhận trục / hộp đúng theo quy tắc của công cụ Ngăn cháy lan (dùng chung hàm tim_truc): tên room HKT → shaft opening
# → ống đứng → hình học (ô / khe kín giữa tường không cửa đi, cửa sổ, thiết bị, sàn hoàn thiện); loại thang máy / thang bộ.
#   - Biên lỗ mở = mép tường thô (dải lõi tường), không bo vào lớp trát / hoàn thiện (người dùng chốt 2026-10-28)
#   - Base Constraint = Top Constraint = level của mặt bằng đang mở; Base Offset -100 mm, Top Offset 1500 mm (mặc định,
#     người dùng chốt 2026-10-28)
#   - Tầng đã có shaft lỗ mở cục bộ (Base và Top cùng là level đó) thì thêm vòng vào shaft đó (shaft nhiều vòng nhất),
#     chưa có thì tạo 1 shaft mới. Ô đã có vòng lỗ mở thì bỏ qua: bấm lại không tạo trùng, không xoá.
#   - Dấu X nhận biết lỗ mở = 2 Symbolic Line mỗi vòng (người dùng chốt 2026-10-28). API không tạo được Symbolic Line
#     trong file dự án → chép 2 nét X của một shaft MẪU (nét sketch mang line style khác "<Sketch>", người dùng vẽ tay
#     một lần) rồi kéo về 2 đường chéo; vòng đã có trong shaft mà chưa có X cũng được bổ sung. Chưa có mẫu thì báo.
#   - Thêm vòng + dấu X nằm trong 1 lần sửa sketch (1 bước Undo); tạo shaft mới là 1 bước Undo riêng.
# Dry-run (mặc định) chỉ báo cáo, không sửa mô hình.
# INPUT
#   IN[0] (str)   Tên view mặt bằng (để trống = view đang mở, phải là mặt bằng tầng)
#   IN[1] (str)   Từ khoá tên room là trục / hộp kỹ thuật, cách nhau bằng ;  (không phân biệt dấu / hoa thường)
#   IN[2] (float) Diện tích lớn nhất của ô / khe kín nhận theo hình học (m2)
#   IN[3] (float) Bề rộng lòng nhỏ nhất của ô / khe (mm)
#   IN[4] (bool)  Dry-run (True = chỉ báo cáo)
#   IN[5] (str)   Thư mục ghi log + ảnh (để trống = Documents\ARV_Logs\lo_mo)
#   IN[6] (str)   Từ khoá loại trừ (thang máy, thang bộ) trong tên family / type / room, cách nhau bằng ;
#   IN[7] (float) Base Offset của lỗ mở (mm)
#   IN[8] (float) Top Offset của lỗ mở (mm)
#   IN[9] (bool)  Gắn dấu X (Symbolic Line chép từ shaft mẫu) cho mọi vòng lỗ mở chưa có X
# OUTPUT
#   OUT (list[str])  Báo cáo
import math
import os
import traceback
import unicodedata
from datetime import datetime
import clr
clr.AddReference("RevitAPI")
clr.AddReference("RevitServices")
from Autodesk.Revit.DB import *
import Autodesk.Revit.DB as _RevitDB
# pythonnet 3.0: tên đã được import đích danh trước đó trong phiên (vd. ở script khác) bị loại khỏi "import *"
# → bổ sung đủ tên của namespace để không phụ thuộc thứ tự import
globals().update({_n: getattr(_RevitDB, _n) for _n in dir(_RevitDB) if not _n.startswith("_") and _n not in globals()})
from RevitServices.Persistence import DocumentManager
from RevitServices.Transactions import TransactionManager
from System.Collections.Generic import List as NetList
# File gộp tự động bằng gop_lomo_shaft.py – KHÔNG sửa tay (sửa LoMo_ShaftOpening_nguon.py / NganChay_TrucHKT.py rồi gộp lại).


def ds_id(ids):
    """List[ElementId] tạo rỗng rồi Add (pythonnet của pyRevit không nhận List[T](list Python))"""
    kq = NetList[ElementId]()
    for i in ids:
        kq.Add(i)
    return kq


doc = DocumentManager.Instance.CurrentDBDocument


def gia_tri(i, mac_dinh):
    try:
        v = IN[i]
        return mac_dinh if v is None or (isinstance(v, str) and not v.strip()) else v
    except Exception:
        return mac_dinh


def tach(s):
    return [k.strip() for k in str(s).split(";") if k.strip()]


TEN_VIEW = gia_tri(0, "")
TU_KHOA_HKT = tach(gia_tri(1, "HKT;Hộp kỹ thuật;Trục kỹ thuật;Giếng kỹ thuật;Shaft"))
DT_MAX_M2 = float(gia_tri(2, 3.0))
RONG_MIN_MM = float(gia_tri(3, 80.0))
DRY_RUN = bool(gia_tri(4, True))
THU_MUC = str(gia_tri(5, os.path.join(os.path.expanduser("~"), "Documents", "ARV_Logs", "lo_mo")))
TU_KHOA_LOAI = tach(gia_tri(6, "Thang máy;Elevator;Lift;Thang bộ;Stair"))
BASE_OFFSET_MM = float(gia_tri(7, -100.0))
TOP_OFFSET_MM = float(gia_tri(8, 1500.0))
GAN_X = bool(gia_tri(9, True))
os.makedirs(THU_MUC, exist_ok=True)

# hằng số nhận trục (chép nguyên từ NganChay_TrucHKT.py khi gộp)
O_LON_MM = 1400.0         # ô lớn hơn 1400 x 1400 mm: vẫn hatch, liệt kê để xem lại
DT_NHO_NHAT_M2 = 0.03     # ô nhỏ hơn coi là khe giữa 2 lớp tường
O_LUOI_MM = 20.0          # cạnh ô lưới quét dấu chân tường
LOI_MONG_MM = 30.0        # tường có lõi mỏng hơn (gạch ốp, lớp gỗ…) là lớp hoàn thiện → không coi là vách
NOI_HO_MM = 400.0         # đầu tường hở cách tường khác tới mức này thì nối (như Revit khép room)
DT_CO_BANG_CHUNG_M2 = 30.0   # ô có ống đứng / shaft opening: nhận tới diện tích này
TU_SAN_KC = ("sbt", "ket cau", "btct", "structural")   # sàn kết cấu: không dùng để loại ô
bao_cao = []


# ==== PHẦN CHUNG: nhận trục / hộp kỹ thuật (dùng chung với LoMo_ShaftOpening.py – file gộp bằng gop_lomo_shaft.py) ====
def mm(v):
    return UnitUtils.ConvertToInternalUnits(v, UnitTypeId.Millimeters)


def ra_mm(v):
    return UnitUtils.ConvertFromInternalUnits(v, UnitTypeId.Millimeters)


def ra_m2(v):
    return UnitUtils.ConvertFromInternalUnits(v, UnitTypeId.SquareMeters)


def khong_dau(s):
    s = unicodedata.normalize("NFD", s or "").replace("đ", "d").replace("Đ", "D")
    return "".join(c for c in s if unicodedata.category(c) != "Mn").lower()


def co_tu(s, tu_khoa):
    s = khong_dau(s)
    return any(khong_dau(k) in s for k in tu_khoa)


def ten(e):
    try:
        return e.Name
    except Exception:
        return "?"


def ten_kieu(e):
    t = doc.GetElement(e.GetTypeId())
    return ten(t) if t is not None else ""


def ten_family(e):
    try:
        return e.Symbol.FamilyName
    except Exception:
        return ten_kieu(e)


def ten_tpl(v):
    return ten(doc.GetElement(v.ViewTemplateId)) if v.ViewTemplateId != ElementId.InvalidElementId else ""


# ---------- chọn view ----------
def chon_view():
    plans = [v for v in FilteredElementCollector(doc).OfClass(ViewPlan) if not v.IsTemplate]
    if TEN_VIEW:
        for v in plans:
            if v.Name == TEN_VIEW:
                return v
        raise Exception("Không tìm thấy view mặt bằng tên '%s'" % TEN_VIEW)
    la_cl = [v for v in plans if "chay lan" in khong_dau(ten_tpl(v)) or "chay lan" in khong_dau(v.Name)]
    av = doc.ActiveView
    for v in la_cl:
        if v.Id == av.Id:
            return v
    if not la_cl:
        raise Exception("Không có view mặt bằng nào có chữ 'cháy lan' trong tên view / template; nhập tên view vào IN[0]")
    return la_cl[0]


# ---------- hình học 2D ----------
def diem_loop(curves):
    pts = []
    for c in curves:
        for p in list(c.Tessellate())[:-1]:
            pts.append((p.X, p.Y))
    return pts


def trong_da_giac(x, y, pts):
    ben_trong = False
    n = len(pts)
    for i in range(n):
        x1, y1 = pts[i]
        x2, y2 = pts[(i + 1) % n]
        if (y1 > y) != (y2 > y) and x < (x2 - x1) * (y - y1) / (y2 - y1) + x1:
            ben_trong = not ben_trong
    return ben_trong


def trong_vung(x, y, loops_pts):
    # điểm nằm trong số lẻ vòng biên = nằm trong vùng (vòng ngoài trừ lỗ)
    return sum(1 for pts in loops_pts if trong_da_giac(x, y, pts)) % 2 == 1


def bao_loi(pts):
    """Bao lồi (monotone chain)"""
    p = sorted(set(pts))
    if len(p) < 3:
        return p

    def cross(o, a, b):
        return (a[0] - o[0]) * (b[1] - o[1]) - (a[1] - o[1]) * (b[0] - o[0])
    duoi, tren = [], []
    for q in p:
        while len(duoi) >= 2 and cross(duoi[-2], duoi[-1], q) <= 0:
            duoi.pop()
        duoi.append(q)
    for q in reversed(p):
        while len(tren) >= 2 and cross(tren[-2], tren[-1], q) <= 0:
            tren.pop()
        tren.append(q)
    return duoi[:-1] + tren[:-1]


def kich_thuoc(pts):
    """(bề rộng nhỏ nhất, chiều dài theo phương đó) của bao lồi – đo đúng cả ô xoay xiên"""
    h = bao_loi(pts)
    if len(h) < 3:
        return 0.0, 0.0
    tot = None
    for i in range(len(h)):
        (x1, y1), (x2, y2) = h[i], h[(i + 1) % len(h)]
        L = math.hypot(x2 - x1, y2 - y1)
        if L < 1e-9:
            continue
        ux, uy = (x2 - x1) / L, (y2 - y1) / L
        rong = max(abs((x - x1) * uy - (y - y1) * ux) for x, y in h)
        dai = max((x - x1) * ux + (y - y1) * uy for x, y in h) - min((x - x1) * ux + (y - y1) * uy for x, y in h)
        if tot is None or rong < tot[0]:
            tot = (rong, dai)
    return tot


def phang(c, z):
    return c.CreateTransformed(Transform.CreateTranslation(XYZ(0, 0, z - c.GetEndPoint(0).Z)))


def diem_tam(e):
    """Điểm đặt trên mặt bằng của đối tượng: Location.Point, không có thì tâm khung bao"""
    try:
        p = e.Location.Point
        return (p.X, p.Y)
    except Exception:
        bb = e.get_BoundingBox(None)
        if bb is None:
            return None
        return ((bb.Min.X + bb.Max.X) / 2, (bb.Min.Y + bb.Max.Y) / 2)


def diem_hai_ben(d):
    """2 điểm dò hai bên cửa đi / cửa sổ (qua bề dày tường + 200 mm)"""
    try:
        p = d.Location.Point
        f = d.FacingOrientation
        k = (d.Host.Width if d.Host is not None else mm(200)) / 2 + mm(200)
        return [(p.X + f.X * k, p.Y + f.Y * k), (p.X - f.X * k, p.Y - f.Y * k)]
    except Exception:
        return []


def theo_level(cat, lv):
    kq = []
    for e in FilteredElementCollector(doc).OfCategory(cat).WhereElementIsNotElementType():
        lid = e.LevelId
        if lid == ElementId.InvalidElementId:
            try:
                lid = e.get_Parameter(BuiltInParameter.INSTANCE_SCHEDULE_ONLY_LEVEL_PARAM).AsElementId()
            except Exception:
                pass
        if lid == lv.Id:
            kq.append(e)
    return kq


def vong_san(f):
    """Các vòng biên của sàn (theo sketch), điểm 2D"""
    try:
        sk = doc.GetElement(f.SketchId)
        return [[(p.X, p.Y) for c in arr for p in list(c.Tessellate())[:-1]] for arr in sk.Profile]
    except Exception:
        return []


def la_san_ket_cau(f):
    if co_tu(ten_kieu(f), TU_SAN_KC):
        return True
    try:
        return f.get_Parameter(BuiltInParameter.FLOOR_PARAMETER_IS_STRUCTURAL).AsInteger() == 1
    except Exception:
        return False


def ong_dung(lv):
    """Điểm 2D của ống / ống gió / ống luồn dây / máng cáp đi đứng qua cao độ level"""
    z = lv.Elevation
    kq = []
    for cat in (BuiltInCategory.OST_PipeCurves, BuiltInCategory.OST_DuctCurves, BuiltInCategory.OST_Conduit,
                BuiltInCategory.OST_CableTray):
        for e in FilteredElementCollector(doc).OfCategory(cat).WhereElementIsNotElementType():
            try:
                c = e.Location.Curve
                a, b = c.GetEndPoint(0), c.GetEndPoint(1)
            except Exception:
                continue
            dz = abs(b.Z - a.Z)
            if dz > 2 * math.hypot(b.X - a.X, b.Y - a.Y) and min(a.Z, b.Z) - mm(500) <= z + mm(1000) <= max(a.Z, b.Z) + mm(500):
                kq.append(((a.X + b.X) / 2, (a.Y + b.Y) / 2))
    return kq


# ---------- kiểu thể hiện ----------
def lay_line_style():
    cat = doc.Settings.Categories.get_Item(BuiltInCategory.OST_Lines)
    for sc in cat.SubCategories:
        if sc.Name == TEN_NET:
            return sc.GetGraphicsStyle(GraphicsStyleType.Projection), "dùng line style có sẵn '%s'" % TEN_NET
    if DRY_RUN:
        return None, "sẽ tạo line style '%s' (màu %d,%d,%d)" % ((TEN_NET,) + MAU_VIEN)
    sc = doc.Settings.Categories.NewSubcategory(cat, TEN_NET)
    sc.LineColor = Color(*MAU_VIEN)
    sc.SetLineWeight(1, GraphicsStyleType.Projection)
    return sc.GetGraphicsStyle(GraphicsStyleType.Projection), "đã tạo line style '%s' (màu %d,%d,%d)" % ((TEN_NET,) + MAU_VIEN)


def lay_mau_luoi():
    for p in FilteredElementCollector(doc).OfClass(FillPatternElement):
        if ten(p) == TEN_MAU_LUOI:
            return p.Id, "dùng mẫu có sẵn '%s'" % TEN_MAU_LUOI
    if DRY_RUN:
        return None, "sẽ tạo mẫu model '%s' (lưới %g mm, %g°)" % (TEN_MAU_LUOI, LUOI_MM, LUOI_GOC)
    fp = FillPattern(TEN_MAU_LUOI, FillPatternTarget.Model, FillPatternHostOrientation.ToView,
                     math.radians(LUOI_GOC), mm(LUOI_MM), mm(LUOI_MM))
    pe = FillPatternElement.Create(doc, fp)
    return pe.Id, "đã tạo mẫu model '%s' (lưới %g mm, %g°)" % (TEN_MAU_LUOI, LUOI_MM, LUOI_GOC)


def lay_kieu_hatch():
    for t in FilteredElementCollector(doc).OfClass(FilledRegionType):
        if ten(t) == TEN_HATCH:
            return t, "dùng kiểu có sẵn '%s'" % TEN_HATCH
    pid, ghi_chu = lay_mau_luoi()
    if DRY_RUN:
        return None, "sẽ tạo kiểu '%s' (màu %d,%d,%d); %s" % ((TEN_HATCH,) + MAU_HATCH + (ghi_chu,))
    goc = FilteredElementCollector(doc).OfClass(FilledRegionType).FirstElement()
    t = goc.Duplicate(TEN_HATCH)
    t.ForegroundPatternId = pid
    t.ForegroundPatternColor = Color(*MAU_HATCH)
    t.BackgroundPatternId = ElementId.InvalidElementId
    t.IsMasking = False
    return t, "đã tạo kiểu '%s' (màu %d,%d,%d); %s" % ((TEN_HATCH,) + MAU_HATCH + (ghi_chu,))


def gom_nhom(ids, ten_goc):
    """Gom phần tử vào Detail Group, đặt tên kiểu group (trùng thì thêm _2, _3…)"""
    g = doc.Create.NewGroup(ds_id(ids))
    ten_nhom = ten_goc
    da_dung = set(ten(t) for t in FilteredElementCollector(doc).OfClass(GroupType))
    i = 1
    while ten_nhom in da_dung:
        i += 1
        ten_nhom = "%s_%d" % (ten_goc, i)
    doc.GetElement(g.GetTypeId()).Name = ten_nhom
    return ten_nhom


# ---------- quét lưới dấu chân tường ----------
def goc_chinh(tuong):
    """Phương chính của tường (độ, 0–90) theo tổng chiều dài"""
    dem = {}
    for w in tuong:
        try:
            c = w.Location.Curve
            a, b = c.GetEndPoint(0), c.GetEndPoint(1)
        except Exception:
            continue
        L = math.hypot(b.X - a.X, b.Y - a.Y)
        if L > 1e-6:
            g = round(math.degrees(math.atan2(b.Y - a.Y, b.X - a.X)) % 90.0)
            dem[g % 90] = dem.get(g % 90, 0.0) + L
    return max(dem.items(), key=lambda kv: kv[1])[0] if dem else 0.0


def mat_day(e, opt):
    """Các mặt đáy (pháp tuyến hướng xuống) của khối đối tượng → list[list[vòng điểm 2D]]"""
    kq = []
    ds = list(e.get_Geometry(opt) or [])
    while ds:
        g = ds.pop()
        ten_lop = g.GetType().Name
        if ten_lop == "GeometryInstance":
            ds.extend(list(g.GetInstanceGeometry()))
            continue
        if ten_lop != "Solid" or g.Volume <= 0:
            continue
        for f in g.Faces:
            if f.GetType().Name == "PlanarFace" and f.FaceNormal.Z < -0.99:
                vong = [diem_loop(list(cl)) for cl in f.GetEdgesAsCurveLoops()]
                vong = [v for v in vong if len(v) >= 3]
                if vong:
                    kq.append(vong)
    return kq


def loi_tuong(w):
    """Đường tim DẢI LÕI của tường thẳng: (A, B, bề dày lõi, bề dày tường); None nếu tường cong / không có cấu tạo lớp"""
    cv = w.Location.Curve
    if cv.GetType().Name != "Line":
        return None
    cau_tao = w.WallType.GetCompoundStructure()
    if cau_tao is None:
        return None
    lop = list(cau_tao.GetLayers())
    i0, i1 = cau_tao.GetFirstCoreLayerIndex(), cau_tao.GetLastCoreLayerIndex()
    if not lop or i0 < 0 or i1 < i0:
        return None
    W = w.Width
    ngoai = sum(l.Width for l in lop[:i0])                  # lớp phía ngoài lõi (theo Orientation)
    cw = sum(l.Width for l in lop[i0:i1 + 1])
    tam_loi = W / 2 - ngoai - cw / 2                        # tim lõi lệch khỏi tim tường về phía Orientation
    k = w.get_Parameter(BuiltInParameter.WALL_KEY_REF_PARAM).AsInteger()
    dinh_vi = {0: 0.0, 1: tam_loi, 2: W / 2, 3: -W / 2, 4: W / 2 - ngoai, 5: W / 2 - ngoai - cw}.get(k, 0.0)
    o = w.Orientation
    d = tam_loi - dinh_vi
    A, B = cv.GetEndPoint(0), cv.GetEndPoint(1)
    return ((A.X + o.X * d, A.Y + o.Y * d), (B.X + o.X * d, B.Y + o.Y * d), cw, W)


def keo_noi(w, dau_i):
    """Nửa bề dày lớn nhất của tường nối ở đầu dau_i (0 / 1) → kéo dải lõi cho kín góc nối"""
    kq = 0.0
    try:
        for e in w.Location.get_ElementsAtJoin(dau_i):
            if e.Id.Value != w.Id.Value:
                try:
                    kq = max(kq, e.Width / 2)
                except Exception:
                    pass
    except Exception:
        pass
    return kq


def quet_khe(view, lv):
    """Khoảng trống khép kín giữa tường / cột: list[{pts, loops(curve), m2, diem, kt}]"""
    zc = lv.Elevation + mm(1000)
    opt = Options()
    opt.DetailLevel = ViewDetailLevel.Fine
    tuong, chi_tuong = [], []
    for cat in (BuiltInCategory.OST_Walls, BuiltInCategory.OST_Columns, BuiltInCategory.OST_StructuralColumns):
        for e in FilteredElementCollector(doc, view.Id).OfCategory(cat).WhereElementIsNotElementType():
            bb = e.get_BoundingBox(None)
            if bb is not None and bb.Min.Z - mm(10) <= zc <= bb.Max.Z + mm(10):
                tuong.append(e)
                if cat == BuiltInCategory.OST_Walls:
                    chi_tuong.append(e)
    th = math.radians(goc_chinh(chi_tuong))
    cs, sn = math.cos(th), math.sin(th)
    xoay = lambda p: (p[0] * cs + p[1] * sn, -p[0] * sn + p[1] * cs)
    mat, loi, bo_mong = [], {}, 0
    id_tuong = set(w.Id.Value for w in chi_tuong)
    for e in tuong:
        try:
            tt = loi_tuong(e) if e.Id.Value in id_tuong else None
        except Exception:
            tt = None
        if tt is not None:
            (ax, ay), (bx, by), cw, W = tt
            if cw < mm(LOI_MONG_MM):
                bo_mong += 1           # tường ốp / lớp hoàn thiện riêng: không phải vách
                continue
            L = math.hypot(bx - ax, by - ay)
            if L < 1e-6:
                continue
            ux, uy = (bx - ax) / L, (by - ay) / L
            loi[e.Id.Value] = (ax, ay, bx, by, cw)
            ka, kb = keo_noi(e, 0), keo_noi(e, 1)
            pa, pb = (ax - ux * ka, ay - uy * ka), (bx + ux * kb, by + uy * kb)
            nx_, ny_ = -uy * cw / 2, ux * cw / 2
            mat.append([[xoay(p) for p in ((pa[0] + nx_, pa[1] + ny_), (pb[0] + nx_, pb[1] + ny_),
                                           (pb[0] - nx_, pb[1] - ny_), (pa[0] - nx_, pa[1] - ny_))]])
            continue
        try:
            for vong in mat_day(e, opt):
                mat.append([[xoay(p) for p in v] for v in vong])
        except Exception:
            pass
    bao_cao.append("Quét theo dải lõi %d tường (bỏ %d tường ốp / hoàn thiện mỏng)" % (len(loi), bo_mong))
    c = mm(O_LUOI_MM)
    # đường phân chia phòng (Room Separation) trên level: coi như vách mỏng 1,5 ô lưới (G19: khép 2 ô ở hành lang)
    for e in FilteredElementCollector(doc).OfCategory(BuiltInCategory.OST_RoomSeparationLines) \
            .WhereElementIsNotElementType():
        try:
            cv = e.GeometryCurve
            if abs(cv.GetEndPoint(0).Z - lv.Elevation) > mm(500) and e.LevelId != lv.Id:
                continue
            ds = [cv.GetEndPoint(0), cv.GetEndPoint(1)] if cv.GetType().Name == "Line" else list(cv.Tessellate())
        except Exception:
            continue
        for a, b in zip(ds, ds[1:]):
            L = math.hypot(b.X - a.X, b.Y - a.Y)
            if L < 1e-6:
                continue
            nx_, ny_ = -(b.Y - a.Y) / L * 0.75 * c, (b.X - a.X) / L * 0.75 * c
            mat.append([[xoay(p) for p in ((a.X + nx_, a.Y + ny_), (b.X + nx_, b.Y + ny_),
                                           (b.X - nx_, b.Y - ny_), (a.X - nx_, a.Y - ny_))]])
    if not mat:
        return [], 0
    xs = [p[0] for f in mat for v in f for p in v]
    ys = [p[1] for f in mat for v in f for p in v]
    x0, y0 = min(xs) - 3 * c, min(ys) - 3 * c
    nx, ny = int((max(xs) - x0) / c) + 4, int((max(ys) - y0) / c) + 4
    luoi = [bytearray(nx) for _ in range(ny)]
    mep_doc, mep_ngang = [], []   # mép vách song song trục lưới: (x, y_min, y_max) / (y, x_min, x_max)

    def to(f):                 # tô 1 mặt (các vòng điểm đã xoay) theo quy tắc chẵn lẻ
        canh = [(v[i], v[(i + 1) % len(v)]) for v in f for i in range(len(v))]
        for a, b in canh:
            if abs(a[0] - b[0]) < 1e-6:
                mep_doc.append((a[0], min(a[1], b[1]), max(a[1], b[1])))
            elif abs(a[1] - b[1]) < 1e-6:
                mep_ngang.append((a[1], min(a[0], b[0]), max(a[0], b[0])))
        fy = [p[1] for v in f for p in v]
        for j in range(max(0, int((min(fy) - y0) / c) - 1), min(ny, int((max(fy) - y0) / c) + 2)):
            yc = y0 + (j + 0.5) * c
            cat_x = sorted(a[0] + (yc - a[1]) * (b[0] - a[0]) / (b[1] - a[1]) for a, b in canh if (a[1] > yc) != (b[1] > yc))
            for k in range(0, len(cat_x) - 1, 2):
                i0 = max(0, int(math.ceil((cat_x[k] - x0) / c - 0.5)))
                i1 = min(nx - 1, int(math.floor((cat_x[k + 1] - x0) / c - 0.5)))
                if i1 >= i0:
                    luoi[j][i0:i1 + 1] = b"\x01" * (i1 - i0 + 1)

    def dac(p):
        i, j = int((p[0] - x0) / c), int((p[1] - y0) / c)
        return 0 <= i < nx and 0 <= j < ny and luoi[j][i] == 1

    def bat_mep(v):
        """Đỉnh vùng (toạ độ ô lưới) → toạ độ đã xoay; mỗi cạnh bắt vào mép vách gần nhất trong 1 ô lưới
        (biên sát đúng mép tường thô, không lệch theo lưới)"""
        P = [(x0 + q[0] * c, y0 + q[1] * c) for q in v]
        n = len(P)
        canh = []
        for k in range(n):
            a, b = P[k], P[(k + 1) % n]
            if abs(a[0] - b[0]) < 1e-9:
                lo, hi = min(a[1], b[1]), max(a[1], b[1])
                ds = [m[0] for m in mep_doc if abs(m[0] - a[0]) <= c * 1.01 and min(hi, m[2]) - max(lo, m[1]) > c / 2]
                canh.append(("d", min(ds, key=lambda t: abs(t - a[0])) if ds else a[0]))
            else:
                lo, hi = min(a[0], b[0]), max(a[0], b[0])
                ds = [m[0] for m in mep_ngang if abs(m[0] - a[1]) <= c * 1.01 and min(hi, m[2]) - max(lo, m[1]) > c / 2]
                canh.append(("n", min(ds, key=lambda t: abs(t - a[1])) if ds else a[1]))
        kq_ = []
        for k in range(n):
            e1, e2 = canh[k - 1], canh[k]
            if e1[0] == e2[0]:
                continue
            q = (e1[1], e2[1]) if e1[0] == "d" else (e2[1], e1[1])
            if not kq_ or abs(q[0] - kq_[-1][0]) + abs(q[1] - kq_[-1][1]) > mm(1):
                kq_.append(q)
        while len(kq_) > 1 and abs(kq_[0][0] - kq_[-1][0]) + abs(kq_[0][1] - kq_[-1][1]) <= mm(1):
            kq_.pop()
        # bỏ đỉnh thẳng hàng (bậc lưới bị bắt về cùng một mép)
        doi = True
        while doi and len(kq_) >= 4:
            doi = False
            for k in range(len(kq_)):
                a, b, d_ = kq_[k - 1], kq_[k], kq_[(k + 1) % len(kq_)]
                if abs((b[0] - a[0]) * (d_[1] - b[1]) - (b[1] - a[1]) * (d_[0] - b[0])) < 1e-9:
                    del kq_[k]
                    doi = True
                    break
        return kq_

    for f in mat:
        to(f)
    # nối đầu tường hở: đầu tường cách tường khác ≤ NOI_HO_MM theo phương tường thì kéo dài cho chạm
    # (Revit vẫn khép room qua khe này; G19: 2 ô hành lang hở 185 / 285 mm)
    so_noi = 0
    dau = []                   # (tâm đầu tường x, y, hướng ra ux, uy, bề dày, id tường)
    for wid, (ax, ay, bx, by, ww) in loi.items():       # theo tim dải lõi, bề dày lõi
        for (px, py), (qx, qy) in (((ax, ay), (bx, by)), ((bx, by), (ax, ay))):
            L = math.hypot(px - qx, py - qy)
            if L < 1e-6:
                continue
            ux, uy = (px - qx) / L, (py - qy) / L
            cx, cy = px, py
            dau.append((cx, cy, ux, uy, ww, wid))
            t, buoc, gap_trong, cham = 0.0, c / 2, False, None
            while t <= mm(NOI_HO_MM):
                d = dac(xoay((cx + ux * t, cy + uy * t)))
                if not d:
                    gap_trong = True
                elif gap_trong:
                    cham = t
                    break
                t += buoc
            if cham is None or not gap_trong:
                continue
            nx_, ny_ = -uy * ww / 2, ux * ww / 2
            ex, ey = cx + ux * (cham + c), cy + uy * (cham + c)
            to([[xoay(v) for v in ((cx + nx_, cy + ny_), (ex + nx_, ey + ny_), (ex - nx_, ey - ny_), (cx - nx_, cy - ny_))]])
            so_noi += 1
    # nối góc: 2 đầu tường không song song, giao điểm tim cách cả 2 đầu ≤ NOI_HO_MM → kéo dài cả 2 tới giao điểm
    G = mm(NOI_HO_MM)
    for m in range(len(dau)):
        x1, y1, u1, v1, w1, id1 = dau[m]
        for n in range(m + 1, len(dau)):
            x2, y2, u2, v2, w2, id2 = dau[n]
            if id1 == id2 or abs(x1 - x2) > 2 * G or abs(y1 - y2) > 2 * G:
                continue
            det = u1 * (-v2) - v1 * (-u2)
            if abs(det) < 0.2:          # gần song song
                # hốc chữ U: 2 đầu tường song song cùng hướng, thẳng hàng, miệng ≤ NOI_HO_MM → đóng miệng hốc
                # (G19: hốc 470 x 120 sau tường lô gia, người dùng chỉ là trục 2026-10-28)
                lech_truc = (x2 - x1) * u1 + (y2 - y1) * v1
                mieng = abs(-(x2 - x1) * v1 + (y2 - y1) * u1)
                if u1 * u2 + v1 * v2 > 0.98 and abs(lech_truc) <= max(w1, w2) / 2 + c and \
                        (w1 + w2) / 2 < mieng <= G + (w1 + w2) / 2:
                    k_ = 1.5 * c
                    to([[xoay(p) for p in ((x1, y1), (x2, y2), (x2 - u2 * k_, y2 - v2 * k_), (x1 - u1 * k_, y1 - v1 * k_))]])
                    so_noi += 1
                continue
            t1 = ((x2 - x1) * (-v2) - (y2 - y1) * (-u2)) / det
            t2 = (u1 * (y2 - y1) - v1 * (x2 - x1)) / det
            if not (-w2 / 2 <= t1 <= G and -w1 / 2 <= t2 <= G) or (t1 <= c and t2 <= c):
                continue
            for x, y, u, v, ww, t, wk in ((x1, y1, u1, v1, w1, t1, w2), (x2, y2, u2, v2, w2, t2, w1)):
                if t <= 0:
                    continue
                e_ = t + wk / 2
                nx_, ny_ = -v * ww / 2, u * ww / 2
                ex, ey = x + u * e_, y + v * e_
                to([[xoay(p) for p in ((x + nx_, y + ny_), (ex + nx_, ey + ny_), (ex - nx_, ey - ny_), (x - nx_, y - ny_))]])
            so_noi += 1
    # dải ô trống theo hàng + hợp nhất (4 hướng)
    chay, cha = [], []

    def goc(a):
        while cha[a] != a:
            cha[a] = cha[cha[a]]
            a = cha[a]
        return a
    truoc = []
    for j in range(ny):
        hang, i, nay = luoi[j], 0, []
        while True:
            a = hang.find(0, i)
            if a < 0:
                break
            b = hang.find(1, a)
            b = nx if b < 0 else b
            k = len(chay)
            chay.append((j, a, b - 1))
            cha.append(k)
            nay.append(k)
            i = b
        p = 0
        for k in nay:
            _, a, b = chay[k]
            while p < len(truoc) and chay[truoc[p]][2] < a:
                p += 1
            q = p
            while q < len(truoc) and chay[truoc[q]][1] <= b:
                ra, rb = goc(k), goc(truoc[q])
                if ra != rb:
                    cha[ra] = rb
                q += 1
        truoc = nay
    nhom = {}
    for k, (j, a, b) in enumerate(chay):
        nhom.setdefault(goc(k), []).append(k)
    c2 = ra_m2(c * c)
    kq = []
    for ks in nhom.values():
        o = sum(chay[k][2] - chay[k][1] + 1 for k in ks)
        if not (DT_NHO_NHAT_M2 <= o * c2 <= DT_CO_BANG_CHUNG_M2):
            continue
        if any(chay[k][0] in (0, ny - 1) or chay[k][1] == 0 or chay[k][2] == nx - 1 for k in ks):
            continue
        S = set((i, chay[k][0]) for k in ks for i in range(chay[k][1], chay[k][2] + 1))
        # biên: cạnh ô giáp ngoài, hướng ngược chiều kim đồng hồ quanh vùng
        di = {}
        for (i, j) in S:
            if (i, j - 1) not in S:
                di.setdefault((i, j), []).append((i + 1, j))
            if (i + 1, j) not in S:
                di.setdefault((i + 1, j), []).append((i + 1, j + 1))
            if (i, j + 1) not in S:
                di.setdefault((i + 1, j + 1), []).append((i, j + 1))
            if (i - 1, j) not in S:
                di.setdefault((i, j + 1), []).append((i, j))
        vong = []
        while di:
            dau = next(iter(di))
            v, p = [dau], dau
            while True:
                ds = di.get(p)
                if not ds:
                    break
                n = ds.pop()
                if not ds:
                    del di[p]
                if n == dau:
                    break
                v.append(n)
                p = n
            gon = [v[t] for t in range(len(v)) if not (
                (v[t - 1][0] == v[t][0] == v[(t + 1) % len(v)][0]) or (v[t - 1][1] == v[t][1] == v[(t + 1) % len(v)][1]))]
            if len(gon) >= 4:
                vong.append(gon)
        if not vong:
            continue
        ve_the_gioi = lambda q: ((x0 + q[0] * c) * cs - (y0 + q[1] * c) * sn, (x0 + q[0] * c) * sn + (y0 + q[1] * c) * cs)
        sat = [v for v in (bat_mep(v) for v in vong) if len(v) >= 4]
        if not sat:
            continue
        pts = [[(p[0] * cs - p[1] * sn, p[0] * sn + p[1] * cs) for p in v] for v in sat]
        z = lv.Elevation
        loops = [[Line.CreateBound(XYZ(a[0], a[1], z), XYZ(b[0], b[1], z)) for a, b in zip(v, v[1:] + v[:1])] for v in pts]
        gi = sum(i for i, j in S) / float(len(S))
        gj = sum(j for i, j in S) / float(len(S))
        ti, tj = min(S, key=lambda q: (q[0] - gi) ** 2 + (q[1] - gj) ** 2)
        diem = ve_the_gioi((ti + 0.5, tj + 0.5))
        dt = sorted((abs(sum(v[t][0] * v[(t + 1) % len(v)][1] - v[(t + 1) % len(v)][0] * v[t][1]
                             for t in range(len(v)))) / 2 for v in sat), reverse=True)
        rong, dai = kich_thuoc(max(sat, key=len))
        kq.append({"pts": pts, "loops": loops, "m2": ra_m2(dt[0] - sum(dt[1:])), "diem": diem,
                   "kt": (ra_mm(rong), ra_mm(dai)), "ten": ""})
    bao_cao.append("Nối %d đầu tường hở ≤ %g mm khi quét" % (so_noi, NOI_HO_MM))
    return kq, len(mat)


def toa_do(p):
    return "(%d, %d)" % (round(ra_mm(p[0])), round(ra_mm(p[1])))


def tim_truc(view, lv, da_lam, viec, ghi_them):
    """Nhận trục / hộp kỹ thuật trên level của view → (se_lam, da_co, bi_loai, xem_lai).
    da_lam(v): ô đã làm rồi (đã hatch / đã có lỗ mở) → bỏ qua; viec: chữ trong báo cáo ("hatch", "tạo lỗ mở")"""
    z = lv.Elevation
    # ---- dữ liệu trên level ----
    cua = [p for d in theo_level(BuiltInCategory.OST_Doors, lv) for p in diem_hai_ben(d)]
    cua_so = [p for d in theo_level(BuiltInCategory.OST_Windows, lv) for p in diem_hai_ben(d)]
    tb = []
    da_xet = set()
    for e in list(theo_level(BuiltInCategory.OST_PlumbingFixtures, lv)) + list(
            FilteredElementCollector(doc, view.Id).OfCategory(BuiltInCategory.OST_PlumbingFixtures)
            .WhereElementIsNotElementType()):
        if e.Id.Value in da_xet:
            continue
        da_xet.add(e.Id.Value)
        p = diem_tam(e)
        if p is None:
            continue
        try:     # bồn cầu host trên sàn: điểm đặt sát tường → dò thêm 200 mm theo hướng mặt
            f = e.FacingOrientation
            p = (p[0] + f.X * mm(200), p[1] + f.Y * mm(200))
        except Exception:
            pass
        tb.append(p)
    san = [vong_san(f) for f in FilteredElementCollector(doc).OfClass(Floor)
           if f.LevelId == lv.Id and not la_san_ket_cau(f)]
    san = [s for s in san if s]
    ong = ong_dung(lv)
    shaft = [diem_tam(e) for e in FilteredElementCollector(doc).OfCategory(BuiltInCategory.OST_ShaftOpening)
             .WhereElementIsNotElementType()]
    shaft = [p for p in shaft if p]
    loai = []
    for cat in (BuiltInCategory.OST_SpecialityEquipment, BuiltInCategory.OST_GenericModel,
                BuiltInCategory.OST_MechanicalEquipment, BuiltInCategory.OST_Stairs):
        for e in FilteredElementCollector(doc).OfCategory(cat).WhereElementIsNotElementType():
            if cat == BuiltInCategory.OST_Stairs or co_tu(ten_family(e) + " " + ten_kieu(e), TU_KHOA_LOAI):
                p = diem_tam(e)
                bb = e.get_BoundingBox(None)
                if p and bb and bb.Min.Z - mm(500) <= z + mm(1000) <= bb.Max.Z + mm(500):
                    loai.append(p)
    bao_cao.append("Trên level: cửa đi %d, cửa sổ %d, thiết bị vệ sinh %d, sàn hoàn thiện %d, ống đứng %d, "
                   "shaft opening %d, thang máy / thang bộ %d; %s" % (
                       len(cua) // 2, len(cua_so) // 2, len(tb), len(san), len(ong), len(shaft), len(loai),
                       ghi_them))
    if not ong and not shaft:
        bao_cao.append("Model không có ống đứng / shaft opening → trục, hộp nhận theo tên room hoặc hình học "
                       "(ô kín không cửa, cửa sổ, thiết bị, sàn) – xem ảnh để duyệt (Cần xác nhận lại).")

    # ---- room đã đặt tên trục / hộp kỹ thuật hoặc thang (chỉ đọc) ----
    opt = SpatialElementBoundaryOptions()
    opt.SpatialElementBoundaryLocation = SpatialElementBoundaryLocation.CoreBoundary
    room_hkt, room_loai = [], []
    for r in FilteredElementCollector(doc).OfCategory(BuiltInCategory.OST_Rooms).WhereElementIsNotElementType():
        if r.LevelId != lv.Id or r.Area <= 0 or r.Location is None:
            continue
        ten_r = r.get_Parameter(BuiltInParameter.ROOM_NAME).AsString() or ""
        if co_tu(ten_r, TU_KHOA_LOAI):
            room_loai.append(r)
        elif co_tu(ten_r, TU_KHOA_HKT):
            loops = [[phang(sg.GetCurve(), z) for sg in segs] for segs in (r.GetBoundarySegments(opt) or [])]
            loops = [l for l in loops if len(l) >= 2]
            if loops:
                p0 = r.Location.Point
                room_hkt.append({"loops": loops, "pts": [diem_loop(l) for l in loops], "m2": ra_m2(r.Area),
                                 "ten": ten_r, "diem": (p0.X, p0.Y)})
    for v in room_hkt:
        v["kt"] = tuple(ra_mm(t) for t in kich_thuoc(max(v["pts"], key=len)))

    # ---- khoảng trống kín giữa tường (quét lưới) ----
    TransactionManager.Instance.EnsureInTransaction(doc)
    khe, so_mat = quet_khe(view, lv)
    bao_cao.append("Quét dấu chân %d mặt đáy tường / cột: %d khoảng trống kín ≤ %g m2" % (
        so_mat, len(khe), DT_CO_BANG_CHUNG_M2))

    # ---- phân loại ----
    se_ve, da_co, bi_loai, xem_lai = [], 0, [], []
    for v in room_hkt + khe:
        pts = v["pts"]
        x, y = v["diem"]
        trong = lambda ds: [p for p in ds if trong_vung(p[0], p[1], pts)]
        if trong(loai) or any(r.IsPointInRoom(XYZ(x, y, z + mm(1000))) for r in room_loai):
            bi_loai.append((v, "thang máy / thang bộ"))
            continue
        if v["ten"]:
            nguon = "tên room '%s'" % v["ten"]
        elif any(trong_vung(x, y, r["pts"]) for r in room_hkt):
            continue          # đã nhận theo room đặt tên
        elif trong(cua) or trong(tb):
            continue
        elif trong(shaft):
            nguon = "shaft opening"
        elif trong(ong):
            nguon = "ống đứng"
        elif (not trong(cua_so) and not any(trong_vung(x, y, s_) for s_ in san)
              and v["m2"] <= DT_MAX_M2 and v["kt"][0] >= RONG_MIN_MM):
            nguon = "hình học"
        else:
            continue
        if da_lam(v):
            da_co += 1
            continue
        v["nguon"] = nguon
        se_ve.append(v)
        if v["kt"][0] > O_LON_MM:
            xem_lai.append(v)
    try:     # danh sách khoảng trống (mm) để vẽ ảnh đối chiếu khi cần
        import json
        with open(os.path.join(THU_MUC, "ngan_chay_vung.json"), "w", encoding="utf-8") as f:
            json.dump([{"m2": round(v["m2"], 3), "kt": [round(t) for t in v["kt"]], "nguon": v.get("nguon", ""),
                        "pts": [[(round(ra_mm(p[0])), round(ra_mm(p[1]))) for p in l] for l in v["pts"]]}
                       for v in room_hkt + khe], f, ensure_ascii=False)
    except Exception:
        pass
    dem_nguon = {}
    for v in se_ve:
        dem_nguon[v["nguon"].split(" '")[0]] = dem_nguon.get(v["nguon"].split(" '")[0], 0) + 1
    bao_cao.append("Trục / hộp kỹ thuật cần %s: %d (%s); đã có %s: %d; loại vì thang: %d" % (
        viec, len(se_ve), ", ".join("%s %d" % kv for kv in sorted(dem_nguon.items())) or "-", viec, da_co, len(bi_loai)))
    for v in sorted(se_ve, key=lambda v: -v["m2"]):
        bao_cao.append("   %5.2f m2  %4d x %4d mm  %-14s tại %s" % (
            v["m2"], round(v["kt"][0]), round(v["kt"][1]), v["nguon"], toa_do(v["diem"])))
    if xem_lai:
        bao_cao.append("CẦN XEM LẠI (ô lớn hơn %d x %d mm, vẫn nhận): %s" % (
            O_LON_MM, O_LON_MM, "; ".join("%.2f m2 tại %s" % (v["m2"], toa_do(v["diem"])) for v in xem_lai)))
    for v, ly_do in bi_loai:
        bao_cao.append("Loại (%s): %.2f m2 tại %s" % (ly_do, v["m2"], toa_do(v["diem"])))

    return se_ve, da_co, bi_loai, xem_lai


# ==== HẾT PHẦN CHUNG ====


# ---------- riêng công cụ lỗ mở ----------
def chon_view():
    """Mặt bằng tầng: theo tên (IN[0]) hoặc view đang mở"""
    loai_mb = (ViewType.FloorPlan, ViewType.EngineeringPlan)
    if TEN_VIEW:
        ds = [v for v in FilteredElementCollector(doc).OfClass(ViewPlan)
              if not v.IsTemplate and v.Name == TEN_VIEW and v.ViewType in loai_mb]
        if not ds:
            raise Exception("Không tìm thấy mặt bằng tầng tên '%s'" % TEN_VIEW)
        return ds[0]
    av = doc.ActiveView
    if av is None or av.ViewType not in loai_mb or av.GenLevel is None:
        raise Exception("View đang mở không phải mặt bằng tầng – mở mặt bằng tầng cần tạo lỗ mở rồi chạy lại")
    return av


def dat(e, bip, ten_ui, gt):
    """Gán tham số theo BuiltInParameter, không được thì theo tên trên giao diện; trả về True nếu gán được"""
    p = e.get_Parameter(bip)
    if p is None or p.IsReadOnly:
        p = e.LookupParameter(ten_ui)
    if p is None or p.IsReadOnly:
        return False
    return bool(p.Set(gt))


def doc_tham_so(e):
    def lay(bip, ten_ui):
        p = e.get_Parameter(bip) or e.LookupParameter(ten_ui)
        if p is None:
            return "?"
        if p.StorageType == StorageType.ElementId:
            return ten(doc.GetElement(p.AsElementId()))
        if p.StorageType == StorageType.Double:
            return "%g mm" % round(ra_mm(p.AsDouble()), 1)
        return p.AsValueString() or ""
    return "Base %s / %s, Top %s / %s" % (
        lay(BuiltInParameter.WALL_BASE_CONSTRAINT, "Base Constraint"), lay(BuiltInParameter.WALL_BASE_OFFSET, "Base Offset"),
        lay(BuiltInParameter.WALL_HEIGHT_TYPE, "Top Constraint"), lay(BuiltInParameter.WALL_TOP_OFFSET, "Top Offset"))


# ---------- 1 shaft opening cho cả tầng + dấu X (Symbolic Line chép từ shaft mẫu) ----------
import time


class _BoQuaCanhBao(IFailuresPreprocessor):
    """Bỏ cảnh báo khi kết thúc sửa sketch (lỗi thật vẫn để Revit báo)"""
    __namespace__ = "ARV.LoMo.X%d" % int(time.time() * 1000)   # tên kiểu .NET mới mỗi lần nạp (chạy lại trong cùng phiên)

    def PreprocessFailures(self, fa):
        for m in fa.GetFailureMessages():
            if m.GetSeverity() == FailureSeverity.Warning:
                fa.DeleteWarning(m)
        return FailureProcessingResult.Continue


class _GhiLoi(IFailuresPreprocessor):
    """Ghi lại thông báo lỗi Revit khi sửa sketch / commit (để báo nguyên nhân); cảnh báo tự bỏ, lỗi thì hủy bước đó"""
    __namespace__ = "ARV.LoMo.G%d" % int(time.time() * 1000)

    loi = []

    def PreprocessFailures(self, fa):
        co_loi = False
        for m in fa.GetFailureMessages():
            if m.GetSeverity() == FailureSeverity.Warning:
                fa.DeleteWarning(m)
            else:
                co_loi = True
                self.loi.append(m.GetDescriptionText())
        return FailureProcessingResult.ProceedWithRollBack if co_loi else FailureProcessingResult.Continue


def tach_sketch(op):
    """Sketch của shaft → (nét biên, nét symbolic): nét symbolic = ModelLine mang line style khác "<Sketch>" """
    sk = doc.GetElement(op.SketchId)
    bien, ky = [], []
    for i in sk.GetAllElements():
        e = doc.GetElement(i)
        if e.GetType().Name == "ModelLine":
            (bien if e.LineStyle is None or e.LineStyle.Name == "<Sketch>" else ky).append(e)
    return bien, ky


def vong_shaft(op):
    """Các vòng biên trong sketch của shaft → list[list[(x, y)]]"""
    sk = doc.GetElement(op.SketchId)
    return [[(p.X, p.Y) for c in arr for p in list(c.Tessellate())[:-1]] for arr in sk.Profile]


def la_shaft_tang(op, lv):
    """Shaft lỗ mở cục bộ của tầng: Base Constraint và Top Constraint đều là level này"""
    b = op.get_Parameter(BuiltInParameter.WALL_BASE_CONSTRAINT)
    t = op.get_Parameter(BuiltInParameter.WALL_HEIGHT_TYPE)
    return b is not None and t is not None and b.AsElementId() == lv.Id and t.AsElementId() == lv.Id


def tim_mau_x():
    """2 nét symbolic của một shaft mẫu có dấu X vẽ tay → (id 2 nét, mô tả); không có thì (None, "")"""
    for o in FilteredElementCollector(doc).OfCategory(BuiltInCategory.OST_ShaftOpening).WhereElementIsNotElementType():
        try:
            ky = tach_sketch(o)[1]
        except Exception:
            continue
        if len(ky) >= 2:
            return [e.Id for e in ky[:2]], "shaft %d (nét %s)" % (o.Id.Value, ky[0].LineStyle.Name)
    return None, ""


def duong_cheo(curves, z):
    """2 đường chéo của hình chữ nhật bao 1 vòng biên, theo phương cạnh dài nhất (đúng cả lỗ xoay xiên)"""
    dai = max(curves, key=lambda c: c.Length)
    a, b = dai.GetEndPoint(0), dai.GetEndPoint(1)
    L = math.hypot(b.X - a.X, b.Y - a.Y)
    ux, uy = (b.X - a.X) / L, (b.Y - a.Y) / L
    pts = [p for c in curves for p in (c.GetEndPoint(0), c.GetEndPoint(1))]
    su = [p.X * ux + p.Y * uy for p in pts]
    sv = [-p.X * uy + p.Y * ux for p in pts]
    diem = lambda s, t: XYZ(s * ux - t * uy, s * uy + t * ux, z)
    u0, u1, v0, v1 = min(su), max(su), min(sv), max(sv)
    return [Line.CreateBound(diem(u0, v0), diem(u1, v1)), Line.CreateBound(diem(u0, v1), diem(u1, v0))]


def x_ngat(curves, z):
    """Dấu X không cắt nhau (Revit báo "Lines cannot intersect each other" khi 2 đường chéo giao tại tâm): mỗi đường chéo
    chia thành 2 đoạn, cách tâm 25 mm mỗi phía → 4 đoạn symbolic / vòng"""
    kq = []
    for l in duong_cheo(curves, z):
        a, b = l.GetEndPoint(0), l.GetEndPoint(1)
        d = b - a
        t = mm(25) / d.GetLength()
        p1 = a + d * (0.5 - t)
        p2 = a + d * (0.5 + t)
        kq.append(Line.CreateBound(a, p1))
        kq.append(Line.CreateBound(p2, b))
    return kq


def dat_rang_buoc(op, lv):
    ok = (dat(op, BuiltInParameter.WALL_BASE_CONSTRAINT, "Base Constraint", lv.Id) and
          dat(op, BuiltInParameter.WALL_BASE_OFFSET, "Base Offset", mm(BASE_OFFSET_MM)) and
          dat(op, BuiltInParameter.WALL_HEIGHT_TYPE, "Top Constraint", lv.Id) and
          dat(op, BuiltInParameter.WALL_TOP_OFFSET, "Top Offset", mm(TOP_OFFSET_MM)))
    if not ok:
        bao_cao.append("Shaft %d: không gán đủ ràng buộc (%s)" % (op.Id.Value, doc_tham_so(op)))


def tao_shaft(lv, vung):
    """Tạo 1 shaft opening với vòng biên của 1 ô (transaction riêng) → Opening"""
    ca = CurveArray()
    for l in vung["loops"]:
        for c in l:
            ca.Append(c)
    tren = sorted([l for l in FilteredElementCollector(doc).OfClass(Level) if l.Elevation > lv.Elevation + mm(1)],
                  key=lambda l: l.Elevation)
    t = Transaction(doc, "ARV - Lỗ mở shaft")
    t.Start()
    try:
        try:
            op = doc.Create.NewOpening(lv, lv, ca)
        except Exception:
            if not tren:
                raise
            op = doc.Create.NewOpening(lv, tren[0], ca)     # tạo tới tầng trên rồi đặt lại ràng buộc
        dat_rang_buoc(op, lv)
        t.Commit()
        return op
    except Exception:
        if t.HasStarted() and not t.HasEnded():
            t.RollBack()
        raise


def vong_chua_x(op):
    """Các vòng biên đã có trong sketch nhưng chưa có dấu X (ít hơn 2 nét symbolic có trung điểm trong vòng)"""
    sk = doc.GetElement(op.SketchId)
    _, ky = tach_sketch(op)
    giua_ky = []
    for e in ky:
        c = e.GeometryCurve
        a, b = c.GetEndPoint(0), c.GetEndPoint(1)
        giua_ky.append(((a.X + b.X) / 2, (a.Y + b.Y) / 2))
    can_x = []
    for arr in sk.Profile:
        cs = [c for c in arr]
        pts = [(c.GetEndPoint(0).X, c.GetEndPoint(0).Y) for c in cs]
        if sum(1 for q in giua_ky if trong_da_giac(q[0], q[1], pts)) < 2:
            can_x.append(cs)
    return can_x


def gan_x_api(op):
    """Không có shaft mẫu: vẽ 2 đường chéo cho mỗi vòng chưa có X rồi đổi line style sang nét thường (<Thin Lines>)
    → thành nét symbolic, cùng cách đổi line style của DetailCurve (CurveElement.LineStyle). Một lần sửa sketch riêng,
    lỗi thì hủy riêng bước này (vòng biên đã thêm vẫn còn). → số vòng đã gắn X"""
    sk = doc.GetElement(op.SketchId)
    zs = sk.SketchPlane.GetPlane().Origin.Z
    can_x = vong_chua_x(op)
    if not can_x:
        return 0
    gs = doc.Settings.Categories.get_Item(BuiltInCategory.OST_Lines).GetGraphicsStyle(GraphicsStyleType.Projection)
    ses = SketchEditScope(doc, "ARV - Lỗ mở shaft X")
    t = Transaction(doc, "ARV - Lỗ mở shaft X")
    ghi = _GhiLoi()
    tuy_chon = t.GetFailureHandlingOptions()
    tuy_chon.SetFailuresPreprocessor(ghi)
    t.SetFailureHandlingOptions(tuy_chon)
    try:
        ses.Start(op.SketchId)
        t.Start()
        for cs in can_x:
            for l in x_ngat(cs, zs):
                mc = doc.Create.NewModelCurve(l, sk.SketchPlane)
                mc.LineStyle = gs
        t.Commit()
        ses.Commit(ghi)
        return len(can_x)
    except Exception as ex:
        try:
            if t.HasStarted() and not t.HasEnded():
                t.RollBack()
            if ses.IsActive:
                ses.Cancel()
        except Exception:
            pass
        raise Exception("%s | lỗi Revit: %s" % (ex, "; ".join(ghi.loi) or "không có thông báo"))


def them_vong_va_x(op, vung_moi, mau_x):
    """Trong 1 lần sửa sketch của shaft: thêm vòng biên các ô mới + dấu X cho mọi vòng chưa có X → (số vòng thêm, số X)"""
    sk = doc.GetElement(op.SketchId)
    zs = sk.SketchPlane.GetPlane().Origin.Z
    can_x = vong_chua_x(op) if mau_x is not None else []
    ses = SketchEditScope(doc, "ARV - Lỗ mở shaft")
    t = Transaction(doc, "ARV - Lỗ mở shaft")
    so_vong = 0
    try:
        ses.Start(op.SketchId)     # chỉ mở được khi không còn transaction nào đang mở
        t.Start()
        for v in vung_moi:
            cs = []
            for l in v["loops"]:
                for c in l:
                    cs.append(doc.Create.NewModelCurve(phang(c, zs), sk.SketchPlane).GeometryCurve)
            can_x.append(cs)
            so_vong += 1
        so_x = 0
        if mau_x is not None:
            for cs in can_x:
                moi = list(ElementTransformUtils.CopyElements(doc, ds_id(mau_x), XYZ(0, 0, 0)))
                for i, l in zip(moi, duong_cheo(cs, zs)):
                    doc.GetElement(i).SetGeometryCurve(l, True)
                so_x += 1
        t.Commit()
        ses.Commit(_BoQuaCanhBao())
        return so_vong, so_x
    except Exception:
        try:
            if t.HasStarted() and not t.HasEnded():
                t.RollBack()
            if ses.IsActive:
                ses.Cancel()
        except Exception:
            pass
        raise


def chinh():
    view = chon_view()
    lv = view.GenLevel
    z = lv.Elevation
    bao_cao.append("View: %s (level %s) → 1 shaft opening cho cả tầng, Base / Top Constraint = %s, Base Offset %g mm, "
                   "Top Offset %g mm" % (view.Name, lv.Name, lv.Name, BASE_OFFSET_MM, TOP_OFFSET_MM))
    zb, zt = z + mm(BASE_OFFSET_MM), z + mm(TOP_OFFSET_MM)
    tam_vong, cua_tang = [], []      # tâm từng vòng của mọi shaft cắt qua tầng; shaft lỗ mở cục bộ của tầng
    for e in FilteredElementCollector(doc).OfCategory(BuiltInCategory.OST_ShaftOpening).WhereElementIsNotElementType():
        bb = e.get_BoundingBox(None)
        if bb is None or bb.Max.Z <= zb or bb.Min.Z >= zt:
            continue
        try:
            vs = vong_shaft(e)
        except Exception:
            vs = []
        for p in vs:
            tam_vong.append((sum(q[0] for q in p) / len(p), sum(q[1] for q in p) / len(p)))
        if la_shaft_tang(e, lv):
            cua_tang.append((len(vs), e))
    tam_vong, cua_tang = [], []
    se_lam, da_co, bi_loai, xem_lai = tim_truc(
        view, lv, lambda v: any(trong_vung(p[0], p[1], v["pts"]) for p in tam_vong), "lỗ mở",
        "vòng lỗ mở đã có cắt qua tầng: %d" % len(tam_vong))
    dich = max(cua_tang, key=lambda t: t[0])[1] if cua_tang else None
    mau_x, ghi_mau = (None, "")
    if dich is not None:
        bao_cao.append("Thêm vào shaft có sẵn của tầng: %d (%d vòng)" % (dich.Id.Value, max(cua_tang, key=lambda t: t[0])[0]))
    elif se_lam:
        bao_cao.append("Tầng chưa có shaft lỗ mở → tạo 1 shaft mới chứa cả %d vòng" % len(se_lam))
    if GAN_X:
        if mau_x is None:
            bao_cao.append("Model chưa có shaft mẫu có dấu X → sẽ vẽ X bằng API (nét <Thin Lines>), kiểm tra lại sau khi chạy.")
        else:
            bao_cao.append("Dấu X chép từ %s" % ghi_mau)
    if DRY_RUN:
        TransactionManager.Instance.TransactionTaskDone()
        bao_cao.append("DRY-RUN: chưa tạo gì. Đặt IN[4] = False để tạo lỗ mở.")
        return view, []
    TransactionManager.Instance.TransactionTaskDone()
    TransactionManager.Instance.ForceCloseTransaction()     # Dynamo giữ transaction tới cuối lượt chạy → đóng hẳn
    con = list(se_lam)
    if dich is None and con:
        try:
            dich = tao_shaft(lv, con[0])
            con = con[1:]
            bao_cao.append("ĐÃ TẠO shaft opening %d" % dich.Id.Value)
        except Exception as ex:
            bao_cao.append("Không tạo được shaft opening: %s" % str(ex).splitlines()[0])
            return view, []
    if dich is None:
        bao_cao.append("Không có ô trục nào cần lỗ mở.")
        return view, []
    try:
        so_vong, so_x = them_vong_va_x(dich, con, mau_x if GAN_X else None)
        bao_cao.append("ĐÃ THÊM %d vòng lỗ mở + %d dấu X vào shaft %d" % (so_vong, so_x, dich.Id.Value))
    except Exception as ex:
        bao_cao.append("LỖI khi sửa sketch shaft %d: %s – không thêm vòng / dấu X nào" % (dich.Id.Value, str(ex).splitlines()[0]))
    if GAN_X and mau_x is None:
        try:
            n_x = gan_x_api(dich)
            bao_cao.append("ĐÃ VẼ dấu X bằng API cho %d vòng (shaft %d)" % (n_x, dich.Id.Value))
        except Exception as ex:
            bao_cao.append("KHÔNG vẽ được dấu X bằng API (%s) – shaft vẫn có vòng lỗ mở; vẽ tay 2 Symbolic Line chéo "
                           "rồi bấm lại để chép X." % str(ex).splitlines()[0])
            bao_cao.append("Chi tiết lỗi X: " + traceback.format_exc())
    dich = doc.GetElement(dich.Id)
    bao_cao.append("Shaft %d sau cùng: %d vòng, %d nét dấu X; %s" % (
        dich.Id.Value, doc.GetElement(dich.SketchId).Profile.Size, len(tach_sketch(dich)[1]), doc_tham_so(dich)))
    return view, [dich.Id]


def xuat_anh(view):
    try:
        TransactionManager.Instance.ForceCloseTransaction()
        opt = ImageExportOptions()
        opt.ExportRange = ExportRange.SetOfViews
        opt.SetViewsAndSheets(ds_id([view.Id]))
        opt.FilePath = os.path.join(THU_MUC, "lo_mo")
        opt.ZoomType = ZoomFitType.FitToPage
        opt.PixelSize = 6000
        opt.ImageResolution = ImageResolution.DPI_300
        opt.HLRandWFViewsFileType = ImageFileType.PNG
        opt.ShadowViewsFileType = ImageFileType.PNG
        doc.ExportImage(opt)
        bao_cao.append("Ảnh: %s*.png" % opt.FilePath)
    except Exception as ex:
        bao_cao.append("Không xuất được ảnh: %s" % ex)


try:
    v, moi = chinh()
    xuat_anh(v)
except Exception:
    bao_cao.append("LỖI: " + traceback.format_exc())

log = os.path.join(THU_MUC, "lo_mo_%s.txt" % datetime.now().strftime("%Y%m%d_%H%M%S"))
with open(log, "w", encoding="utf-8") as f:
    f.write("\n".join(bao_cao))
bao_cao.append("Log: " + log)
OUT = bao_cao

with open(r"D:\AI\_tmp\revit_lomo_test\log\ket_qua_test.txt", "w", encoding="utf-8") as f:
    f.write("\n".join(bao_cao))
# ----------------------------------------

# group: Đầu ra
báo_cáo = Watch(test_lomo_x)  # graph output
