# Dynamo graph thu_x_20261028_101102.dyn "thu_x" (Dynamo 3.6.2.11575)
# author: Archivina
# Thử dấu X

# group: Đầu vào
thư_mục = StringInput("D:\AI\_tmp\revit_lomo_x")  # graph input

# group: Xử lý
thu_x = Python(IN[0]=thư_mục)  # PythonNet3
# ---------- thu_x.python (86 lines) ----------
# -*- coding: utf-8 -*-
# THỬ API trên BẢN SAO G19: thêm Symbolic Line dấu X vào sketch của 1 shaft opening (SketchEditScope).
import os, traceback
import clr
clr.AddReference("RevitAPI")
clr.AddReference("RevitServices")
from Autodesk.Revit.DB import *
from RevitServices.Persistence import DocumentManager
from RevitServices.Transactions import TransactionManager
doc = DocumentManager.Instance.CurrentDBDocument
OUTD = IN[0]
bc = []


def ten(e):
    try:
        return e.Name
    except Exception:
        return "?"


class BoQua(IFailuresPreprocessor):
    __namespace__ = "ARV.ThuX"

    def PreprocessFailures(self, fa):
        for m in fa.GetFailureMessages():
            bc.append("  failure: %s | %s" % (m.GetSeverity(), m.GetDescriptionText()))
            if m.GetSeverity() == FailureSeverity.Warning:
                fa.DeleteWarning(m)
        return FailureProcessingResult.Continue


try:
    TransactionManager.Instance.ForceCloseTransaction()
    bc.append("BuiltInCategory có Shaft/Symbolic: %s" % [n for n in dir(BuiltInCategory) if "Shaft" in n or "Symbolic" in n or "SketchLines" in n])
    sh = list(FilteredElementCollector(doc).OfCategory(BuiltInCategory.OST_ShaftOpening).WhereElementIsNotElementType())
    bc.append("Shaft: %d" % len(sh))
    op = sh[0]
    bc.append("Opening: %s | thuộc tính có SketchId: %s" % (op.GetType().Name, hasattr(op, "SketchId")))
    sk = [doc.GetElement(i) for i in op.GetDependentElements(ElementClassFilter(Sketch))]
    bc.append("Sketch phụ thuộc: %d" % len(sk))
    sketch = sk[0]
    for i in sketch.GetAllElements():
        e = doc.GetElement(i)
        bc.append("  phần tử sketch: %s | cat %s | style %s" % (e.GetType().Name, e.Category.Name if e.Category else "-",
                  e.LineStyle.Name if hasattr(e, "LineStyle") and e.LineStyle else "-"))
    cat = op.Category
    bc.append("Subcategory của %s: %s" % (cat.Name, [c.Name for c in cat.SubCategories]))
    bc.append("doc.Create có NewSymbolicCurve: %s; FamilyCreate: %s" % (hasattr(doc.Create, "NewSymbolicCurve"), doc.FamilyCreate))
    pts = []
    for c in op.BoundaryCurves:
        pts.append(c.GetEndPoint(0))
    xs = [p.X for p in pts]; ys = [p.Y for p in pts]; z = sketch.SketchPlane.GetPlane().Origin.Z
    a, b = XYZ(min(xs), min(ys), z), XYZ(max(xs), max(ys), z)
    c_, d = XYZ(min(xs), max(ys), z), XYZ(max(xs), min(ys), z)
    # thử: SketchEditScope + NewModelCurve, xem phần tử tạo ra và line style chọn được
    ses = SketchEditScope(doc, "Thu X")
    ses.Start(sketch.Id)
    t = Transaction(doc, "Thu X")
    t.Start()
    mc = doc.Create.NewModelCurve(Line.CreateBound(a, b), sketch.SketchPlane)
    bc.append("Tạo: %s | cat %s | style %s" % (mc.GetType().Name, mc.Category.Name if mc.Category else "-", mc.LineStyle.Name))
    ids = mc.GetLineStyleIds()
    bc.append("Line style chọn được: %s" % [ten(doc.GetElement(i)) for i in ids])
    hop = [i for i in ids if "symbol" in ten(doc.GetElement(i)).lower() or "shaft" in ten(doc.GetElement(i)).lower()]
    if hop:
        mc.LineStyle = doc.GetElement(hop[0])
        bc.append("Đổi style → %s | type %s" % (mc.LineStyle.Name, mc.GetType().Name))
    mc2 = doc.Create.NewModelCurve(Line.CreateBound(c_, d), sketch.SketchPlane)
    if hop:
        mc2.LineStyle = doc.GetElement(hop[0])
    t.Commit()
    ses.Commit(BoQua())
    bc.append("Commit sketch OK")
    op2 = doc.GetElement(op.Id)
    bc.append("Sau commit: opening còn: %s; số cạnh biên: %d" % (op2 is not None, op2.BoundaryCurves.Size if op2 else -1))
    for i in sketch.GetAllElements():
        e = doc.GetElement(i)
        bc.append("  phần tử sketch sau: %s | cat %s | style %s" % (e.GetType().Name, e.Category.Name if e.Category else "-",
                  e.LineStyle.Name if hasattr(e, "LineStyle") and e.LineStyle else "-"))
    doc.Save()
    bc.append("ĐÃ LƯU bản sao")
except Exception:
    bc.append(traceback.format_exc())
open(os.path.join(OUTD, "thu_x.txt"), "w", encoding="utf-8").write("\n".join(bc))
OUT = bc
# ----------------------------------------

# group: Đầu ra
báo_cáo = Watch(thu_x)  # graph output
