# Dynamo graph TaoSanKetCau.dyn (Dynamo 3.6.2.11575)
# author: dungbn
# Tạo sàn kết cấu Revit từ đường bao Model/Detail Line khép kín (vòng trong = lỗ mở)

n1_chọn_đường_bao_sàn_model = DSModelElementsSelection()  # "1. Chọn đường bao sàn (Model/Detail Line)"; 138 picked in the model
n2_level = Levels("TẦNG 2")  # "2. Level"; graph input
n3_floor_type = FloorTypes("Generic 200")  # "3. Floor Type"; graph input
n4_offset_mặt_sàn_mm = DoubleInput(0)  # "4. Offset mặt sàn (mm)"; graph input
n5_chạy_false_chỉ_kiểm_tra = BoolSelector(false)  # "5. Chạy (False = chỉ kiểm tra)"; graph input
taoSanKetCau = Python(IN[0]=n1_chọn_đường_bao_sàn_model, IN[1]=n2_level, IN[2]=n3_floor_type, IN[3]=n4_offset_mặt_sàn_mm, IN[4]=n5_chạy_false_chỉ_kiểm_tra)  # CPython3
# ---------- taoSanKetCau.python (173 lines) ----------
# TaoSanKetCau — tạo sàn kết cấu (Structural Floor) từ các đường bao vẽ sẵn
# Revit 2026 / Dynamo 3.6 (CPython3)
# IN[0] : các Model Line / Detail Line khép kín (có thể nhiều vòng);
#         để trống -> lấy vùng chọn hiện tại trong Revit
#         - vòng ngoài cùng  -> biên sàn
#         - vòng nằm trong   -> lỗ mở (thang, thang máy, hộp KT)
#         - nhiều vòng ngoài rời nhau -> nhiều tấm sàn
# IN[1] : Level
# IN[2] : Floor Type
# IN[3] : Offset mặt sàn so với Level (mm), VD 0 hoặc -50
# IN[4] : True = tạo sàn; False = chỉ kiểm tra, báo cáo
import clr
clr.AddReference('RevitAPI')
clr.AddReference('RevitServices')
from Autodesk.Revit.DB import (CurveLoop, Floor, XYZ, Transform, UnitUtils,
                               UnitTypeId, BuiltInParameter, CurveElement)
from RevitServices.Persistence import DocumentManager
from RevitServices.Transactions import TransactionManager
from System.Collections.Generic import List

doc = DocumentManager.Instance.CurrentDBDocument
TOL = UnitUtils.ConvertToInternalUnits(1.0, UnitTypeId.Millimeters)


def as_list(x):
    if x is None:
        return []
    return list(x) if hasattr(x, '__iter__') and not isinstance(x, str) else [x]


elems = [e for e in as_list(UnwrapElement(IN[0])) if e is not None]
level = UnwrapElement(IN[1])
ftype = UnwrapElement(IN[2])
offset_mm = float(IN[3] or 0)
run = bool(IN[4])
msgs = []

# Node chọn trống -> lấy vùng chọn hiện tại trong Revit
src = 'node Chọn đường bao'
if not elems:
    uidoc = DocumentManager.Instance.CurrentUIApplication.ActiveUIDocument
    elems = [doc.GetElement(i) for i in uidoc.Selection.GetElementIds()]
    src = 'vùng chọn trong Revit'
msgs.append('Nhận %d đối tượng từ %s' % (len(elems), src))

# 1. Lấy curve, chiếu về cao độ level
curves = []
for e in elems:
    if isinstance(e, CurveElement):
        c = e.GeometryCurve
        if not c.IsBound:  # vòng tròn kín -> tách 2 cung
            p0 = 0.0
            half = c.Period / 2.0
            parts = []
            for a, b in ((p0, p0 + half), (p0 + half, p0 + 2 * half)):
                k = c.Clone()
                k.MakeBound(a, b)
                parts.append(k)
        else:
            parts = [c]
        for k in parts:
            dz = level.Elevation - k.GetEndPoint(0).Z
            curves.append(k.CreateTransformed(Transform.CreateTranslation(XYZ(0, 0, dz))))
skipped = len(elems) - len([e for e in elems if isinstance(e, CurveElement)])
if skipped:
    names = sorted(set(e.GetType().Name for e in elems if not isinstance(e, CurveElement)))
    msgs.append('Bỏ qua %d đối tượng không phải Model/Detail Line (%s)' % (skipped, ', '.join(names)))


# 2. Nối curve thành các vòng kín
def same(p, q):
    return p.DistanceTo(q) < TOL


loops, pool = [], curves[:]
while pool:
    chain = [pool.pop(0)]
    start = chain[0].GetEndPoint(0)
    end = chain[0].GetEndPoint(1)
    while not same(start, end):
        nxt = None
        for i, c in enumerate(pool):
            if same(c.GetEndPoint(0), end):
                nxt = pool.pop(i)
                break
            if same(c.GetEndPoint(1), end):
                nxt = pool.pop(i).CreateReversed()
                break
        if nxt is None:
            break
        chain.append(nxt)
        end = nxt.GetEndPoint(1)
    if same(start, end):
        loops.append(chain)
    else:
        msgs.append('Vòng hở tại (%.0f, %.0f) mm — kiểm tra lại nét bao' %
                    (end.X * 304.8, end.Y * 304.8))


# 3. Đa giác 2D để tính diện tích / quan hệ trong–ngoài
def poly(chain):
    pts = []
    for c in chain:
        pts.extend([(p.X, p.Y) for p in list(c.Tessellate())[:-1]])
    return pts


def area(pts):
    return abs(sum(pts[i][0] * pts[i - 1][1] - pts[i - 1][0] * pts[i][1]
                   for i in range(len(pts)))) / 2.0


def inside(pt, pts):
    x, y, res = pt[0], pt[1], False
    for i in range(len(pts)):
        x1, y1 = pts[i - 1]
        x2, y2 = pts[i]
        if (y1 > y) != (y2 > y) and x < (x2 - x1) * (y - y1) / (y2 - y1) + x1:
            res = not res
    return res


polys = [poly(l) for l in loops]
depth = [sum(1 for j in range(len(loops)) if j != i and inside(polys[i][0], polys[j]))
         for i in range(len(loops))]

# 4. Gom: vòng chẵn = biên sàn, vòng lẻ nằm ngay trong = lỗ mở
slabs = []
for i in range(len(loops)):
    if depth[i] % 2:
        continue
    holes = [j for j in range(len(loops)) if depth[j] == depth[i] + 1
             and inside(polys[j][0], polys[i])]
    slabs.append((i, holes))

ft = UnitUtils.ConvertToInternalUnits(1.0, UnitTypeId.Millimeters)
report = []
for i, holes in slabs:
    a = (area(polys[i]) - sum(area(polys[j]) for j in holes)) * 0.09290304
    report.append('Sàn %d: %.2f m², %d lỗ mở' % (len(report) + 1, a, len(holes)))

floors = []
if run and slabs:
    TransactionManager.Instance.EnsureInTransaction(doc)
    for i, holes in slabs:
        cls = List[CurveLoop]()
        outer = CurveLoop()
        for c in loops[i]:
            outer.Append(c)
        if not outer.IsCounterclockwise(XYZ.BasisZ):
            outer.Flip()
        cls.Add(outer)
        for j in holes:
            h = CurveLoop()
            for c in loops[j]:
                h.Append(c)
            if h.IsCounterclockwise(XYZ.BasisZ):
                h.Flip()
            cls.Add(h)
        fl = Floor.Create(doc, cls, ftype.Id, level.Id, True, None, 0.0)
        fl.get_Parameter(BuiltInParameter.FLOOR_HEIGHTABOVELEVEL_PARAM).Set(offset_mm * ft)
        floors.append(fl)
    TransactionManager.Instance.TransactionTaskDone()
    msgs.append('ĐÃ TẠO %d sàn kết cấu "%s" tại %s, offset %.0f mm'
                % (len(floors), ftype.get_Parameter(BuiltInParameter.SYMBOL_NAME_PARAM).AsString(),
                   level.Name, offset_mm))
elif slabs:
    msgs.append('Chế độ KIỂM TRA — đổi nút Chạy = True rồi bấm Run để tạo sàn')
else:
    msgs.append('Không tìm thấy vòng bao kín nào — vẽ Model/Detail Line khép kín, '
                'chọn chúng (node 1: Select → quét → Finish, hoặc chọn sẵn trong Revit) rồi Run')

OUT = report + msgs, floors
# ----------------------------------------
báo_cáo = Watch(taoSanKetCau)
