# Dynamo graph ThongKeCua_TuDong.dyn (Dynamo 3.6.2.11575)
# author: Archivina
# Bảng thống kê cửa đi / cửa sổ của mặt bằng đang mở: cột Ký hiệu (Type Mark) / Rộng / Cao / Số lượng, gộp theo Type Mark (cửa trùng hiện 1 dòng), lọc theo tầng của mặt bằng, bỏ cửa có Type Comments chứa chữ Louver, Lam thép hoặc Lam nhôm; bấm lại thì cập nhật bảng cũ, không tạo trùng. Thêm: đặt Mark + tag vách kính (curtain wall) bằng Mark. Mặc định Dry-run.

# group: Đầu vào
tên_view_mặt_bằng_trống_view = StringInput("")  # "Tên view mặt bằng (trống = view đang mở)"; graph input
hạng_mục_thống_kê = StringInput("Cửa đi;Cửa sổ")  # graph input
type_comments_có_chữ_này_thì = StringInput("Louver;Lam thép;Lam nhôm")  # "Type Comments có chữ này thì không thống kê (;)"; graph input
dry_run_true_chỉ_báo_cáo = BoolSelector(true)  # graph input
mẫu_tên_bảng_loai_tang_view = StringInput("THỐNG KÊ {loai} - {tang}")  # graph input
mở_bảng_vừa_tạo = BoolSelector(true)  # graph input
chỉ_đếm_cửa_thấy_trên_sheet_đặt = BoolSelector(false)  # "Chỉ đếm cửa thấy trên sheet đặt bảng (Filter by sheet)"; graph input
đổi_tên_cửa_json_id_type_type = StringInput("")  # "Đổi tên cửa: JSON {id type: Type Mark mới} (trống = không đổi)"; graph input
tạo_cập_nhật_bảng_thống_kê_revit = BoolSelector(true)  # graph input
đặt_tên_vách_kính_json_ids_moi = StringInput("")  # "Đặt tên vách kính: JSON [{ids, moi}] (trống = không đặt)"; graph input
tag_vách_kính_bằng_mark = BoolSelector(false)  # graph input
kiểu_tag_vách_kính_family_type = StringInput("")  # "Kiểu tag vách kính Family : Type (trống = ARV_Tag Vach Kinh Mark)"; graph input
thư_mục_family_tag_vách_kính = StringInput("")  # "Thư mục family tag vách kính đóng gói (trống = lib/tag_vach_kinh)"; graph input
vẫn_thống_kê_cửa_đi_cửa_sổ_nằm = BoolSelector(false)  # "Vẫn thống kê cửa đi / cửa sổ nằm trong vách kính (mặc định tắt)"; graph input

# group: Xử lý
thongKeCua_TuDong = Python(IN[0]=tên_view_mặt_bằng_trống_view, IN[1]=hạng_mục_thống_kê, IN[2]=type_comments_có_chữ_này_thì, IN[3]=dry_run_true_chỉ_báo_cáo, IN[4]=mẫu_tên_bảng_loai_tang_view, IN[5]=mở_bảng_vừa_tạo, IN[6]=chỉ_đếm_cửa_thấy_trên_sheet_đặt, IN[7]=đổi_tên_cửa_json_id_type_type, IN[8]=tạo_cập_nhật_bảng_thống_kê_revit, IN[9]=đặt_tên_vách_kính_json_ids_moi, IN[10]=tag_vách_kính_bằng_mark, IN[11]=kiểu_tag_vách_kính_family_type, IN[12]=thư_mục_family_tag_vách_kính, IN[13]=vẫn_thống_kê_cửa_đi_cửa_sổ_nằm)  # PythonNet3
# ---------- thongKeCua_TuDong.python (1521 lines) ----------
# Bảng thống kê cửa của mặt bằng đang mở (người dùng yêu cầu 2026-11-04: "tạo 1 bảng thống kê các cửa có trong mặt bằng
# đó, những cửa trùng thì hiện 1 lần"):
#   - Mỗi hạng mục 1 bảng: "THỐNG KÊ CỬA ĐI - <tầng>", "THỐNG KÊ CỬA SỔ - <tầng>" (Revit không gộp được cửa đi + cửa sổ
#     vào 1 bảng: bảng nhiều hạng mục không có cột Rộng / Cao và bộ lọc không có "hoặc" – khảo sát Revit 2027.3).
#   - Cột: Ký hiệu (Type Mark) / Rộng / Cao / Số lượng; KHÔNG liệt kê từng cái (Itemize tắt), gộp theo Type Mark → cửa
#     trùng ký hiệu hiện 1 dòng kèm số lượng; dòng tổng cuối bảng.
#   - Lọc: Level = tầng của mặt bằng, bỏ cửa có Type Comments CHỨA chữ loại trừ (Louver, Lam thép, Lam nhôm; không phân biệt hoa
#     thường / dấu, vd. "Louver", "LOUVER nhôm", "CỬA LAM THÉP LOGIA CĂN HỘ" – người dùng yêu cầu 2026-11-09; bảng Revit
#     dùng bộ lọc "does not contain", thêm cả dạng HOA / thường vì bộ lọc này phân biệt). "Filter by sheet" TẮT mặc định (bật thì bảng đặt
#     trên sheet không có mặt bằng sẽ trống – thử 2026-11-04); mặt bằng crop 1 phần tầng thì bật IN[6] rồi đặt bảng lên
#     sheet của mặt bằng đó để bảng chỉ đếm cửa thấy trên sheet.
#   - Bảng cùng tên đã có (bấm lại) thì cập nhật lại cột / lọc / gộp, không tạo trùng, không xoá. Chưa có thì nhân bản
#     bảng cùng hạng mục có sẵn của dự án (giữ kiểu trình bày công ty), không có thì tạo mới.
#   - Đổi tên cửa (người dùng yêu cầu 2026-11-04 tối: "1 bảng hiện ra, có các cửa, tên hiện tại, tên đổi, chiều dài,
#     chiều cao"): nút bật bảng lib\arv_bang_cua.py (mỗi loại cửa thấy trong mặt bằng 1 dòng), người dùng gõ tên mới →
#     IN[7] = JSON {id type: tên mới} → đổi Type Mark của type đó (áp cho mọi cửa cùng type trong dự án). Làm TRƯỚC
#     bảng thống kê để bảng hiện tên mới. IN[8] = có tạo / cập nhật bảng thống kê Revit không.
#   - Báo CẦN XEM LẠI: cửa chưa có Type Mark, cùng Type Mark mà khác kích thước (Revit để trống ô), số cửa thấy trong
#     mặt bằng khác số cửa của tầng.
#   - Vách kính (người dùng yêu cầu + duyệt 2026-11-13: "1 cửa sổ đặt tên cửa đi cửa sổ, 1 cửa sổ tag vách kính bằng mark"):
#     bảng lib/arv_bang_cua.py có thêm cửa sổ "Vách kính" (curtain wall thấy trong mặt bằng, tên = MARK của từng vách) →
#     IN[9] = JSON đặt Mark, IN[10] = tag mỗi vách 1 tag tường hiện Mark (family ARV_Tag Vach Kinh Mark, chưa có thì nạp bản
#     đóng gói lib/tag_vach_kinh); xem khối VÁCH KÍNH bên dưới.
#   - Cửa nằm trong vách kính (người dùng chốt 2026-11-14: "không tag các cửa và thống kê các cửa (cửa đi, cửa sổ) khi nằm
#     trong vách kính"): cửa đi / cửa sổ có host là curtain wall (kể cả tấm vách kính là family cửa) KHÔNG vào bảng đổi tên,
#     KHÔNG vào bảng thống kê – vách kính có tên riêng (Mark). Tầng có cửa như vậy thì bảng thống kê là bảng vẽ (drafting
#     view) như trường hợp file link, vì bảng thống kê Revit không lọc được theo vách chủ. IN[13] bật = đếm như cũ.
# Dry-run chỉ báo cáo, không sửa mô hình.
# INPUT
#   IN[0] (str)  Tên view mặt bằng (để trống = view đang mở)
#   IN[1] (str)  Hạng mục thống kê: Cửa đi;Cửa sổ (bỏ bớt nếu chỉ cần 1 bảng)
#   IN[2] (str)  Type Comments CÓ CHỨA chữ này thì KHÔNG thống kê (vd. Louver;Lam thép;Lam nhôm), cách nhau bằng ;
#   IN[3] (bool) Dry-run (True = chỉ báo cáo)
#   IN[4] (str)  Mẫu tên bảng ({loai} = CỬA ĐI / CỬA SỔ, {tang} = tên tầng, {view} = tên view)
#   IN[5] (bool) Mở bảng vừa tạo (bảng đầu tiên)
#   IN[6] (bool) Chỉ đếm cửa thấy trên sheet đặt bảng (Filter by sheet; dùng cho mặt bằng crop 1 phần tầng)
#   IN[7] (str)  Đổi tên cửa: JSON {"<id type>": "<Type Mark mới>"} (trống = không đổi; nút điền từ bảng cửa)
#   IN[8] (bool) Tạo / cập nhật bảng thống kê Revit (THỐNG KÊ CỬA ĐI / CỬA SỔ - <tầng>)
#   IN[9] (str)  Đặt tên vách kính: JSON [{"ids": [id vách], "moi": "<Mark mới>"}] (trống = không đặt; nút điền từ bảng)
#   IN[10] (bool) Tag vách kính (curtain wall) của mặt bằng bằng Mark
#   IN[11] (str)  Kiểu tag vách kính "Family : Type" (trống = ARV_Tag Vach Kinh Mark, chưa có thì nạp bản đóng gói)
#   IN[12] (str)  Thư mục family tag vách kính đóng gói (trống = <extension>/lib/tag_vach_kinh)
#   IN[13] (bool) Vẫn thống kê cửa đi / cửa sổ nằm trong vách kính (mặc định tắt = không thống kê)
# OUTPUT
#   OUT (list[str])  Báo cáo
import os
import json
import traceback
import unicodedata
import clr
clr.AddReference("RevitAPI")
clr.AddReference("RevitServices")
from Autodesk.Revit.DB import *
import Autodesk.Revit.DB as _RevitDB
# pythonnet 3.0: tên đã được import đích danh trước đó trong phiên bị loại khỏi "import *" → bổ sung đủ tên
globals().update({_n: getattr(_RevitDB, _n) for _n in dir(_RevitDB) if not _n.startswith("_") and _n not in globals()})
from RevitServices.Persistence import DocumentManager
from RevitServices.Transactions import TransactionManager

TRANSACTION_NAME = u"ARV - Thống kê cửa"
MAC_DINH = ["", u"Cửa đi;Cửa sổ", u"Louver;Lam thép;Lam nhôm", True, u"THỐNG KÊ {loai} - {tang}", True, False, "", True, "", False, "", "", False]
VK_IN_THU_MUC = 12
# (từ khoá không dấu nhận trong IN[1], hạng mục, nhãn, tham số rộng, tham số cao)
HANG_MUC = [(u"cua di", BuiltInCategory.OST_Doors, u"CỬA ĐI", BuiltInParameter.DOOR_WIDTH, BuiltInParameter.DOOR_HEIGHT),
            (u"cua so", BuiltInCategory.OST_Windows, u"CỬA SỔ", BuiltInParameter.WINDOW_WIDTH,
             BuiltInParameter.WINDOW_HEIGHT)]
COT = [u"Tên", u"Chiều dài", u"Chiều cao", u"Số lượng"]


def doc_in(i):
    try:
        v = IN[i]
    except Exception:
        v = None
    return MAC_DINH[i] if v is None or (isinstance(v, str) and v == "" and MAC_DINH[i] != "") else v


def khong_dau(s):
    s = unicodedata.normalize("NFD", u"%s" % (s or u"")).replace(u"đ", u"d").replace(u"Đ", u"D")
    return u"".join(c for c in s if unicodedata.category(c) != "Mn").lower()


def tach(s):
    return [x.strip() for x in (s or "").split(";") if x.strip()]


def mm(v):
    return UnitUtils.ConvertFromInternalUnits(v, UnitTypeId.Millimeters)


def ten(e):
    try:
        return Element.Name.GetValue(e)
    except Exception:
        try:
            return e.Name
        except Exception:
            return "?"


def gia_tri_kt(e, t, bips):
    """Kích thước (mm) lấy ở instance trước, không có thì ở type."""
    for o in (e, t):
        if o is None:
            continue
        for b in bips:
            p = o.get_Parameter(b)
            if p is not None and p.HasValue and p.StorageType == StorageType.Double:
                return int(round(mm(p.AsDouble())))
    return None


def chuoi_type(t, bip):
    p = t.get_Parameter(bip) if t is not None else None
    return (p.AsString() or u"").strip() if p is not None else u""


def co_chu(s, ds):
    """s CÓ CHỨA một chữ trong ds (ds đã khong_dau) – không phân biệt hoa thường / dấu."""
    ks = khong_dau(s)
    return bool(ks) and any(k in ks for k in ds)


# ==== PHẦN CHUNG FILE LINK (nguồn: Link_chung.py, chép vào công cụ bằng gop_link.py – không sửa tay trong công cụ) ====
# Model chỉ chứa link (vd. HQV Site: tường / cửa / WC đều nằm trong các file link): công cụ đọc đối tượng link qua LkPT, là
# lớp bọc trả toạ độ đã đổi về model chính và chuyển mọi thuộc tính khác cho phần tử gốc. Phần tử trong link chỉ ĐỌC được.
LK_HE_SO_ID = 10000000000      # id giả = id link instance × hệ số + id phần tử, không trùng giữa các link


def _lk_mm(v):
    return UnitUtils.ConvertToInternalUnits(v, UnitTypeId.Millimeters)


class LkId(object):
    """Id giả của phần tử link: có .Value như ElementId, dùng làm khoá và để in."""
    def __init__(self, v):
        self.Value = v

    def __eq__(self, o):
        return getattr(o, "Value", None) == self.Value

    def __ne__(self, o):
        return not self.__eq__(o)

    def __hash__(self):
        return hash(self.Value)

    def __str__(self):
        return "%d" % self.Value


class _LkViTri(object):
    """Location của phần tử link, đã đổi về toạ độ model chính."""
    def __init__(self, pt):
        self._pt = pt
        self._loc = pt._e.Location

    @property
    def Point(self):
        return self._pt._tf.OfPoint(self._loc.Point)

    @property
    def Curve(self):
        return self._loc.Curve.CreateTransformed(self._pt._tf)

    @property
    def Rotation(self):
        return self._loc.Rotation

    def get_ElementsAtJoin(self, i):
        return [LkPT(x, self._pt._li, self._pt._tf) for x in self._loc.get_ElementsAtJoin(i)]


class _LkDoanBien(object):
    """BoundarySegment của room link: GetCurve đã đổi toạ độ."""
    def __init__(self, sg, tf):
        self._sg, self._tf = sg, tf

    def GetCurve(self):
        return self._sg.GetCurve().CreateTransformed(self._tf)


class LkPT(object):
    """Phần tử trong file link nhìn như phần tử model chính (chỉ đọc). Thuộc tính không khai báo ở đây lấy từ phần tử gốc."""
    def __init__(self, e, li, tf=None):
        self._e = e
        self._li = li
        self._tf = tf if tf is not None else li.GetTotalTransform()

    def __getattr__(self, ten_tt):
        return getattr(self._e, ten_tt)

    @property
    def Id(self):
        return LkId(self._li.Id.Value * LK_HE_SO_ID + self._e.Id.Value)

    @property
    def Location(self):
        return _LkViTri(self) if self._e.Location is not None else None

    @property
    def HandOrientation(self):
        return self._tf.OfVector(self._e.HandOrientation)

    @property
    def FacingOrientation(self):
        return self._tf.OfVector(self._e.FacingOrientation)

    @property
    def Orientation(self):
        return self._tf.OfVector(self._e.Orientation)

    @property
    def Host(self):
        h = self._e.Host
        return LkPT(h, self._li, self._tf) if h is not None else None

    def GetPath(self):
        return [c.CreateTransformed(self._tf) for c in self._e.GetPath()]

    def get_BoundingBox(self, view=None):
        bb = self._e.get_BoundingBox(None)
        if bb is None:
            return None
        ds = [self._tf.OfPoint(XYZ(x, y, z)) for x in (bb.Min.X, bb.Max.X) for y in (bb.Min.Y, bb.Max.Y)
              for z in (bb.Min.Z, bb.Max.Z)]
        kq = BoundingBoxXYZ()
        kq.Min = XYZ(min(p.X for p in ds), min(p.Y for p in ds), min(p.Z for p in ds))
        kq.Max = XYZ(max(p.X for p in ds), max(p.Y for p in ds), max(p.Z for p in ds))
        return kq

    def get_Geometry(self, opt):
        """Hình học đã đổi toạ độ. Có view thì lấy theo mặt bằng cùng tầng trong file link (để có nét 2D: cánh mở, ký hiệu)."""
        o = Options()
        try:
            o.IncludeNonVisibleObjects = opt.IncludeNonVisibleObjects
            o.ComputeReferences = opt.ComputeReferences
        except Exception:
            pass
        vm = lk_view_tang(self._e, self._tf) if getattr(opt, "View", None) is not None else None
        if vm is not None:
            o.View = vm
        else:
            try:
                o.DetailLevel = opt.DetailLevel if getattr(opt, "View", None) is None else ViewDetailLevel.Fine
            except Exception:
                o.DetailLevel = ViewDetailLevel.Fine
        g = self._e.get_Geometry(o)
        if vm is not None and (g is None or not any(True for _ in g)):       # view trong link ẩn đối tượng → lấy hình 3D
            o2 = Options()
            o2.DetailLevel = ViewDetailLevel.Fine
            o2.ComputeReferences = o.ComputeReferences
            g = self._e.get_Geometry(o2)
        return g.GetTransformed(self._tf) if g is not None else None

    def GetBoundarySegments(self, opt):
        kq = self._e.GetBoundarySegments(opt)
        return [[_LkDoanBien(s, self._tf) for s in vong] for vong in kq] if kq is not None else None

    @property
    def GeometryCurve(self):
        return self._e.GeometryCurve.CreateTransformed(self._tf)

    def IsPointInRoom(self, p):
        return self._e.IsPointInRoom(self._tf.Inverse.OfPoint(p))

    def IsHidden(self, view):
        return False

    def CanBeHidden(self, view):
        return False


def la_link(e):
    return isinstance(e, LkPT)


def lk_tham_chieu(e):
    """Reference để tag / dim: phần tử link thì là link reference."""
    return Reference(e._e).CreateLinkReference(e._li) if la_link(e) else Reference(e)


def lk_cac_link(doc, view):
    """Các link đã nạp và đang thấy trong view: [(instance, document, transform)]."""
    kq = []
    for li in FilteredElementCollector(doc, view.Id).OfClass(RevitLinkInstance):
        try:
            ld = li.GetLinkDocument()
            if ld is not None:
                kq.append((li, ld, li.GetTotalTransform()))
        except Exception:
            pass
    return kq


def lk_level_khop(ld, tf, lv):
    """Id level của file link trùng cao độ với level lv của model chính (đã tính link đặt lệch cao độ, vd. tầng điển hình)."""
    return set(l.Id.Value for l in FilteredElementCollector(ld).OfClass(Level)
               if abs(l.Elevation + tf.Origin.Z - lv.Elevation) < _lk_mm(5))


_LK_VIEW = {}


def lk_view_tang(e, tf):
    """Mặt bằng trong file link cùng level của e (để đọc nét 2D của family); không có thì None."""
    ld = e.Document
    k = (ld.PathName or ld.Title, e.LevelId.Value)
    if k not in _LK_VIEW:
        ds = [v for v in FilteredElementCollector(ld).OfClass(ViewPlan)
              if not v.IsTemplate and v.ViewType == ViewType.FloorPlan and v.GenLevel is not None
              and v.GenLevel.Id == e.LevelId]
        ds.sort(key=lambda v: v.Id.Value)
        _LK_VIEW[k] = ds[0] if ds else None
    return _LK_VIEW[k]


def lk_tren_level(e, ids, tf=None, lv=None):
    """Phần tử e (trong link) thuộc các level ids? LevelId rỗng thì xét tham số level, host, cuối cùng theo cao độ."""
    if e.LevelId.Value in ids:
        return True
    if e.LevelId != ElementId.InvalidElementId:
        return False
    for bip in (BuiltInParameter.INSTANCE_SCHEDULE_ONLY_LEVEL_PARAM, BuiltInParameter.FAMILY_LEVEL_PARAM,
                BuiltInParameter.STAIRS_RAILING_BASE_LEVEL_PARAM):
        try:
            p = e.get_Parameter(bip)
            if p is not None and p.HasValue:
                return p.AsElementId().Value in ids
        except Exception:
            pass
    try:
        if e.Host is not None and e.Host.LevelId.Value in ids:
            return True
    except Exception:
        pass
    if tf is not None and lv is not None:
        bb = e.get_BoundingBox(None)
        if bb is not None:
            z = bb.Min.Z + tf.Origin.Z
            return lv.Elevation - _lk_mm(300) <= z <= lv.Elevation + _lk_mm(2000)
    return False


def lk_thay(doc, view, bic, theo_level=True):
    """Đối tượng hạng mục bic trong các link đang thấy trong view (đúng tầng của view khi theo_level) → list[LkPT]."""
    kq = []
    lv = view.GenLevel
    for li, ld, tf in lk_cac_link(doc, view):
        ids = lk_level_khop(ld, tf, lv) if theo_level and lv is not None else None
        if theo_level and not ids:
            continue
        for e in FilteredElementCollector(doc, view.Id, li.Id).OfCategory(bic).WhereElementIsNotElementType():
            if ids is None or lk_tren_level(e, ids, tf, lv):
                kq.append(LkPT(e, li, tf))
    return kq


def lk_tang(doc, view, bic):
    """Như lk_thay nhưng không lọc theo view (kể cả đối tượng view không vẽ, vd. room) – chỉ trong link đang thấy, đúng tầng."""
    kq = []
    lv = view.GenLevel
    for li, ld, tf in lk_cac_link(doc, view):
        ids = lk_level_khop(ld, tf, lv)
        if not ids:
            continue
        for e in FilteredElementCollector(ld).OfCategory(bic).WhereElementIsNotElementType():
            if lk_tren_level(e, ids, tf, lv):
                kq.append(LkPT(e, li, tf))
    return kq


def lk_room_tai_diem(doc, view, p):
    """Room trong link tại điểm p (toạ độ model chính), CHỈ room thuộc tầng của view → LkPT hoặc None. (Link đặt chồng nhiều
    bản lệch cao độ: bản khác tầng cũng trả room tại điểm đó → biên phòng sai, đo trên HQV Site 2026-11-11: 3 phòng xiên.)"""
    lv = view.GenLevel
    for li, ld, tf in lk_cac_link(doc, view):
        ids = lk_level_khop(ld, tf, lv) if lv is not None else None
        if ids is not None and not ids:
            continue
        try:
            r = ld.GetRoomAtPoint(tf.Inverse.OfPoint(p))
        except Exception:
            r = None
        if r is not None and (ids is None or r.LevelId.Value in ids):
            return LkPT(r, li, tf)
    return None


def lk_room_moi_link(doc, p, lv=None):
    """Room trong bất kỳ link đã nạp tại điểm p (toạ độ model chính) → LkPT hoặc None (không cần view); có lv thì chỉ room
    thuộc tầng lv (link đặt chồng nhiều bản lệch cao độ)."""
    for li in FilteredElementCollector(doc).OfClass(RevitLinkInstance):
        try:
            ld = li.GetLinkDocument()
            if ld is None:
                continue
            tf = li.GetTotalTransform()
            ids = lk_level_khop(ld, tf, lv) if lv is not None else None
            if ids is not None and not ids:
                continue
            r = ld.GetRoomAtPoint(tf.Inverse.OfPoint(p))
            if r is not None and ids is not None and r.LevelId.Value not in ids:
                r = None
        except Exception:
            r = None
        if r is not None:
            return LkPT(r, li, tf)
    return None


def lk_level_host(doc, e):
    """Level của model chính cùng cao độ với level của phần tử link e (đã tính Z của instance); không có thì None."""
    try:
        z = e.Document.GetElement(e.LevelId).Elevation + e._tf.Origin.Z
    except Exception:
        return None
    ds = [l for l in FilteredElementCollector(doc).OfClass(Level) if abs(l.Elevation - z) < _lk_mm(5)]
    return ds[0] if ds else None


def lk_tu_id(doc, v):
    """Id giả (id link instance × hệ số + id phần tử) → LkPT; id thường → phần tử model chính."""
    v = int(v)
    if v < LK_HE_SO_ID:
        return doc.GetElement(ElementId(v))
    li = doc.GetElement(ElementId(v // LK_HE_SO_ID))
    ld = li.GetLinkDocument() if li is not None else None
    e = ld.GetElement(ElementId(v % LK_HE_SO_ID)) if ld is not None else None
    return LkPT(e, li) if e is not None else None


class LkMat(object):
    """PlanarFace của phần tử link: pháp tuyến / điểm đã đổi toạ độ, Reference là link reference (dùng để dim)."""
    def __init__(self, f, tf, li, ref=None):
        self._f, self._tf = f, tf
        self.Reference = ref if ref is not None else f.Reference.CreateLinkReference(li)
        self.FaceNormal = tf.OfVector(f.FaceNormal)
        self.Origin = tf.OfPoint(f.Origin)

    def GetBoundingBox(self):
        return self._f.GetBoundingBox()

    def Evaluate(self, uv):
        return self._tf.OfPoint(self._f.Evaluate(uv))

    def Project(self, p):
        return self._f.Project(self._tf.Inverse.OfPoint(p))

    def GetType(self):
        return self._f.GetType()


def lk_mat_phang(e, opt):
    """Các PlanarFace (có reference) của phần tử link e dạng LkMat; hình học lấy trong file link rồi đổi toạ độ."""
    kq = []

    def duyet(geo, tf):
        for g in geo:
            tn = g.GetType().Name
            if tn == "GeometryInstance":
                duyet(g.GetInstanceGeometry(), tf)
            elif tn == "Solid" and g.Volume > 0:
                for f in g.Faces:
                    if f.GetType().Name == "PlanarFace" and f.Reference is not None:
                        try:
                            kq.append(LkMat(f, tf, e._li))
                        except Exception:
                            pass
    geo = e._e.get_Geometry(opt)
    if geo is not None:
        duyet(geo, e._tf)
    return kq


def lk_an_bang_filter(doc, view, ten_f, bics, giu_tu=()):
    """Ẩn đối tượng trong link theo hạng mục bằng view filter (Revit không Hide in View từng phần tử link): filter tên ten_f,
    hạng mục bics, giữ lại đối tượng có Family Name chứa một chữ trong giu_tu. Filter cũng áp cho đối tượng model chính.
    View có template điều khiển filter thì KHÔNG sửa template, chỉ báo. Gọi TRONG transaction. Trả về câu báo cáo."""
    from System.Collections.Generic import List as _List
    f = None
    for x in FilteredElementCollector(doc).OfClass(ParameterFilterElement):
        if x.Name == ten_f:
            f = x
            break
    if f is None:
        cats = _List[ElementId]()
        for b in bics:
            cats.Add(ElementId(b))
        pid = ElementId(BuiltInParameter.ALL_MODEL_FAMILY_NAME)
        loc_duoc = any(i.Value == pid.Value for i in ParameterFilterUtilities.GetFilterableParametersInCommon(doc, cats))
        luat = _List[FilterRule]()
        if loc_duoc:
            for k in giu_tu:
                luat.Add(ParameterFilterRuleFactory.CreateNotContainsRule(pid, k))
        if luat.Count:
            f = ParameterFilterElement.Create(doc, ten_f, cats, ElementParameterFilter(luat))
        else:
            f = ParameterFilterElement.Create(doc, ten_f, cats)
    tpl = doc.GetElement(view.ViewTemplateId) if view.ViewTemplateId != ElementId.InvalidElementId else None
    if tpl is not None:
        vg = BuiltInParameter.VIS_GRAPHICS_FILTERS
        if not any(i.Value == int(vg) for i in tpl.GetNonControlledTemplateParameterIds()):
            return (u"CẦN XEM LẠI: đối tượng trong link chưa ẩn – template '%s' điều khiển filter (công cụ không sửa template): "
                    u"thêm filter '%s' vào template và tắt hiển thị." % (tpl.Name, ten_f))
    try:
        if not view.IsFilterApplied(f.Id):
            view.AddFilter(f.Id)
        view.SetFilterVisibility(f.Id, False)
        return u"Ẩn đối tượng trong link bằng filter '%s' trong view." % ten_f
    except Exception as ex:
        return u"CẦN XEM LẠI: không gắn được filter '%s' vào view (%s)." % (ten_f, (u"%s" % ex).splitlines()[0][:120])


def lk_khoa_tag(tg):
    """Khoá các đối tượng mà tag đang gắn (phần tử model chính: id; phần tử link: id giả như LkPT.Id)."""
    kq = []
    for x in tg.GetTaggedElementIds():
        if x.LinkInstanceId != ElementId.InvalidElementId:
            kq.append(x.LinkInstanceId.Value * LK_HE_SO_ID + x.LinkedElementId.Value)
        else:
            kq.append(x.HostElementId.Value)
    return kq


def lk_ghi_chu(doc, view):
    """Một dòng báo cáo: các link đang thấy trong view + số link khớp tầng."""
    ds = lk_cac_link(doc, view)
    lv = view.GenLevel
    khop = [li.Name.split(" : ")[0] for li, ld, tf in ds if lv is not None and lk_level_khop(ld, tf, lv)]
    return "File link thấy trong view: %d, khớp tầng: %s" % (len(ds), ", ".join(sorted(set(khop))) or "(không)")
def lk_bang_ve(doc, ten_view, tieu_de, cot, rong_cot, dong):
    """Bảng vẽ trên drafting view tỉ lệ 1:1: Revit không lọc được bảng thống kê theo tầng khi lấy cả file link (Level của
    link không dùng được làm bộ lọc; thêm link thì đếm mọi tầng của mọi bản link). cot: tên cột; rong_cot: mm giấy; dong:
    list[list[chuỗi]]. Đã có view tên đó thì chỉ sửa chữ khi đúng số dòng, không xoá gì. Gọi TRONG transaction.
    Trả về (view, cách làm)."""
    cao_dong, cao_dau = _lk_mm(8), _lk_mm(10)
    so_cot = len(cot)
    ds = [v for v in FilteredElementCollector(doc).OfClass(ViewDrafting) if not v.IsTemplate and v.Name == ten_view]
    if ds:
        v = ds[0]
        notes = sorted(FilteredElementCollector(doc, v.Id).OfClass(TextNote), key=lambda n: (-round(n.Coord.Y, 2), n.Coord.X))
        cu = [n for n in notes if round(n.Coord.Y, 2) < 0]             # ô dữ liệu nằm dưới tiêu đề + đầu cột
        ky_vong = sum(1 for d in dong for x in d if x != u"")
        if len(cu) != ky_vong:
            return v, u"bảng '%s' đã có nhưng khác số ô (%d, cần %d) – CHƯA cập nhật, xoá view đó rồi bấm lại" % (ten_view, len(cu), ky_vong)
        phang = [x for d in dong for x in d if x != u""]
        for n, x in zip(cu, phang):
            if n.Text != x:
                n.Text = x
        return v, u"cập nhật chữ bảng đã có"
    vft = [t for t in FilteredElementCollector(doc).OfClass(ViewFamilyType) if t.ViewFamily == ViewFamily.Drafting][0]
    v = ViewDrafting.Create(doc, vft.Id)
    v.Name = ten_view
    v.Scale = 1
    kieu = sorted(FilteredElementCollector(doc).OfClass(TextNoteType), key=lambda t: t.Id.Value)
    def diem_kieu(t):
        ten_k = (t.get_Parameter(BuiltInParameter.SYMBOL_NAME_PARAM).AsString() or u"").lower()
        co = t.get_Parameter(BuiltInParameter.TEXT_SIZE).AsDouble()
        return (0 if u"arial" in ten_k else 1, abs(co - _lk_mm(2.5)))
    kt = min(kieu, key=diem_kieu)
    tong = sum(_lk_mm(x) for x in rong_cot)
    tao_chu = lambda x_, y_, s_: TextNote.Create(doc, v.Id, XYZ(x_, y_, 0), s_, kt.Id)
    tao_net = lambda a_, b_: doc.Create.NewDetailCurve(v, Line.CreateBound(a_, b_))
    tao_chu(_lk_mm(2), cao_dau * 1.5, tieu_de)
    xs = [0.0]
    for r_ in rong_cot:
        xs.append(xs[-1] + _lk_mm(r_))
    y_tren = cao_dau
    y_day = -cao_dong * len(dong)
    for i_ in range(len(dong) + 2):
        y_ = cao_dau if i_ == 0 else -cao_dong * (i_ - 1)
        tao_net(XYZ(0, y_, 0), XYZ(tong, y_, 0))
    for x_ in xs:
        tao_net(XYZ(x_, y_tren, 0), XYZ(x_, y_day, 0))
    for c_ in range(so_cot):
        tao_chu(xs[c_] + _lk_mm(2), cao_dau - _lk_mm(3), cot[c_])
    for r_i, d in enumerate(dong):
        for c_ in range(so_cot):
            if d[c_] != u"":
                tao_chu(xs[c_] + _lk_mm(2), -cao_dong * r_i - _lk_mm(2), d[c_])
    return v, u"bảng vẽ mới (drafting view)"


class LkBangTrenSheet(object):
    """Viewport của bảng vẽ, dùng được như ScheduleSheetInstance khi xếp bảng lên sheet (Point = góc trên trái)."""
    def __init__(self, vp):
        self._vp = vp

    def get_BoundingBox(self, v=None):
        o = self._vp.GetBoxOutline()
        bb = BoundingBoxXYZ()
        bb.Min, bb.Max = o.MinimumPoint, o.MaximumPoint
        return bb

    @property
    def Point(self):
        o = self._vp.GetBoxOutline()
        return XYZ(o.MinimumPoint.X, o.MaximumPoint.Y, 0)

    @Point.setter
    def Point(self, p):
        o = self._vp.GetBoxOutline()
        w, h = o.MaximumPoint.X - o.MinimumPoint.X, o.MaximumPoint.Y - o.MinimumPoint.Y
        self._vp.SetBoxCenter(XYZ(p.X + w / 2.0, p.Y - h / 2.0, 0))


def lk_kich_thuoc(e):
    """(chiều dài / rộng, chiều cao) mm dạng chuỗi của cửa, lan can, louver (model chính hoặc link), dùng cho bảng vẽ."""
    def mm_(p):
        return u"%d" % round(UnitUtils.ConvertFromInternalUnits(p.AsDouble(), UnitTypeId.Millimeters))

    def tim(bips, nguon):
        for b in bips:
            for o in nguon:
                p = o.get_Parameter(b) if o is not None else None
                if p is not None and p.HasValue and p.StorageType == StorageType.Double and p.AsDouble() > 0:
                    return mm_(p)
        return u""
    t = e.Document.GetElement(e.GetTypeId())
    dai = tim((BuiltInParameter.CURVE_ELEM_LENGTH, BuiltInParameter.INSTANCE_LENGTH_PARAM, BuiltInParameter.DOOR_WIDTH,
               BuiltInParameter.WINDOW_WIDTH, BuiltInParameter.GENERIC_WIDTH, BuiltInParameter.FAMILY_WIDTH_PARAM), (e, t))
    cao = tim((BuiltInParameter.DOOR_HEIGHT, BuiltInParameter.WINDOW_HEIGHT, BuiltInParameter.GENERIC_HEIGHT,
               BuiltInParameter.FAMILY_HEIGHT_PARAM), (e, t))
    if not cao and t is not None:
        p = t.LookupParameter("Railing Height")
        if p is not None and p.HasValue:
            cao = mm_(p)
    return dai, cao


def lk_dat_bang_len_sheet(doc, sh, vs, x0, y1):
    """Đặt drafting view bảng lên sheet (view đã nằm trên sheet khác thì nêu lỗi). Trả về LkBangTrenSheet."""
    if not Viewport.CanAddViewToSheet(doc, sh.Id, vs.Id):
        raise Exception(u"bảng '%s' đã nằm trên sheet khác" % vs.Name)
    vp = Viewport.Create(doc, sh.Id, vs.Id, XYZ(x0, y1, 0))
    for t in FilteredElementCollector(doc).OfClass(ElementType):
        if t.GetType().Name == "ElementType" and t.Category is None and (t.FamilyName or u"") == u"Viewport" and u"No Line" in (t.get_Parameter(BuiltInParameter.SYMBOL_NAME_PARAM).AsString() or u""):
            vp.ChangeTypeId(t.Id)
            break
    return LkBangTrenSheet(vp)
# ==== HẾT PHẦN CHUNG FILE LINK ====


def dem_trong_view(doc, view, bic, rong_bip, cao_bip, loai_tru, bo_vk=True):
    """Cửa thấy trong mặt bằng: {Type Mark: {"so": n, "kt": set((rộng, cao)), "type": set(tên)}}, số bị loại, các Type
    Comments bị loại, số khác tầng (thấy trong view nhưng Level khác tầng → bảng không đếm), số nằm trong vách kính (bỏ)."""
    lv = view.GenLevel
    nhom, bo, bo_tc, khac_tang, so_vk = {}, 0, set(), [], 0
    for e in list(FilteredElementCollector(doc, view.Id).OfCategory(bic).WhereElementIsNotElementType()) + lk_thay(doc, view, bic, True):
        t = e.Document.GetElement(e.GetTypeId())
        tc = chuoi_type(t, BuiltInParameter.ALL_MODEL_TYPE_COMMENTS)
        if co_chu(tc, loai_tru):
            bo += 1
            bo_tc.add(tc)
            continue
        if bo_vk and vk_trong_vach(e):
            so_vk += 1
            continue
        if lv is not None and not la_link(e) and e.LevelId != lv.Id:
            khac_tang.append(e)
            continue
        mk = chuoi_type(t, BuiltInParameter.ALL_MODEL_TYPE_MARK)
        g = nhom.setdefault(mk, {"so": 0, "kt": set(), "type": set()})
        g["so"] += 1
        g["kt"].add((gia_tri_kt(e, t, (rong_bip, BuiltInParameter.FAMILY_WIDTH_PARAM)),
                     gia_tri_kt(e, t, (cao_bip, BuiltInParameter.FAMILY_HEIGHT_PARAM))))
        g["type"].add(u"%s : %s" % (t.FamilyName if t is not None else u"?", ten(t)))
    return nhom, bo, bo_tc, khac_tang, so_vk


def dem_theo_tang(doc, lv, bic, loai_tru, view=None, bo_vk=True):
    """(số cửa của tầng – đã bỏ loại trừ + cửa nằm trong vách kính, số cửa model chính của tầng nằm trong vách kính)."""
    n, n_vk = 0, 0
    for e in (lk_tang(doc, view, bic) if view is not None else []):
        if co_chu(chuoi_type(e.Document.GetElement(e.GetTypeId()), BuiltInParameter.ALL_MODEL_TYPE_COMMENTS), loai_tru):
            continue
        if bo_vk and vk_trong_vach(e):
            continue
        n += 1
    for e in FilteredElementCollector(doc).OfCategory(bic).WhereElementIsNotElementType():
        if e.LevelId != lv.Id:
            continue
        t = doc.GetElement(e.GetTypeId())
        if co_chu(chuoi_type(t, BuiltInParameter.ALL_MODEL_TYPE_COMMENTS), loai_tru):
            continue
        if bo_vk and vk_trong_vach(e):
            n_vk += 1
            continue
        n += 1
    return n, n_vk


def lap_bang(doc, bic, ten_bang, level, loai_tru_tc, rong_bip, cao_bip, theo_sheet=False):
    """Tạo / cập nhật bảng thống kê 1 hạng mục: cột Ký hiệu / Rộng / Cao / Số lượng, gộp theo Type Mark, lọc Level +
    Type Comments. Trả về (bảng, cách làm)."""
    vs = None
    for x in FilteredElementCollector(doc).OfClass(ViewSchedule):
        if not x.IsTemplate and x.Name == ten_bang:
            vs = x
            break
    if vs is not None:
        if vs.Definition.CategoryId.Value != int(bic):
            raise Exception(u"đã có bảng tên '%s' nhưng khác hạng mục – đổi tên bảng đó hoặc đổi mẫu tên" % ten_bang)
        cach = u"cập nhật bảng đã có"
    else:
        nguon = [x for x in FilteredElementCollector(doc).OfClass(ViewSchedule)
                 if not x.IsTemplate and not x.IsTitleblockRevisionSchedule and not x.IsInternalKeynoteSchedule
                 and x.Definition.CategoryId.Value == int(bic)]
        nguon.sort(key=lambda x: (0 if u"thong ke" in khong_dau(x.Name) else 1, x.Name))
        vs = None
        if nguon:
            try:
                vs = doc.GetElement(nguon[0].Duplicate(ViewDuplicateOption.Duplicate))
                cach = u"nhân bản kiểu trình bày của '%s'" % nguon[0].Name
            except Exception:
                vs = None
        if vs is None:
            vs = ViewSchedule.CreateSchedule(doc, ElementId(bic))
            cach = u"tạo mới"
        vs.Name = ten_bang
    d = vs.Definition
    co = {}
    for i in range(d.GetFieldCount()):
        f = d.GetField(i)
        if str(f.FieldType) == "Count":
            co.setdefault(("count", None), f)
            continue
        try:
            co.setdefault(("pid", f.ParameterId.Value), f)
        except Exception:
            pass

    def lay(bip):
        k = ("pid", int(bip))
        if k in co:
            return co[k]
        for sf in d.GetSchedulableFields():
            try:
                if str(sf.FieldType) != "Count" and sf.ParameterId.Value == int(bip):
                    co[k] = d.AddField(sf)
                    return co[k]
            except Exception:
                pass
        return None

    f_mark = lay(BuiltInParameter.ALL_MODEL_TYPE_MARK)
    f_rong = lay(rong_bip) or lay(BuiltInParameter.FAMILY_WIDTH_PARAM)
    f_cao = lay(cao_bip) or lay(BuiltInParameter.FAMILY_HEIGHT_PARAM)
    f_dem = co.get(("count", None))
    if f_dem is None:
        for sf in d.GetSchedulableFields():
            if str(sf.FieldType) == "Count":
                f_dem = d.AddField(sf)
                break
    f_tang = lay(BuiltInParameter.FAMILY_LEVEL_PARAM) or lay(BuiltInParameter.SCHEDULE_LEVEL_PARAM)
    f_tc = lay(BuiltInParameter.ALL_MODEL_TYPE_COMMENTS)
    if f_mark is None or f_dem is None:
        raise Exception(u"không thêm được cột Type Mark / Count vào bảng")
    hien = [(f_mark, COT[0]), (f_rong, COT[1]), (f_cao, COT[2]), (f_dem, COT[3])]
    ids_hien = [g.FieldId for g, _ in hien if g is not None]
    for i in range(d.GetFieldCount()):
        f = d.GetField(i)
        f.IsHidden = not any(f.FieldId == x for x in ids_hien)
    for f, nhan in hien:
        if f is not None:
            f.ColumnHeading = nhan
    try:
        f_dem.DisplayType = ScheduleFieldDisplayType.Totals
    except Exception:
        pass
    try:
        from System.Collections.Generic import List
        thu_tu = List[ScheduleFieldId]()
        for x in ids_hien:
            thu_tu.Add(x)
        for i in range(d.GetFieldCount()):
            f = d.GetField(i)
            if not any(f.FieldId == x for x in ids_hien):
                thu_tu.Add(f.FieldId)
        d.SetFieldOrder(thu_tu)
    except Exception:
        pass
    d.ClearFilters()
    if f_tang is not None and level is not None:
        d.AddFilter(ScheduleFilter(f_tang.FieldId, ScheduleFilterType.Equal, level.Id))
    if f_tc is not None:
        # Bộ lọc bảng Revit phân biệt HOA / thường và mỗi bảng tối đa 8 bộ lọc (thử 2026-11-09) → bỏ chữ cái đầu của từ khoá
        # (khỏi lo "Lam" / "lam"), còn 2 dạng thường + HOA: 3 từ khoá = 6 bộ lọc, cộng 1 lọc tầng
        chu_loc = []
        for tc in loai_tru_tc:
            goc = tc[1:] if len(tc) > 3 else tc
            for x in (goc, goc.lower(), goc.upper()):
                if x not in chu_loc:
                    chu_loc.append(x)
        con_cho = 8 - d.GetFilterCount()
        for x in chu_loc[:con_cho]:     # "does not contain": Type Comments có chữ này ở bất kỳ đâu đều bị bỏ
            d.AddFilter(ScheduleFilter(f_tc.FieldId, ScheduleFilterType.NotContains, x))
        if len(chu_loc) > con_cho:
            cach += u"; CẦN XEM LẠI: quá 8 bộ lọc của bảng Revit, chưa lọc được: " + u", ".join(chu_loc[con_cho:])
    d.ClearSortGroupFields()
    d.AddSortGroupField(ScheduleSortGroupField(f_mark.FieldId))
    d.IsItemized = False                # gộp: cửa trùng Type Mark → 1 dòng
    for ten_tt, gt in (("ShowTitle", True), ("ShowHeaders", True), ("ShowGrandTotal", True),
                       ("ShowGrandTotalTitle", True), ("ShowGrandTotalCount", False), ("GrandTotalTitle", u"TỔNG")):
        try:
            setattr(d, ten_tt, gt)
        except Exception:
            pass
    try:
        if d.IsValidCategoryForFilterBySheet() and d.IsFilteredBySheet != bool(theo_sheet):
            d.IsFilteredBySheet = bool(theo_sheet)
    except Exception:
        pass
    return vs, cach


def doc_bang(vs):
    """Nội dung bảng như hiển thị (đọc lại sau khi tạo)."""
    dong = []
    try:
        sec = vs.GetTableData().GetSectionData(SectionType.Body)
        for r in range(sec.NumberOfRows):
            o = [vs.GetCellText(SectionType.Body, r, c) for c in range(sec.NumberOfColumns)]
            if any(x.strip() for x in o):
                dong.append(u" | ".join(o))
    except Exception as ex:
        dong.append(u"(không đọc được nội dung bảng: %s)" % ex)
    return dong


def doi_ten(doc, json_doi, dry, bao, xem_lai):
    """Đổi Type Mark theo JSON {id type: tên mới}. Báo từng dòng; tên mới trùng Type Mark của type khác cùng hạng mục thì
    vẫn đổi (người dùng đã xác nhận trong bảng) nhưng ghi CẦN XEM LẠI."""
    import json
    if not json_doi:
        return
    try:
        doi = json.loads(json_doi)
    except Exception as ex:
        bao.append(u"IN[7] không phải JSON hợp lệ: %s" % ex)
        return
    if not doi:
        bao.append(u"Không có tên cửa nào cần đổi.")
        return
    bao.append(u"")
    bao.append(u"== ĐỔI TÊN CỬA (Type Mark) – %d loại%s" % (len(doi), u" (DRY-RUN)" if dry else u""))
    if not dry:
        TransactionManager.Instance.EnsureInTransaction(doc)
    for k, moi in doi.items():
        moi = (u"%s" % moi).strip()
        try:
            t = doc.GetElement(ElementId(int(k)))
        except Exception:
            t = None
        if t is None or not moi:
            bao.append(u"   bỏ qua id %s: không có loại cửa này / tên trống" % k)
            continue
        p = t.get_Parameter(BuiltInParameter.ALL_MODEL_TYPE_MARK)
        cu = (p.AsString() or u"") if p is not None else u""
        so = sum(1 for e in FilteredElementCollector(doc).OfCategoryId(t.Category.Id).WhereElementIsNotElementType()
                 if e.GetTypeId().Value == t.Id.Value)
        nhan = u"%s : %s" % (getattr(t, "FamilyName", u""), ten(t))
        if p is None or p.IsReadOnly:
            bao.append(u"   KHÔNG đổi được '%s' (%s): Type Mark chỉ đọc" % (cu, nhan))
            continue
        trung = [u"%s : %s" % (getattr(x, "FamilyName", u""), ten(x))
                 for x in FilteredElementCollector(doc).OfCategoryId(t.Category.Id).WhereElementIsElementType()
                 if x.Id.Value != t.Id.Value and chuoi_type(x, BuiltInParameter.ALL_MODEL_TYPE_MARK) == moi
                 and (u"%s" % x.Id.Value) not in doi]
        if trung:
            xem_lai.append(u"Tên mới '%s' của %s trùng loại cửa khác: %s – bảng thống kê gộp chung 1 dòng." % (
                moi, nhan, u"; ".join(trung[:3])))
        if not dry:
            p.Set(moi)
        bao.append(u"   %s → %s  (%s, %d cửa trong dự án)" % (cu or u"(trống)", moi, nhan, so))
    if not dry:
        doc.Regenerate()


# ==== PHẦN CHUNG VÁCH KÍNH (nguồn: VachKinh_chung.py, chép vào công cụ bằng gop_vach_kinh.py – không sửa tay trong công cụ) ====
# Dùng chung cho nút Thống kê cửa (cửa sổ "Vách kính") và nút Định vị + tag cửa. Cần sẵn trong công cụ: khối PHẦN CHUNG FILE
# LINK, doc_in, os, clr, _RevitDB, TransactionManager; biến VK_IN_THU_MUC = chỉ số IN[] "thư mục family tag vách kính".
#   - Tên vách kính = MARK của từng curtain wall (model HQV: T1-VK.02, DVKT1-01 …). Tag = family tag TƯỜNG hiện Mark
#     "ARV_Tag Vach Kinh Mark" (dựng từ family tag Mark lan can của người dùng, đổi hạng mục sang Wall Tags vì API không tạo
#     được nhãn); dự án chưa có thì nạp bản đóng gói lib\tag_vach_kinh.
#   - Mỗi vách 1 tag, không leader, nằm theo phương vách (vách dọc trên view → tag đứng), giữa vách, phía ngoài nhà, cách mép
#     vách VK_KHE_MM giấy; vướng tag / chữ / tường khác / cửa (kể cả cánh mở) thì dịch dọc vách, hết chỗ thì đẩy ra xa dần,
#     rồi mới sang phía trong; vẫn vướng thì để chỗ đầu và báo. Phía ngoài = phía có nhiều tia dò (0°, ±30°, xa VK_TIA_M)
#     không chạm tường; bằng nhau thì phía không có room; vẫn không rõ thì theo mặt ngoài của tường.
#   - Vách đã có tag tường trong view thì không tag thêm; vách chưa có Mark thì liệt kê, không tag.
#   - Người dùng chốt 2026-11-14: cửa đi / cửa sổ NẰM TRONG vách kính (host là curtain wall, kể cả tấm vách là family cửa)
#     KHÔNG tag cửa, KHÔNG thống kê – vách kính đã có tên riêng (Mark). vk_trong_vach nhận các cửa đó.
#   - Việc có xoá (tag cửa cũ trên cửa trong vách kính, chữ + nét của bảng vẽ lại) luôn hỏi Yes / No trước (vk_hoi).
VK_TAG = u"ARV_Tag Vach Kinh Mark"
VK_KHE_MM = 1.0           # khe giữa mép vách và khung tag (mm giấy)
VK_NUA_DAY_MM = 100.0     # nửa bề dày vách kính khi tường không có Width (đố 65 x ~190)
VK_SO_NAC = 6             # số nấc đẩy tag ra xa vách khi sát vách không còn chỗ (mỗi nấc = bề dày tag + 1 mm giấy)
VK_TIA_M = 25.0           # tia dò phía ngoài nhà: đi xa chừng này mà không chạm tường khác = phía ngoài


def vk_la_vach(e):
    try:
        return e.WallType.Kind == WallKind.Curtain
    except Exception:
        return False


def vk_trong_vach(e):
    """Cửa đi / cửa sổ nằm trong vách kính: host là curtain wall (kể cả tấm vách kính là family cửa đi / cửa sổ)."""
    try:
        h = e.Host
    except Exception:
        return False
    return h is not None and vk_la_vach(h)


def vk_hoi(bien_mt, tieu_de, chinh, noi_dung, mo_rong=u""):
    """Hỏi Yes / No trước khi xoá (quy tắc: có xoá thì liệt kê + chờ xác nhận). Biến môi trường <bien_mt> = 1 / 0 trả lời
    sẵn (chạy thử nền, không hiện hộp thoại)."""
    tl = os.environ.get(bien_mt, "")
    if tl in ("1", "0"):
        return tl == "1"
    clr.AddReference("RevitAPIUI")
    from Autodesk.Revit.UI import TaskDialog, TaskDialogCommonButtons, TaskDialogResult
    td = TaskDialog(tieu_de)
    td.MainInstruction = chinh
    td.MainContent = noi_dung
    if mo_rong:
        td.ExpandedContent = mo_rong
    td.CommonButtons = TaskDialogCommonButtons.Yes | TaskDialogCommonButtons.No
    td.DefaultButton = TaskDialogResult.Yes
    return td.Show() == TaskDialogResult.Yes


def vk_trong_view(doc, view):
    """Curtain wall thấy trong view: model chính + file link đúng tầng (LkPT)."""
    kq = [e for e in FilteredElementCollector(doc, view.Id).OfClass(Wall) if vk_la_vach(e)]
    lv = view.GenLevel
    for li, ld, tf in lk_cac_link(doc, view):
        ids = lk_level_khop(ld, tf, lv) if lv is not None else None
        if ids is not None and not ids:
            continue
        for e in FilteredElementCollector(doc, view.Id, li.Id).OfClass(Wall):
            if vk_la_vach(e) and (ids is None or e.LevelId.Value in ids):
                kq.append(LkPT(e, li, tf))
    return kq


def vk_mark(e):
    p = e.get_Parameter(BuiltInParameter.ALL_MODEL_MARK)
    return (p.AsString() or u"").strip() if p is not None else u""


def vk_dat_mark(doc, json_dat, dry, bao, xem_lai):
    """Đặt Mark cho vách kính theo JSON [{"ids": [...], "moi": "T1-VK.61"}]."""
    if not json_dat:
        return
    import json
    try:
        ds = json.loads(json_dat)
    except Exception as ex:
        bao.append(u"IN[9] không phải JSON hợp lệ: %s" % ex)
        return
    if not ds:
        return
    bao.append(u"")
    bao.append(u"== ĐẶT TÊN VÁCH KÍNH (Mark) – %d dòng%s" % (len(ds), u" (DRY-RUN)" if dry else u""))
    dang_doi = set(int(i) for d in ds for i in d.get("ids", []))
    khac = {}
    for e in FilteredElementCollector(doc).OfClass(Wall):
        if vk_la_vach(e) and e.Id.Value not in dang_doi and vk_mark(e):
            khac.setdefault(vk_mark(e), []).append(e.Id.Value)
    if not dry:
        TransactionManager.Instance.EnsureInTransaction(doc)
    for d in ds:
        moi = (u"%s" % d.get("moi", u"")).strip()
        if not moi:
            continue
        n = 0
        for i in d.get("ids", []):
            e = doc.GetElement(ElementId(int(i)))
            p = e.get_Parameter(BuiltInParameter.ALL_MODEL_MARK) if e is not None else None
            if p is None or p.IsReadOnly:
                bao.append(u"   KHÔNG đặt được Mark cho vách id %s (không có / chỉ đọc)" % i)
                continue
            if not dry:
                p.Set(moi)
            n += 1
        bao.append(u"   %s → %s  (%d vách: %s)" % (d.get("cu") or u"(trống)", moi, n,
                                                    u", ".join(u"%s" % i for i in d.get("ids", [])[:8])))
        if moi in khac:
            xem_lai.append(u"Mark '%s' đã có ở vách kính khác (id %s) – 2 vách cùng tên." % (
                moi, u", ".join(u"%d" % i for i in khac[moi][:5])))
    if not dry:
        doc.Regenerate()


def vk_thu_muc_tag():
    i_ = globals().get("VK_IN_THU_MUC")
    d = (u"%s" % (doc_in(i_) or u"")).strip() if i_ is not None else u""
    if d:
        return d
    try:
        f = globals().get("__file__")
        if f:
            return os.path.normpath(os.path.join(os.path.dirname(os.path.abspath(f)), u"..", u"..", u"..", u"lib",
                                                 u"tag_vach_kinh"))
    except Exception:
        pass
    return u""


def vk_tuy_chon_nap():
    """IFamilyLoadOptions: family đã có thì giữ nguyên. Tên lớp .NET riêng mỗi lần gọi."""
    import uuid
    ns = "ARV.VachKinh.N" + uuid.uuid4().hex

    class _Nap(_RevitDB.IFamilyLoadOptions):
        __namespace__ = ns

        def OnFamilyFound(self, familyInUse, overwriteParameterValues):
            return (True, False)

        def OnSharedFamilyFound(self, sharedFamily, familyInUse, source, overwriteParameterValues):
            return (True, _RevitDB.FamilySource.Family, False)

    return _Nap()


def vk_ten_kieu(s):
    p = s.get_Parameter(BuiltInParameter.SYMBOL_NAME_PARAM)
    return u"%s : %s" % (s.FamilyName, p.AsString() if p is not None else u"")


def vk_kieu_tag(doc, ten_kieu, dry, bao):
    """Kiểu tag tường để tag vách: theo tên "Family : Type" (IN[11]); trống → family VK_TAG, chưa có thì nạp bản đóng gói."""
    ds = list(FilteredElementCollector(doc).OfClass(FamilySymbol).OfCategory(BuiltInCategory.OST_WallTags))
    ten_kieu = (ten_kieu or u"").strip()
    if ten_kieu:
        for s in ds:
            if vk_ten_kieu(s) == ten_kieu or s.FamilyName == ten_kieu:
                return s
        bao.append(u"Không thấy kiểu tag '%s' trong dự án → dùng '%s'." % (ten_kieu, VK_TAG))
    for s in ds:
        if s.FamilyName == VK_TAG:
            return s
    duong = os.path.join(vk_thu_muc_tag(), VK_TAG + u".rfa")
    if not os.path.isfile(duong):
        bao.append(u"CHƯA CÓ family tag '%s' trong dự án và không thấy file đóng gói '%s' → không tag." % (VK_TAG, duong))
        return None
    if dry:
        bao.append(u"Sẽ nạp family tag '%s' từ %s." % (VK_TAG, duong))
        return None
    TransactionManager.Instance.EnsureInTransaction(doc)
    try:
        doc.LoadFamily(duong, vk_tuy_chon_nap())
    except Exception as ex:
        bao.append(u"KHÔNG nạp được family tag '%s' từ %s: %s" % (VK_TAG, duong, (u"%s" % ex).splitlines()[0][:200]))
        return None
    finally:
        TransactionManager.Instance.TransactionTaskDone()
    for s in FilteredElementCollector(doc).OfClass(FamilySymbol).OfCategory(BuiltInCategory.OST_WallTags):
        if s.FamilyName == VK_TAG:
            bao.append(u"Nạp family tag '%s' từ %s." % (VK_TAG, duong))
            return s
    bao.append(u"Nạp '%s' xong nhưng KHÔNG thấy kiểu tag." % duong)
    return None


def vk_tag(doc, view, ten_kieu, dry, bao, xem_lai):
    vs = vk_trong_view(doc, view)
    bao.append(u"")
    bao.append(u"== TAG VÁCH KÍNH BẰNG MARK%s: %d vách kính thấy trong mặt bằng" % (u" (DRY-RUN)" if dry else u"", len(vs)))
    if not vs:
        return
    da_tag = set()
    for tg in FilteredElementCollector(doc, view.Id).OfClass(IndependentTag):
        if tg.Category is not None and tg.Category.Id.Value == int(BuiltInCategory.OST_WallTags):
            da_tag.update(lk_khoa_tag(tg))
    da = [e for e in vs if e.Id.Value in da_tag]
    con = [e for e in vs if e.Id.Value not in da_tag]
    thieu = [e for e in con if not vk_mark(e)]
    can = [e for e in con if vk_mark(e)]
    bao.append(u"   đã có tag: %d | sẽ tag: %d | chưa có Mark (không tag): %d" % (len(da), len(can), len(thieu)))
    if thieu:
        xem_lai.append(u"%d vách kính chưa có Mark nên chưa tag (id %s) – đặt Mark (nút Thống kê cửa → cửa sổ Vách kính) rồi bấm lại." % (
            len(thieu), u", ".join(u"%s" % e.Id.Value for e in thieu[:12])))
    dem = {}
    for e in vs:
        if vk_mark(e):
            dem.setdefault(vk_mark(e), []).append(e.Id.Value)
    for mk in sorted(dem):
        if len(dem[mk]) > 1:
            xem_lai.append(u"Mark '%s' đặt cho %d vách kính (id %s)." % (mk, len(dem[mk]), u", ".join(u"%s" % i for i in dem[mk][:6])))
    try:
        if view.GetCategoryHidden(ElementId(BuiltInCategory.OST_WallTags)):
            xem_lai.append(u"Hạng mục Wall Tags đang TẮT trong view / view template – tag vách kính tạo ra sẽ không hiện.")
    except Exception:
        pass
    if not can:
        return
    kieu = vk_kieu_tag(doc, ten_kieu, dry, bao)
    if kieu is None:
        return
    bao.append(u"   kiểu tag: %s" % vk_ten_kieu(kieu))
    if dry:
        return
    sc = float(view.Scale)
    ft = lambda v_mm: UnitUtils.ConvertToInternalUnits(v_mm, UnitTypeId.Millimeters)
    R, U = view.RightDirection, view.UpDirection
    uv = lambda p: (p.DotProduct(R), p.DotProduct(U))
    z_room = (view.GenLevel.Elevation if view.GenLevel is not None else 0.0) + ft(500)

    def co_phong(p):
        q = XYZ(p.X, p.Y, z_room)
        try:
            if doc.GetRoomAtPoint(q) is not None:
                return True
        except Exception:
            pass
        return lk_room_moi_link(doc, q, view.GenLevel) is not None

    # vật cản: tag + chữ đang có (khung bao trong view), tim mọi tường thấy trong view (kèm nửa bề dày)
    hop = []          # (u0, v0, u1, v1)
    for cls in (IndependentTag, TextNote):
        for x in FilteredElementCollector(doc, view.Id).OfClass(cls):
            bb = x.get_BoundingBox(view)
            if bb is not None:
                a, b = uv(bb.Min), uv(bb.Max)
                hop.append((min(a[0], b[0]), min(a[1], b[1]), max(a[0], b[0]), max(a[1], b[1])))
    for bic in (BuiltInCategory.OST_Doors, BuiltInCategory.OST_Windows):
        for x in FilteredElementCollector(doc, view.Id).OfCategory(bic).WhereElementIsNotElementType():
            bb = x.get_BoundingBox(view)
            if bb is not None:
                a, b = uv(bb.Min), uv(bb.Max)
                hop.append((min(a[0], b[0]), min(a[1], b[1]), max(a[0], b[0]), max(a[1], b[1])))
        # cửa trong file link: không lấy được khung bao theo view (thiếu nét cánh mở) → khung bao khối, cửa đi nới thêm bán
        # kính cánh mở ước lượng theo phương vuông góc (rộng ≤ 1100: 1 cánh = bề rộng; rộng hơn: 2 cánh = nửa bề rộng)
        for x in lk_thay(doc, view, bic, True):
            try:
                bb = x.get_BoundingBox(None)
                if bb is None:
                    continue
                a, b = uv(bb.Min), uv(bb.Max)
                u0, v0, u1, v1 = min(a[0], b[0]), min(a[1], b[1]), max(a[0], b[0]), max(a[1], b[1])
                if bic == BuiltInCategory.OST_Doors:
                    dai = max(u1 - u0, v1 - v0)
                    r_ = dai if dai <= ft(1100) else dai / 2.0
                    if (u1 - u0) >= (v1 - v0):
                        v0, v1 = v0 - r_, v1 + r_
                    else:
                        u0, u1 = u0 - r_, u1 + r_
                hop.append((u0, v0, u1, v1))
            except Exception:
                pass
    doan = []         # (id, (u, v) đầu, (u, v) cuối, nửa dày)
    tuong = list(FilteredElementCollector(doc, view.Id).OfClass(Wall)) + lk_thay(doc, view, BuiltInCategory.OST_Walls, True)
    for x in tuong:
        try:
            c = x.Location.Curve
            nd = max(x.Width / 2.0, ft(VK_NUA_DAY_MM) if vk_la_vach(x) else 0.0)
            ds_p = [c.GetEndPoint(0), c.GetEndPoint(1)] if c.GetType().Name == "Line" else list(c.Tessellate())
            for i in range(len(ds_p) - 1):
                doan.append((x.Id.Value, uv(ds_p[i]), uv(ds_p[i + 1]), nd))
        except Exception:
            pass

    def cat_doan(h, a, b, nd):
        """Hình chữ nhật h (nới nd) có chạm đoạn a-b không (Liang–Barsky)."""
        x0, y0, x1, y1 = h[0] - nd, h[1] - nd, h[2] + nd, h[3] + nd
        dx, dy = b[0] - a[0], b[1] - a[1]
        t0, t1 = 0.0, 1.0
        for p_, q_ in ((-dx, a[0] - x0), (dx, x1 - a[0]), (-dy, a[1] - y0), (dy, y1 - a[1])):
            if abs(p_) < 1e-12:
                if q_ < 0:
                    return False
                continue
            r_ = q_ / p_
            if p_ < 0:
                t0 = max(t0, r_)
            else:
                t1 = min(t1, r_)
            if t0 > t1:
                return False
        return True

    def vuong(h, bo_id):
        for k in hop:
            if h[0] < k[2] and k[0] < h[2] and h[1] < k[3] and k[1] < h[3]:
                return True
        for i, a, b, nd in doan:
            if i != bo_id and cat_doan(h, a, b, nd):
                return True
        return False

    def tia_thoat(g, hu, hv, bo_id):
        """Số tia (0°, ±30°) từ điểm g theo hướng (hu, hv) đi VK_TIA_M mét mà không chạm tường nào khác."""
        import math
        xa_ = ft(VK_TIA_M * 1000.0)
        so_ = 0
        for goc_ in (0.0, math.radians(30), -math.radians(30)):
            cu_, su_ = math.cos(goc_), math.sin(goc_)
            du_, dv_ = hu * cu_ - hv * su_, hu * su_ + hv * cu_
            cham = False
            for i, a, b, nd in doan:
                if i == bo_id:
                    continue
                ex, ey = b[0] - a[0], b[1] - a[1]
                mau = du_ * ey - dv_ * ex
                if abs(mau) < 1e-12:
                    continue
                t_ = ((a[0] - g[0]) * ey - (a[1] - g[1]) * ex) / mau
                s_ = ((a[0] - g[0]) * dv_ - (a[1] - g[1]) * du_) / mau
                if 1e-6 < t_ < xa_ and -1e-9 <= s_ <= 1 + 1e-9:
                    cham = True
                    break
            if not cham:
                so_ += 1
        return so_

    TransactionManager.Instance.EnsureInTransaction(doc)
    if not kieu.IsActive:
        kieu.Activate()
    viec = []
    for e in can:
        try:
            c = e.Location.Curve
            giua = c.Evaluate(0.5, True)
            d = c.ComputeDerivatives(0.5, True).BasisX.Normalize()
            du, dv = uv(d)
            huong = TagOrientation.Vertical if abs(dv) > abs(du) else TagOrientation.Horizontal
            tg = IndependentTag.Create(doc, kieu.Id, view.Id, lk_tham_chieu(e), False, huong, giua)
            viec.append((e, c, d, tg, giua))
        except Exception as ex:
            xem_lai.append(u"Vách id %s (Mark %s): không tag được – %s" % (e.Id.Value, vk_mark(e), (u"%s" % ex).splitlines()[0][:120]))
    doc.Regenerate()
    so, vuong_ds = 0, []
    for e, c, d, tg, giua in viec:
        bb = tg.get_BoundingBox(view)
        if bb is None:
            xem_lai.append(u"Vách id %s: tag không hiện trong view (hạng mục / template ẩn?)." % e.Id.Value)
            so += 1
            continue
        a, b = uv(bb.Min), uv(bb.Max)
        nu, nv = abs(b[0] - a[0]) / 2.0, abs(b[1] - a[1]) / 2.0            # nửa rộng / nửa cao khung tag trên view
        tam0 = ((a[0] + b[0]) / 2.0, (a[1] + b[1]) / 2.0)
        dau0 = uv(tg.TagHeadPosition)
        lech = (tam0[0] - dau0[0], tam0[1] - dau0[1])                     # tâm khung so với điểm đặt
        n = XYZ(-d.Y, d.X, 0.0)
        nu_, nv_ = uv(n)
        nua_tag = abs(nu_) * nu + abs(nv_) * nv                           # nửa khung tag theo phương vuông góc vách
        nd = max(e.Width / 2.0, ft(VK_NUA_DAY_MM))
        xa = nd + ft(VK_KHE_MM) * sc + nua_tag
        # phía ngoài nhà: phía có nhiều tia đi xa mà không chạm tường khác; bằng nhau thì phía không có room; vẫn không rõ
        # thì theo mặt ngoài của tường
        gu, gv = uv(giua)
        le_ = nd + ft(50)
        ta = tia_thoat((gu + nu_ * le_, gv + nv_ * le_), nu_, nv_, e.Id.Value)
        tb = tia_thoat((gu - nu_ * le_, gv - nv_ * le_), -nu_, -nv_, e.Id.Value)
        if ta != tb:
            ngoai = 1.0 if ta > tb else -1.0
        else:
            pa, pb = co_phong(giua + n * ft(700)), co_phong(giua - n * ft(700))
            if pa != pb:
                ngoai = -1.0 if pa else 1.0
            else:
                try:
                    ngoai = 1.0 if e.Orientation.DotProduct(n) >= 0 else -1.0
                except Exception:
                    ngoai = 1.0
        chon = None
        ung = []
        for t_ in (0.5, 0.4, 0.6, 0.3, 0.7, 0.2, 0.8, 0.12, 0.88):
            for phia in (ngoai, -ngoai):
                ung.append((t_, phia))
        ung.sort(key=lambda k: (k[1] != ngoai, abs(k[0] - 0.5)))       # phía ngoài trước, gần giữa vách trước
        ung = [(t_, phia, xa) for t_, phia in ung]
        # vách ngắn bị cửa chiếm hết chiều dài: đẩy tag ra xa dần (vượt cung mở cửa), giữa vách, phía ngoài rồi phía trong
        buoc = 2.0 * nua_tag + ft(1.0) * sc
        for phia in (ngoai, -ngoai):
            for k_ in range(1, VK_SO_NAC + 1):
                ung.append((0.5, phia, xa + k_ * buoc))
        for t_, phia, xa_ in ung:
            p = c.Evaluate(t_, True) + n * (phia * xa_)
            pu, pv = uv(p)
            h = (pu - nu, pv - nv, pu + nu, pv + nv)
            if not vuong(h, e.Id.Value):
                chon = (p, h)
                break
        if chon is None:
            p = giua + n * (ngoai * xa)
            pu, pv = uv(p)
            chon = (p, (pu - nu, pv - nv, pu + nu, pv + nv))
            vuong_ds.append(u"%s (id %s)" % (vk_mark(e), e.Id.Value))
        p, h = chon
        # điểm đặt = tâm mong muốn - độ lệch tâm khung
        dich = XYZ(p.X, p.Y, tg.TagHeadPosition.Z) - R * lech[0] - U * lech[1]
        tg.TagHeadPosition = XYZ(dich.X, dich.Y, tg.TagHeadPosition.Z)
        hop.append(h)
        so += 1
    doc.Regenerate()
    TransactionManager.Instance.TransactionTaskDone()
    bao.append(u"   đã tag %d vách kính." % so)
    if vuong_ds:
        xem_lai.append(u"%d tag vách kính không tìm được chỗ trống (đang đè tường / tag / chữ khác), cần dời tay: %s" % (
            len(vuong_ds), u", ".join(vuong_ds[:15])))


def vk_ve_bang(doc, v, tieu_de, cot, rong_cot, dong):
    """Vẽ nội dung bảng vào drafting view v (cùng cách trình bày với lk_bang_ve)."""
    cao_dong, cao_dau = _lk_mm(8), _lk_mm(10)
    kieu = sorted(FilteredElementCollector(doc).OfClass(TextNoteType), key=lambda t: t.Id.Value)

    def diem_kieu(t):
        ten_k = (t.get_Parameter(BuiltInParameter.SYMBOL_NAME_PARAM).AsString() or u"").lower()
        co = t.get_Parameter(BuiltInParameter.TEXT_SIZE).AsDouble()
        return (0 if u"arial" in ten_k else 1, abs(co - _lk_mm(2.5)))
    kt = min(kieu, key=diem_kieu)
    tong = sum(_lk_mm(x) for x in rong_cot)
    tao_chu = lambda x_, y_, s_: TextNote.Create(doc, v.Id, XYZ(x_, y_, 0), s_, kt.Id)
    tao_net = lambda a_, b_: doc.Create.NewDetailCurve(v, Line.CreateBound(a_, b_))
    tao_chu(_lk_mm(2), cao_dau * 1.5, tieu_de)
    xs = [0.0]
    for r_ in rong_cot:
        xs.append(xs[-1] + _lk_mm(r_))
    y_day = -cao_dong * len(dong)
    for i_ in range(len(dong) + 2):
        y_ = cao_dau if i_ == 0 else -cao_dong * (i_ - 1)
        tao_net(XYZ(0, y_, 0), XYZ(tong, y_, 0))
    for x_ in xs:
        tao_net(XYZ(x_, cao_dau, 0), XYZ(x_, y_day, 0))
    for c_ in range(len(cot)):
        tao_chu(xs[c_] + _lk_mm(2), cao_dau - _lk_mm(3), cot[c_])
    for r_i, d in enumerate(dong):
        for c_ in range(len(cot)):
            if d[c_] != u"":
                tao_chu(xs[c_] + _lk_mm(2), -cao_dong * r_i - _lk_mm(2), d[c_])


def vk_bang_ve(doc, ten_view, tieu_de, cot, rong_cot, dong):
    """Như lk_bang_ve; riêng bảng đã có mà số ô đã đổi (vd. bỏ cửa nằm trong vách kính) thì HỎI rồi vẽ lại ngay trong view
    đó: xoá chữ + nét cũ của bảng, vẽ theo số liệu mới, giữ nguyên góc phải dưới của bảng trên bản vẽ. Gọi TRONG
    transaction. Biến môi trường ARV_VE_LAI_BANG = 1 / 0 trả lời sẵn. Trả về (view, cách làm)."""
    v, cach = lk_bang_ve(doc, ten_view, tieu_de, cot, rong_cot, dong)
    if u"CHƯA cập nhật" not in cach:
        return v, cach
    chu = list(FilteredElementCollector(doc, v.Id).OfClass(TextNote))
    net = list(FilteredElementCollector(doc, v.Id).OfClass(CurveElement))
    if not vk_hoi("ARV_VE_LAI_BANG", u"Vẽ lại bảng thống kê", u"Bảng '%s' đã có nhưng số dòng đã đổi." % ten_view,
                  u"Vẽ lại bảng ngay trong view đó?\n\nYes: XOÁ %d chữ + %d nét cũ của bảng rồi vẽ lại theo số liệu mới "
                  u"(view và chỗ đặt trên bản vẽ giữ nguyên, góc phải dưới không đổi). Ctrl+Z để hoàn tác.\n"
                  u"No: giữ nguyên bảng cũ." % (len(chu), len(net)),
                  u"Id chữ: %s\nId nét: %s" % (u", ".join(u"%d" % x.Id.Value for x in chu[:200]),
                                               u", ".join(u"%d" % x.Id.Value for x in net[:200]))):
        return v, cach
    def goc_nhan(vp):
        """Góc dưới trái của nhãn tên viewport trên bản vẽ (None nếu viewport không có nhãn)."""
        try:
            return vp.GetLabelOutline().MinimumPoint
        except Exception:
            return None
    vps = [(vp, vp.GetBoxOutline(), goc_nhan(vp)) for vp in FilteredElementCollector(doc).OfClass(Viewport)
           if vp.ViewId.Value == v.Id.Value]
    from System.Collections.Generic import List
    ids = List[ElementId]()
    for x in chu + net:
        ids.Add(x.Id)
    doc.Delete(ids)
    vk_ve_bang(doc, v, tieu_de, cot, rong_cot, dong)
    doc.Regenerate()
    for vp, o, nhan0 in vps:    # giữ góc phải dưới của bảng trên bản vẽ; nhãn tên viewport (nếu có) ở yên chỗ cũ
        try:
            n = vp.GetBoxOutline()
            c = vp.GetBoxCenter()
            vp.SetBoxCenter(XYZ(c.X + (o.MaximumPoint.X - n.MaximumPoint.X), c.Y + (o.MinimumPoint.Y - n.MinimumPoint.Y), c.Z))
        except Exception:
            pass
        try:
            if nhan0 is not None:
                doc.Regenerate()
                nhan1 = goc_nhan(vp)
                if nhan1 is not None:
                    lo = vp.LabelOffset
                    vp.LabelOffset = XYZ(lo.X + (nhan0.X - nhan1.X), lo.Y + (nhan0.Y - nhan1.Y), lo.Z)
        except Exception:
            pass
    return v, u"vẽ lại bảng đã có (xoá %d chữ + %d nét cũ, vẽ theo số liệu mới)" % (len(chu), len(net))
# ==== HẾT PHẦN CHUNG VÁCH KÍNH ====


def _chinh():
    doc = DocumentManager.Instance.CurrentDBDocument
    bao = []
    ten_view = doc_in(0)
    if ten_view:
        ung = [v for v in FilteredElementCollector(doc).OfClass(ViewPlan) if not v.IsTemplate and v.Name == ten_view]
        ung.sort(key=lambda v: 0 if v.ViewType == ViewType.FloorPlan else 1)
        av = doc.ActiveView
        if av is not None and any(v.Id.Value == av.Id.Value for v in ung):
            ung = [av]
        view = ung[0] if ung else None
        if view is None:
            return [u"Không có view mặt bằng tên '%s'." % ten_view]
    else:
        view = doc.ActiveView
    if view is None or view.ViewType not in (ViewType.FloorPlan, ViewType.EngineeringPlan, ViewType.AreaPlan) \
            or view.GenLevel is None:
        return [u"View '%s' không phải mặt bằng tầng. Mở mặt bằng cần thống kê rồi chạy lại." % (ten(view) if view else "-")]
    lv = view.GenLevel
    dry = bool(doc_in(3))
    loai_tru = tach(doc_in(2))
    loai_tru_thuong = [khong_dau(x) for x in loai_tru]
    chon = [khong_dau(x) for x in tach(doc_in(1))]
    hang_muc = [h for h in HANG_MUC if any(h[0] in c for c in chon)]
    if not hang_muc:
        return [u"IN[1] không có hạng mục nào nhận được (Cửa đi / Cửa sổ)."]
    bao.append(u"Mặt bằng: %s – tầng %s%s" % (view.Name, lv.Name, u" (DRY-RUN: chỉ báo cáo)" if dry else u""))
    mau = doc_in(4) or MAC_DINH[4]
    xem_lai = []
    bang_tao = []
    doi_ten(doc, doc_in(7), dry, bao, xem_lai)
    vk_dat_mark(doc, doc_in(9), dry, bao, xem_lai)
    lam_bang = bool(doc_in(8))
    if not lam_bang:
        hang_muc = []
        bao.append(u"Không tạo bảng thống kê Revit (IN[8] tắt).")
    for _, bic, nhan, rong_bip, cao_bip in hang_muc:
        bo_vk = not bool(doc_in(13))
        nhom, bo, bo_tc, khac_tang, so_vk = dem_trong_view(doc, view, bic, rong_bip, cao_bip, loai_tru_thuong, bo_vk)
        tong = sum(g["so"] for g in nhom.values())
        theo_tang, vk_tang = dem_theo_tang(doc, lv, bic, loai_tru_thuong, view, bo_vk)
        co_link = bool(lk_thay(doc, view, bic, True))
        ve_tay = co_link or vk_tang > 0      # bảng vẽ: có cửa trong file link, hoặc tầng có cửa nằm trong vách kính phải bỏ
        ten_bang = mau.replace(u"{loai}", nhan).replace(u"{tang}", lv.Name.upper()).replace(u"{view}", view.Name)
        bao.append(u"")
        bao.append(u"== %s: %d cái thấy trong mặt bằng, %d ký hiệu (mỗi ký hiệu 1 dòng)%s" % (
            nhan, tong, len(nhom), (u", bỏ %d cái Type Comments có chữ %s (%s)" % (
                bo, u" / ".join(loai_tru), u"; ".join(sorted(bo_tc))[:200])) if bo else u"") + (
                (u", bỏ %d cái nằm trong vách kính (vách kính có tên riêng theo Mark)" % so_vk) if so_vk else u""))
        for mk in sorted(nhom, key=lambda k: (k == u"", k)):
            g = nhom[mk]
            kt = sorted(g["kt"], key=lambda x: (x[0] or 0, x[1] or 0))
            bao.append(u"   %-14s %s  x%d" % (mk or u"(trống)", u", ".join(u"%sx%s" % (a or u"?", b or u"?") for a, b in kt),
                                            g["so"]))
            if not mk:
                xem_lai.append(u"%s chưa có Type Mark (%d cái, gộp chung 1 dòng trống): %s" % (
                    nhan, g["so"], u"; ".join(sorted(g["type"]))[:300]))
            elif len(kt) > 1:
                xem_lai.append(u"%s '%s' cùng ký hiệu nhưng khác kích thước %s – ô Rộng / Cao để trống: %s" % (
                    nhan, mk, u", ".join(u"%sx%s" % k for k in kt), u"; ".join(sorted(g["type"]))[:300]))
        if khac_tang:
            xem_lai.append(u"%d %s thấy trong mặt bằng nhưng Level khác tầng %s – bảng KHÔNG đếm (vd. id %s)." % (
                len(khac_tang), nhan.lower(), lv.Name, u", ".join(str(e.Id.Value) for e in khac_tang[:5])))
        if theo_tang != tong and ve_tay:
            xem_lai.append(u"%s: tầng %s có %d cái, mặt bằng chỉ thấy %d (crop / ẩn) – bảng vẽ rời chỉ đếm %d cái thấy "
                           u"trong mặt bằng này." % (nhan, lv.Name, theo_tang, tong, tong))
        elif theo_tang != tong and not doc_in(6):
            xem_lai.append(u"%s: tầng %s có %d cái, mặt bằng chỉ thấy %d (crop / ẩn) – bảng lọc theo tầng nên đếm %d; đặt "
                           u"bảng lên sheet của mặt bằng này và bật IN[6] (Shift+bấm) thì bảng chỉ đếm cửa thấy trên sheet."
                           % (nhan, lv.Name, theo_tang, tong, theo_tang))
        if dry:
            bao.append(u"   Sẽ tạo / cập nhật bảng '%s'." % ten_bang)
            continue
        TransactionManager.Instance.EnsureInTransaction(doc)
        st = SubTransaction(doc)            # bảng lỗi giữa chừng thì huỷ riêng bảng đó
        st.Start()
        try:
            if ve_tay:
                dong_bang = []
                for mk in sorted(nhom, key=lambda k: (k == u"", k)):
                    g = nhom[mk]
                    kt = sorted(g["kt"], key=lambda x: (x[0] or 0, x[1] or 0))
                    r_, c_ = (kt[0] if len(kt) == 1 else (None, None))
                    dong_bang.append([mk or u"(trống)", u"%s" % r_ if r_ else u"", u"%s" % c_ if c_ else u"", u"%d" % g["so"]])
                dong_bang.append([u"TỔNG", u"", u"", u"%d" % tong])
                vs, cach = vk_bang_ve(doc, ten_bang, ten_bang, COT, [34, 22, 22, 20], dong_bang)
                if co_link:
                    bao.append(u"   Bảng lấy từ file link: Revit không lọc được bảng thống kê theo tầng cho đối tượng trong link "
                               u"nên vẽ thành bảng rời; đổi cửa thì bấm lại nút để cập nhật.")
                else:
                    bao.append(u"   Tầng có %d cửa nằm trong vách kính (không thống kê): bảng thống kê Revit không lọc được theo "
                               u"vách chủ nên vẽ thành bảng rời; đổi cửa thì bấm lại nút để cập nhật." % vk_tang)
                    if any(not x.IsTemplate and x.Name == ten_bang for x in FilteredElementCollector(doc).OfClass(ViewSchedule)):
                        xem_lai.append(u"Bảng thống kê Revit '%s' có từ trước vẫn đếm cả cửa nằm trong vách kính – công cụ "
                                       u"không xoá; dùng bảng vẽ cùng tên (Drafting Views)." % ten_bang)
            else:
                vs, cach = lap_bang(doc, bic, ten_bang, lv, loai_tru, rong_bip, cao_bip, bool(doc_in(6)))
            doc.Regenerate()
            st.Commit()
            bang_tao.append(vs)
            bao.append(u"   Bảng '%s' (%s):" % (ten_bang, cach))
            for d_ in ([] if ve_tay else doc_bang(vs)):
                bao.append(u"      " + d_)
        except Exception as ex:
            if st.HasStarted() and not st.HasEnded():
                st.RollBack()
            bao.append(u"   KHÔNG tạo được bảng '%s': %s" % (ten_bang, (u"%s" % ex).splitlines()[0][:200]))
    TransactionManager.Instance.TransactionTaskDone()
    if doc_in(10):
        vk_tag(doc, view, doc_in(11), dry, bao, xem_lai)
    if xem_lai:
        bao.append(u"")
        bao.append(u"CẦN XEM LẠI:")
        bao.extend(u" - " + s for s in xem_lai)
    if bang_tao and doc_in(5):
        try:
            DocumentManager.Instance.CurrentUIDocument.RequestViewChange(bang_tao[0])
        except Exception:
            pass
    return bao


try:
    OUT = _chinh()
except Exception:
    try:
        TransactionManager.Instance.ForceCloseTransaction()
    except Exception:
        pass
    OUT = [u"LỖI:", traceback.format_exc()]
# ----------------------------------------

# group: Đầu ra
báo_cáo = Watch(thongKeCua_TuDong)  # graph output
